# Grasshopper definition a03_custom-joints.ghx (Grasshopper 1.0.8)
# Copyright: Lorin Wiedemeier

crv = Curve(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)
crv_2 = Curve(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)
crv_3 = Curve(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)
install = CompasPyTemplate(a=crv)  # -> a
# ---------- install: Python ----------
# r: compas==2.15.1,timber_design==0.2.0,compas_fab==1.1.4
# venv: ca-fs26-focus-work

ghenv.Component.Message = "Install"
# ---------- end install ----------
explode = Explode(Curve=crv_3, Recursive=True)  # -> Segments, Vertices
forced_joint = Python3Script(main_curve=install, cross_curve=crv_2, mill_depth=Slider(0.008, range=0..0.1))  # -> out, main_beam_out, cross_beam_out; inputs main_curve: Curve, cross_curve: Curve
# ---------- forced_joint: Python ----------
# r: compas==2.15.1,timber_design==0.2.0,compas_fab==1.1.4
# venv: ca-fs26-focus-work

from compas_rhino.devtools import DevTools

DevTools.ensure_path()
ghenv.Component.Message = "Test Preferred TButt"

import Rhino.Geometry as rg

from compas.geometry import Line
from compas.geometry import Point
from compas.geometry import Vector
from compas.scene import SceneObject
from compas_timber.elements import Beam
from compas_timber.model import TimberModel
from timber_design.workflow import DirectRule
from timber_design.workflow import JointRuleSolver

from a03_preferred_face_tbutt_joint import PreferredFaceTButtJoint


beam_width = vars().get("beam_width") or 0.060
beam_height = vars().get("beam_height") or 0.080
joint_max_distance = vars().get("joint_max_distance") or 0.020
mill_depth = vars().get("mill_depth") or 0.001
process_joinery = True if vars().get("process_joinery") is None else vars().get("process_joinery")
preferred_face_vector = vars().get("preferred_face_vector") or Vector(0, 0, 1)
cross_beam_ref_side_index = vars().get("cross_beam_ref_side_index")


def rhino_curve_to_line(curve):
    if isinstance(curve, rg.Line):
        line = curve
    elif isinstance(curve, rg.LineCurve):
        line = curve.Line
    elif isinstance(curve, rg.PolylineCurve):
        polyline = curve.ToPolyline()
        if polyline.Count < 2:
            raise ValueError("PolylineCurve must have at least two points.")
        line = rg.Line(polyline[0], polyline[polyline.Count - 1])
    else:
        success, line = rg.Curve.TryGetLine(curve)
        if not success:
            line = rg.Line(curve.PointAtStart, curve.PointAtEnd)

    return Line(
        Point(line.From.X, line.From.Y, line.From.Z),
        Point(line.To.X, line.To.Y, line.To.Z),
    )


def vector_to_compas(vector):
    if isinstance(vector, Vector):
        return vector
    return Vector(vector.X, vector.Y, vector.Z)


def make_beam(curve):
    return Beam.from_centerline(
        rhino_curve_to_line(curve),
        width=beam_width,
        height=beam_height,
        z_vector=Vector(0, 0, 1),
    )


def to_rhino(geometry, errors):
    try:
        return SceneObject(item=geometry).draw()
    except Exception as error:
        errors.append("Rhino conversion: {!r}".format(error))
        return None


errors = []
timber_model = TimberModel()

main_beam = make_beam(main_curve)
cross_beam = make_beam(cross_curve)

timber_model.add_element(main_beam)
timber_model.add_element(cross_beam)

rule = DirectRule(
    PreferredFaceTButtJoint,
    [main_beam, cross_beam],
    max_distance=joint_max_distance,
    mill_depth=mill_depth,
    preferred_face_vector=vector_to_compas(preferred_face_vector),
    cross_beam_ref_side_index=cross_beam_ref_side_index,
)

solver = JointRuleSolver([rule])
joining_errors, unjoined_clusters = solver.apply_rules_to_model(timber_model)

if process_joinery:
    timber_model.process_joinery()

joints = list(getattr(timber_model, "joints", None) or getattr(timber_model, "interactions", None) or [])
joint_count = len(joints)
joint_errors = [getattr(error, "debug_info", repr(error)) for error in joining_errors]

beams = [main_beam, cross_beam]
beams_out = []
beams_rhino = []
for beam in beams:
    try:
        geometry = beam.geometry
        beams_out.append(geometry)
        beams_rhino.append(to_rhino(geometry, errors))
    except Exception as error:
        errors.append("{} geometry: {!r}".format(type(beam).__name__, error))
        beams_out.append(None)
        beams_rhino.append(None)

cross_ref_side_index = None
cross_ref_side = None
if joints:
    cross_ref_side_index = joints[0].cross_beam_ref_side_index
    cross_ref_side = cross_beam.ref_sides[cross_ref_side_index]

main_beam_out = main_beam.geometry
cross_beam_out = cross_beam.geometry
# ---------- end forced_joint ----------
item = ListItem(List=explode.Segments, Index=0, Wrap=True)  # -> Item, Item1
py3 = Python3Script(
    beam_a_curve=item.Item,
    beam_b_curve=item.Item1,
    cutoff_offset=Slider(0.03, range=0..0.1),
    limit_lap_removal=Toggle(True),
    flip_lap_side=Toggle(True),
    use_opposite_lap_cutoff_frame=Toggle(False),
    extend_lap_removal_to_inner_edge=Toggle(False))  # -> out, clip_status, beam_a_out, beam_b_out; inputs beam_a_curve: Curve, beam_b_curve: Curve, cutoff_offset: Double, cutoff_offset_a: Double, cutoff_offset_b: Double, limit_lap_removal: Boolean, flip_lap_side: Boolean, use_opposite_lap_cutoff_frame: Boolean, extend_lap_removal_to_inner_edge: Boolean
# ---------- py3: Python ----------
# r: compas==2.15.1,timber_design==0.2.0,compas_fab==1.1.4
# venv: ca-fs26-focus-work

from compas_rhino.devtools import DevTools

DevTools.ensure_path()
ghenv.Component.Message = "Test Cutoff L-Lap"

import Rhino.Geometry as rg
import importlib

from compas.geometry import Line
from compas.geometry import Point
from compas.geometry import Vector
from compas.scene import SceneObject
from compas_timber.elements import Beam
from compas_timber.model import TimberModel
from timber_design.workflow import DirectRule
from timber_design.workflow import JointRuleSolver

import a03_cutoff_l_lap_joint

importlib.reload(a03_cutoff_l_lap_joint)
from a03_cutoff_l_lap_joint import CutoffLLapJoint


beam_width = vars().get("beam_width") or 0.060
beam_height = vars().get("beam_height") or 0.080
joint_max_distance = vars().get("joint_max_distance") or 0.020
cut_plane_bias = vars().get("cut_plane_bias") or 0.5
cutoff_offset = vars().get("cutoff_offset") or 0.0
cutoff_offset_a = vars().get("cutoff_offset_a")
cutoff_offset_b = vars().get("cutoff_offset_b")
limit_lap_removal = True if vars().get("limit_lap_removal") is None else vars().get("limit_lap_removal")
invert_lap_removal_plane = vars().get("invert_lap_removal_plane") or False
extend_lap_removal_to_inner_edge = vars().get("extend_lap_removal_to_inner_edge") or False
use_opposite_cutoff_planes = vars().get("use_opposite_cutoff_planes") or False
use_opposite_lap_cutoff_frame = vars().get("use_opposite_lap_cutoff_frame") or False
flip_lap_side = vars().get("flip_lap_side") or False
process_joinery = True if vars().get("process_joinery") is None else vars().get("process_joinery")


def rhino_curve_to_line(curve):
    if isinstance(curve, rg.Line):
        line = curve
    elif isinstance(curve, rg.LineCurve):
        line = curve.Line
    elif isinstance(curve, rg.PolylineCurve):
        polyline = curve.ToPolyline()
        if polyline.Count < 2:
            raise ValueError("PolylineCurve must have at least two points.")
        line = rg.Line(polyline[0], polyline[polyline.Count - 1])
    else:
        try:
            success, line = curve.TryGetLine()
        except AttributeError:
            success = False
        if not success:
            line = rg.Line(curve.PointAtStart, curve.PointAtEnd)

    return Line(
        Point(line.From.X, line.From.Y, line.From.Z),
        Point(line.To.X, line.To.Y, line.To.Z),
    )


def make_beam(curve):
    return Beam.from_centerline(
        rhino_curve_to_line(curve),
        width=beam_width,
        height=beam_height,
        z_vector=Vector(0, 0, 1),
    )


def to_rhino(geometry, errors):
    try:
        return SceneObject(item=geometry).draw()
    except Exception as error:
        errors.append("Rhino conversion: {!r}".format(error))
        return None


errors = []
timber_model = TimberModel()

beam_a = make_beam(beam_a_curve)
beam_b = make_beam(beam_b_curve)

timber_model.add_element(beam_a)
timber_model.add_element(beam_b)

rule = DirectRule(
    CutoffLLapJoint,
    [beam_a, beam_b],
    max_distance=joint_max_distance,
    flip_lap_side=flip_lap_side,
    cut_plane_bias=cut_plane_bias,
    cutoff_offset=cutoff_offset,
    cutoff_offset_a=cutoff_offset_a,
    cutoff_offset_b=cutoff_offset_b,
    limit_lap_removal=limit_lap_removal,
    invert_lap_removal_plane=invert_lap_removal_plane,
    extend_lap_removal_to_inner_edge=extend_lap_removal_to_inner_edge,
    use_opposite_cutoff_planes=use_opposite_cutoff_planes,
    use_opposite_lap_cutoff_frame=use_opposite_lap_cutoff_frame,
)

solver = JointRuleSolver([rule])
joining_errors, unjoined_clusters = solver.apply_rules_to_model(timber_model)

if process_joinery:
    timber_model.process_joinery()

joints = list(getattr(timber_model, "joints", None) or getattr(timber_model, "interactions", None) or [])
joint_count = len(joints)
joint_errors = [getattr(error, "debug_info", repr(error)) for error in joining_errors]

beams = [beam_a, beam_b]
beams_out = []
beams_rhino = []
for beam in beams:
    try:
        geometry = beam.geometry
        beams_out.append(geometry)
        beams_rhino.append(to_rhino(geometry, errors))
    except Exception as error:
        errors.append("{} geometry: {!r}".format(type(beam).__name__, error))
        beams_out.append(None)
        beams_rhino.append(None)

cutting_plane_a = None
cutting_plane_b = None
extension_plane_a = None
extension_plane_b = None
negative_volume_a = None
negative_volume_b = None
negative_volume_a_rhino = None
negative_volume_b_rhino = None
clip_status = []
centerline_intersection = None
if joints:
    joint = joints[0]
    cutting_plane_a = joint.cutting_plane_a
    cutting_plane_b = joint.cutting_plane_b
    extension_plane_a = joint.extension_plane_a
    extension_plane_b = joint.extension_plane_b
    negative_volume_a = joint.debug_negative_volume_a
    negative_volume_b = joint.debug_negative_volume_b
    negative_volume_a_rhino = to_rhino(negative_volume_a.to_mesh(), errors) if negative_volume_a else None
    negative_volume_b_rhino = to_rhino(negative_volume_b.to_mesh(), errors) if negative_volume_b else None
    clip_status = joint.debug_clip_status
    centerline_intersection = joint.centerline_intersection

for status in clip_status:
    print(status)

beam_a_out = beam_a.geometry    
beam_b_out = beam_b.geometry
# ---------- end py3 ----------
# Focus Work - Preffered Face TButt Joint
draw = COMPASDraw(cg=forced_joint.main_beam_out)  # -> rg
#   port cg: The COMPAS geometry or datastructure to be drawn.
#   port rg: The Rhino geometry object.
# ---------- draw: Python ----------
# r: compas>=2.14.1
"""
Draws COMPAS geometry in Grasshopper.
"""

from typing import Any

import Grasshopper

from compas.scene import SceneObject


class CompasToRhinoGeometry(Grasshopper.Kernel.GH_ScriptInstance):
    def RunScript(self, cg):
        if not cg:
            return None

        return SceneObject(item=cg).draw()
# ---------- end draw ----------
draw_2 = COMPASDraw(cg=forced_joint.cross_beam_out)  # -> rg; same code as draw
draw_3 = COMPASDraw(cg=py3.beam_a_out)  # -> rg; same code as draw
draw_4 = COMPASDraw(cg=py3.beam_b_out)  # -> rg; same code as draw
data = Data([draw_3, draw_4])
panel = Panel(py3.out)

reloader = CompasDevReloader()
# ---------- reloader: Python ----------
"""
------------------------------
Using VS Code as Python editor
------------------------------

The simplest way to start using VS Code as our editor, is
to place our Python code in files located IN THE SAME FOLDER as our Grasshopper file.

After we have done that, we need 2 steps: 

1. Enable the COMPAS reloader on one component. This tells Grasshopper to watch for changes in the Pythoh files and reload if changed.
2. Every other component that uses Python code from external files needs to start with a method to ensure Grasshopper knows where to load the files from.

"""
# venv: ca-fs26-focus-work

from compas_rhino.devtools import DevTools
DevTools.enable_reloader()
# ---------- end reloader ----------
