# Grasshopper definition a03_design_base-file.ghx (Grasshopper 1.0.8)
# Copyright: Lorin Wiedemeier

# Input Surface
srf = Geometry(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)
srf_2 = Geometry(<surface referenced from the Rhino model>)

# ---- group: Border Edge Length
py_compas = CompasPyTemplate(strength=Slider(0.38, range=0..1), ignore_corner_points=Toggle(False))  # -> modifier; inputs strength: Double, ignore_corner_points: Boolean
# ---------- py_compas: Python ----------
# venv: ca-fs26-focus-work

from compas_rhino.devtools import DevTools
DevTools.ensure_path()
ghenv.Component.Message = "Border Edge Length"

# ------ IMPORTS -------
from a03_modifiers import SameBorderEdgeLength

# Inputs
strength: float
ignore_corner_points: bool

modifier = SameBorderEdgeLength(strength, ignore_corner_points)
# ---------- end py_compas ----------

# ---- group: Directional Force
vec = VectorXYZ(XComponent=Slider(0, range=-1..1), YComponent=Slider(0.07, range=-1..1), ZComponent=Slider(-0.38, range=-1..1))  # -> Vector, Length
py_compas_2 = CompasPyTemplate(direction=vec.Vector, attraction_force=Slider(0.06, range=0..1))  # -> modifier; inputs direction: Vector3d, attraction_force: Double
# ---------- py_compas_2: Python ----------
# venv: ca-fs26-focus-work

from compas_rhino.devtools import DevTools
DevTools.ensure_path()
ghenv.Component.Message = "Directional Force"

# ------ IMPORTS -------

from compas_rhino.conversions import point_to_compas
from compas_rhino.conversions import vector_to_compas

from a03_modifiers import DirectionalForce

modifier = DirectionalForce(vector_to_compas(direction), attraction_force)
# ---------- end py_compas_2 ----------

# ---- group: Increse Force Near Borders
py_compas_3 = CompasPyTemplate(strength=Slider(0.02, range=0..1))  # -> modifier; inputs strength: Double
# ---------- py_compas_3: Python ----------
# venv: ca-fs26-focus-work

from compas_rhino.devtools import DevTools
DevTools.ensure_path()
ghenv.Component.Message = "Force Around Borders"

# ------ IMPORTS -------

from a03_modifiers import IncreaseForceAroundBorders

# Inputs
strength: float

modifier = IncreaseForceAroundBorders(strength)
# ---------- end py_compas_3 ----------

# ---- group: Gravitational Point
# Modifiers
pt = Point(Point(-0.2085037615, 2.115103633, 3.447762801))
py_compas_4 = CompasPyTemplate(attractor_point=pt, attraction_force=Slider(0.02, range=0..1))  # -> modifier; inputs attractor_point: Point3d, attraction_force: Double
# ---------- py_compas_4: Python ----------
# venv: ca-fs26-focus-work

from compas_rhino.devtools import DevTools
DevTools.ensure_path()
ghenv.Component.Message = "Attraction Point Modifier"

# ------ IMPORTS -------

from compas_rhino.conversions import point_to_compas

from a03_modifiers import AttractorPointModifier

modifier = AttractorPointModifier(point_to_compas(attractor_point), attraction_force)
# ---------- end py_compas_4 ----------

# ----
py_compas_5 = CompasPyTemplate(target_edge_length=Slider(0.59, range=0..1), K=Slider(0.182, range=0..0.5))  # -> modifier; inputs target_edge_length: Double, K: Double
# ---------- py_compas_5: Python ----------
# venv: ca-fs26-focus-work

from compas_rhino.devtools import DevTools
DevTools.ensure_path()
ghenv.Component.Message = "Edge Spring Force"

# ------ IMPORTS -------

from a03_modifiers import TargetEdgeLengthSpringForce

modifier = TargetEdgeLengthSpringForce(target_edge_length, K)
# ---------- end py_compas_5 ----------

# ---- group: Boundary Equalization
py_compas_6 = CompasPyTemplate(K=Slider(0.073, range=0..0.5))  # -> modifier; inputs K: Double
# ---------- py_compas_6: Python ----------
# venv: ca-fs26-focus-work

from compas_rhino.devtools import DevTools
DevTools.ensure_path()
ghenv.Component.Message = "Edge Spring Force"

# ------ IMPORTS -------

from a03_modifiers import BoundaryEdgeLengthOptimizer

modifier = BoundaryEdgeLengthOptimizer(None, K)
# ---------- end py_compas_6 ----------

# ----
srf_trim = Geometry(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)

# ---- group: Base Surface
srf_3 = Geometry(srf_2)

# ----
# Brep Meshing
list = ValueList({"TriRemesh": "tri", "QuadRemesh": "quad", "HexaRemesh": "hexa"}, selected="QuadRemesh")
srf_4 = Geometry(srf_3)
py_compas_7 = CompasPyTemplate(mesher_type=list, u_count=Slider(6, range=1..30), v_count=Slider(6, range=1..30), brep=srf_4, full_faces=Toggle(False))  # -> mesh, goals, geo; inputs mesher_type: String, u_count: Int32, v_count: Int32, brep: Brep
# ---------- py_compas_7: Python ----------
# venv: ca-fs26-focus-work

from compas_rhino.devtools import DevTools
DevTools.ensure_path()
ghenv.Component.Message = "Mesher"

# ------ IMPORTS -------
from compas_rhino.conversions import mesh_to_rhino

from a03_mesher import HexaMesher
from a03_mesher import QuadMesher
from a03_mesher import TriMesher
from a03_mesh_relax import MeshRelaxerGoals

# --------------------------------------------------
# ------------------- EXECUTION --------------------

if mesher_type == "tri":
    mesher = TriMesher(u_count, v_count, brep)
elif mesher_type == "quad":
    mesher = QuadMesher(u_count, v_count, brep, full_quads = full_faces)
elif mesher_type == "hexa":
    mesher = HexaMesher(u_count, v_count, brep, full_hexas = full_faces)

mesher.generate_mesh()
goals = MeshRelaxerGoals.from_brep(brep)

mesh = mesher.mesh
geo = mesh_to_rhino(mesh, disjoint=False)
# ---------- end py_compas_7 ----------
geometry = Geometry(py_compas_7.geo)
mesh = Data(py_compas_7.mesh)
goals = Data(py_compas_7.goals)

# ---- group: Custom Hexa Mesh
# Meshing
list_2 = ValueList({"TriRemesh": "tri", "QuadRemesh": "quad", "HexaRemesh": "hexa", "EHexa": "ehexa"}, selected="EHexa")
number_slider = Slider(7, range=1..30)
number_slider_2 = Slider(4, range=1..30)
py_compas_8 = CompasPyTemplate(
    mesher_type=list_2,
    u_count=number_slider_2,
    v_count=number_slider,
    brep=srf_3,
    inset=Slider(0.2, range=0..1),
    tolerance=Slider(0.025, range=0..1))  # -> mesh, goals, geo; inputs mesher_type: String, u_count: Int32, v_count: Int32, brep: Brep, inset: Double, cutout_brep: Brep
# ---------- py_compas_8: Python ----------
# r: compas==2.15.1,timber_design==0.2.0,compas_fab==1.1.4
# venv: ca-fs26-focus-work

from compas_rhino.devtools import DevTools
DevTools.ensure_path()
ghenv.Component.Message = "Mesher"

# ------ IMPORTS -------
from compas_rhino.conversions import mesh_to_rhino

from a03_mesher import HexaMesher, HexagonalMesher2D
from a03_mesher import QuadMesher
from a03_mesher import TriMesher
from a03_mesh_relax import MeshRelaxerGoals

# --------------------------------------------------
# ------------------- EXECUTION --------------------

if mesher_type == "tri":
    mesher = TriMesher(u_count, v_count, brep)
elif mesher_type == "quad":
    mesher = QuadMesher(u_count, v_count, brep, full_quads = full_faces)
elif mesher_type == "hexa":
    mesher = HexaMesher(u_count, v_count, brep, full_hexas = full_faces)
elif mesher_type == "ehexa":
    mesher = HexagonalMesher2D(u_count=u_count, brep=brep, v_count=v_count, radius=1, inset=inset)
    

mesher.generate_mesh()
goals = MeshRelaxerGoals.from_brep(brep)
if cutout_brep:
    mesher.remove_faces_overlapping_surface(cutout_brep=cutout_brep, tolerance=tolerance)
mesh = mesher.mesh
geo = mesh_to_rhino(mesh, disjoint=False)
# ---------- end py_compas_8 ----------
goals_2 = Data(py_compas_8.goals)
geo = Geometry(py_compas_8.geo)
mesh_2 = Data(py_compas_8.mesh)

# ---- group: QuadMesh
list_3 = ValueList({"TriRemesh": "tri", "QuadRemesh": "quad", "HexaRemesh": "hexa"}, selected="QuadRemesh")
number_slider_3 = Slider(1, range=1..30)
number_slider_4 = Slider(1, range=1..30)
py_compas_9 = CompasPyTemplate(mesher_type=list_3, u_count=number_slider_2, v_count=number_slider, brep=srf_3, full_faces=Toggle(False))  # -> mesh, goals, geo; inputs mesher_type: String, u_count: Int32, v_count: Int32, brep: Brep
# ---------- py_compas_9: Python ----------
# r: compas==2.15.1,timber_design==0.2.0,compas_fab==1.1.4
# venv: ca-fs26-focus-work


from compas_rhino.devtools import DevTools
DevTools.ensure_path()
ghenv.Component.Message = "Mesher"

# ------ IMPORTS -------
from compas_rhino.conversions import mesh_to_rhino

from a03_mesher import HexaMesher
from a03_mesher import QuadMesher
from a03_mesher import TriMesher
from a03_mesh_relax import MeshRelaxerGoals

# --------------------------------------------------
# ------------------- EXECUTION --------------------

if mesher_type == "tri":
    mesher = TriMesher(u_count, v_count, brep)
elif mesher_type == "quad":
    mesher = QuadMesher(u_count, v_count, brep, full_quads = full_faces)
elif mesher_type == "hexa":
    mesher = HexaMesher(u_count, v_count, brep, full_hexas = full_faces)

mesher.generate_mesh()
goals = MeshRelaxerGoals.from_brep(brep)

mesh = mesher.mesh
geo = mesh_to_rhino(mesh, disjoint=False)
# ---------- end py_compas_9 ----------
geometry_2 = Geometry(py_compas_9.geo)
goals_3 = Data(py_compas_9.goals)
mesh_3 = Data(py_compas_9.mesh)

# ---- group: Fixed boundary Vertices
py_compas_10 = CompasPyTemplate()  # -> modifier
# ---------- py_compas_10: Python ----------
# venv: ca-fs26-focus-work

from compas_rhino.devtools import DevTools
DevTools.ensure_path()

ghenv.Component.Message = "Fixed Boundary Vertices"

# ------ IMPORTS -------

from compas_rhino.conversions import point_to_compas

from a03_modifiers import FixedBoundaryVertices

modifier = FixedBoundaryVertices()
# ---------- end py_compas_10 ----------

# ---- group: Simplify Border Edge
py_compas_11 = CompasPyTemplate()  # -> modifier
# ---------- py_compas_11: Python ----------
# venv: ca-fs26-focus-work

from compas_rhino.devtools import DevTools
DevTools.ensure_path()
ghenv.Component.Message = "Simplify Border Edge"

# ------ IMPORTS -------

from a03_modifiers import SimplifyBorderEdges

modifier = SimplifyBorderEdges()
# ---------- end py_compas_11 ----------

# ---- group: Modifiers
merge = Merge(Data1=py_compas_4, Data6=py_compas_2)

# ----
modifiers = Data(merge)

# ----
# Mesh Relaxation
mesh_4 = Data(mesh)
goals_4 = Data(goals)
py_compas_12 = CompasPyTemplate(
    mesh=mesh_4,
    damping=Slider(0.15, range=0..0.5),
    goals=goals_4,
    modifiers=modifiers,
    snap_to_surface=Toggle(True),
    reset=Button(),
    on=Toggle(False))  # -> relaxed_mesh, iteration; inputs damping: Double, modifiers: list, snap_to_surface: Boolean, reset: Boolean, on: Boolean
# ---------- py_compas_12: Python ----------
# venv: ca-fs26-focus-work

from compas_rhino.devtools import DevTools
DevTools.ensure_path()

# ------ IMPORTS -------

import scriptcontext as sc
import Grasshopper as gh

from compas_ghpython import create_id
from compas_ghpython.timer import update_component

from a03_mesh_relax import MeshRelaxer

# --------------------------------------------------
# ------------------- EXECUTION --------------------

key = create_id(ghenv.Component, "relaxer")

# 1. Initialize or Reset
if reset or key not in sc.sticky:
    relaxer = MeshRelaxer(mesh.copy(), iterations=1)

    sc.sticky[key] = relaxer
    ghenv.Component.Message = "Mesh Relaxer Ready"

# 2. Retrieve state
relaxer = sc.sticky[key]

# 3. Update live parameters
relaxer.damping = damping
relaxer.goals = goals
relaxer.snap_to_surface = snap_to_surface
relaxer.modifiers = modifiers or []

# 4. Run step
if on:
    relaxer.relax()

    ghenv.Component.Message = f"Mesh Relaxer\nIteration #{relaxer.step}"
    update_component(ghenv, 20)

relaxed_mesh = relaxer.mesh
# ---------- end py_compas_12 ----------
dam = DataDam(DataA=py_compas_12.relaxed_mesh, BufferDelay=10000000, BufferMode=0)
draw = COMPASDraw(cg=py_compas_12.relaxed_mesh)  # -> rg
#   port cg: The COMPAS geometry or datastructure to be drawn.
#   port rg: The Rhino geometry object.
# ---------- draw: Python ----------
# venv: ca-fs26-final-project
"""
Draws COMPAS geometry in Grasshopper.
"""

from typing import Any

import Grasshopper

from compas.scene import SceneObject


class CompasToRhinoGeometry(Grasshopper.Kernel.GH_ScriptInstance):
    def RunScript(self, cg):
        if not cg:
            return None

        return SceneObject(item=cg).draw()
# ---------- end draw ----------

# ---- group: Hex RF System
# Focus Work - Base File
# Gramazio Kohler Research
# Gonzalo Casas, Lorin Wiedemeier, Eric Gozzi
# Project by Timo Feddern, Alessia Martino, Zan Kocunik
# RF System
compas_mesh = Data(mesh_2)
number_slider_5 = Slider(85, range=0..360)
rf_system_inner = Python3Script(
    mesh=compas_mesh,
    hex_offset=number_slider_5,
    hex_rotation=number_slider_5,
    extension_pos=Slider(0.63, range=-1..2),
    extension_neg=Slider(0.59, range=-1..1),
    use_hexagonal=Toggle(False),
    use_extension=Toggle(True))  # -> out2, rf_system, centerlines
# ---------- rf_system_inner: Python ----------
# venv: ca-fs26-focus-work

# Component 1: Process Inner Beams with Timo's RF System

from compas_rhino.devtools import DevTools
DevTools.ensure_path()
ghenv.Component.Message = "Inner Beams (Timo)"

# ------ IMPORTS -------

from a03_rf_system_timo import RFSystem

# ------ SET DEFAULTS -------

hex_offset = hex_offset if 'hex_offset' in dir() else 0.5
hex_rotation = hex_rotation if 'hex_rotation' in dir() else 60.0
extension_pos = extension_pos if 'extension_pos' in dir() else 0.2
extension_neg = extension_neg if 'extension_neg' in dir() else 0.1
use_hexagonal = use_hexagonal if 'use_hexagonal' in dir() else True
use_extension = use_extension if 'use_extension' in dir() else True

# ------ PROCESS INNER BEAMS -------

# Initialize outputs
rf_system = None
centerlines = []

if mesh:
    inner_rf = RFSystem(mesh.copy())
    inner_rf.create_rf_datastructure()
    
    if use_hexagonal:
        inner_rf.eccentrize_centerlines_hexagonal(
            offset=hex_offset,
            rotation_angle=hex_rotation
        )
    
    if use_extension:
        inner_rf.extend_centerlines(
            extensions_pos=extension_pos,
            extensions_neg=extension_neg
        )
    
    # ------ SET OUTPUTS -------
    rf_system = inner_rf  # This must be set as an output in GH component
    centerlines = inner_rf.centerlines
    
    print("Inner RF System created successfully")
    print("Type:", type(rf_system))
    print("Has mesh:", hasattr(rf_system, 'mesh'))
# ---------- end rf_system_inner ----------
draw_2 = COMPASDraw(cg=rf_system_inner.centerlines)  # -> rg
#   port cg: The COMPAS geometry or datastructure to be drawn.
#   port rg: The Rhino geometry object.
# ---------- draw_2: Python ----------
# venv: ca-fs26-final-project

from typing import Any

import Grasshopper

from compas.scene import SceneObject


class CompasToRhinoGeometry(Grasshopper.Kernel.GH_ScriptInstance):
    def RunScript(self, cg):
        if not cg:
            return None

        return SceneObject(item=cg).draw()
# ---------- end draw_2 ----------

# ---- group: Basic Quad RF System
compas_mesh_2 = Data(mesh_3)
outer_mesh = Python3Script(mesh=compas_mesh_2)  # -> rf_system, centerlines
# ---------- outer_mesh: Python ----------
# venv: ca-fs26-focus-work

# Component 2: Process Boundary Beams with Standard RF System

from compas_rhino.devtools import DevTools
DevTools.ensure_path()
ghenv.Component.Message = "Boundary Beams (Standard)"

# ------ IMPORTS -------

from a03_rf_system import RFSystem

# ------ SET DEFAULTS -------

eccentricity = eccentricity if 'eccentricity' in dir() else 0.1
use_eccentricity = use_eccentricity if 'use_eccentricity' in dir() else True

# ------ PROCESS BOUNDARY BEAMS -------

if mesh:
    boundary_rf = RFSystem(mesh.copy())
    boundary_rf.create_rf_datastructure()
    
    if use_eccentricity:
        boundary_rf.eccentrize_centerlines(eccentricity=eccentricity)
    
    # ------ OUTPUT -------
    rf_system = boundary_rf  # Output the RFSystem object itself
    centerlines = boundary_rf.centerlines
else:
    rf_system = None
    centerlines = []
# ---------- end outer_mesh ----------
draw_3 = COMPASDraw(cg=outer_mesh.centerlines)  # -> rg; same code as draw_2

# ----
mesh_analysis = Data(mesh_3)
py_compas_13 = CompasPyTemplate(mesh=mesh_analysis, f_index=Slider(51, range=0..100), e_index=Slider(0, range=0..6))  # inputs f_index: Int32, e_index: Int32
# ---------- py_compas_13: Python ----------
# venv: ca-fs26-final-project

"""Grasshopper Script Instance"""
import System
import Rhino
import Rhino.Geometry
import Grasshopper

from compas_rhino.conversions import point_to_rhino

class MyComponent(Grasshopper.Kernel.GH_ScriptInstance):

    def RunScript(self, mesh, f_index: int, e_index: int):
        """
        Inputs:
            mesh: compas.datastructures.Mesh
            f_index: int (Face Index)
            e_index: int (Edge Index)
        """
        ghenv.Component.Message = "Topo Explorer"
        
        # --- Storage for Draw ---
        self._lines = []        
        self._main_labels = []  # Navigation labels (Selected, Next, etc.)
        self._index_labels = [] # Face-local edge indices
        self._global_dots = []  # Global Face and Vertex indices
        
        if not mesh:
            return

        # ------------------------------------------------
        # 0. DRAW ALL MESH EDGES (Background Wireframe)
        # ------------------------------------------------
        wire_color = System.Drawing.Color.FromArgb(180, 180, 180) 
        
        for u, v in mesh.edges():
            p_u = point_to_rhino(mesh.vertex_attributes(u, 'xyz'))
            p_v = point_to_rhino(mesh.vertex_attributes(v, 'xyz'))
            self._lines.append((Rhino.Geometry.Line(p_u, p_v), wire_color, 1))

        # ------------------------------------------------
        # 1. GLOBAL VISUALIZATION 
        # ------------------------------------------------
        for fkey in mesh.faces():
            pt = mesh.face_centroid(fkey)
            self._global_dots.append((str(fkey), point_to_rhino(pt), System.Drawing.Color.Blue, 35))
            
        for vkey in mesh.vertices():
            pt = mesh.vertex_point(vkey)
            self._global_dots.append((str(vkey), point_to_rhino(pt), System.Drawing.Color.Magenta, 30))

        # ------------------------------------------------
        # 2. TOPO NAVIGATION LOGIC
        # ------------------------------------------------
        def get_face_centroid(f_key):
            pts = [mesh.vertex_attributes(v, 'xyz') for v in mesh.face_vertices(f_key)]
            c = [sum(axis)/len(axis) for axis in zip(*pts)]
            return point_to_rhino(c)

        def add_face_indices(f_key, color):
            center = get_face_centroid(f_key)
            vertices = mesh.face_vertices(f_key)
            for i in range(len(vertices)):
                p_u = point_to_rhino(mesh.vertex_attributes(vertices[i], 'xyz'))
                p_v = point_to_rhino(mesh.vertex_attributes(vertices[(i + 1) % len(vertices)], 'xyz'))
                mid = (p_u + p_v) / 2.0
                vec_to_center = center - mid
                text_loc = mid + (vec_to_center * 0.15)
                self._index_labels.append((str(i), text_loc, color, 22))

        if f_index is not None and e_index is not None:
            try:
                f_keys = list(mesh.faces())
                if f_index >= len(f_keys): raise IndexError
                f_key = f_keys[f_index]
                
                f_vtx = mesh.face_vertices(f_key)
                if e_index >= len(f_vtx):
                    self.AddRuntimeMessage(Grasshopper.Kernel.GH_RuntimeMessageLevel.Warning, "Edge Index out of range")
                else:
                    # Highlight active face indices
                    add_face_indices(f_key, System.Drawing.Color.DarkGreen)

                    # --- A. Selected Edge (Black) ---
                    u, v = f_vtx[e_index], f_vtx[(e_index + 1) % len(f_vtx)]
                    p1, p2 = point_to_rhino(mesh.vertex_attributes(u, 'xyz')), point_to_rhino(mesh.vertex_attributes(v, 'xyz'))
                    
                    self._lines.append((Rhino.Geometry.Line(p1, p2), System.Drawing.Color.Black, 6))
                    self._main_labels.append(("*Selected*", (p1+p2)/2, System.Drawing.Color.Black, 24))

                    # --- B. Next Edge (Blue) ---
                    w = f_vtx[(e_index + 2) % len(f_vtx)]
                    p3 = point_to_rhino(mesh.vertex_attributes(w, 'xyz'))
                    
                    self._lines.append((Rhino.Geometry.Line(p2, p3), System.Drawing.Color.DodgerBlue, 4))
                    # Added Label Here:
                    self._main_labels.append(("Next Edge", (p2+p3)/2, System.Drawing.Color.DodgerBlue, 20))
                    
                    # --- C. Previous Edge (Red) ---
                    adj_face = mesh.halfedge_face((v, u))
                    if adj_face is not None:
                        add_face_indices(adj_face, System.Drawing.Color.DarkRed)
                        adj_vtx = mesh.face_vertices(adj_face)
                        if u in adj_vtx:
                            u_idx = adj_vtx.index(u)
                            z = adj_vtx[(u_idx + 1) % len(adj_vtx)]
                            p_z = point_to_rhino(mesh.vertex_attributes(z, 'xyz'))
                            
                            self._lines.append((Rhino.Geometry.Line(p1, p_z), System.Drawing.Color.Red, 4))
                            # Renamed Label Here:
                            self._main_labels.append(("Prev. Edge", (p1+p_z)/2, System.Drawing.Color.Red, 20))
                    else:
                        self._main_labels.append(("Boundary", (p1+p2)/2, System.Drawing.Color.Gray, 18))
            
            except IndexError:
                self.AddRuntimeMessage(Grasshopper.Kernel.GH_RuntimeMessageLevel.Warning, "Face Index out of range")

        return None

    def IsPreviewCapable(self):
        return Grasshopper.Kernel.GH_PreviewCapability.Disabled

    def DrawViewportWires(self, args):
        if hasattr(self, "_lines"):
            for line, color, thickness in self._lines:
                args.Display.DrawLine(line, color, thickness)

    def DrawViewportMeshes(self, args):
        # 1. Global Face/Vertex Indices
        if hasattr(self, "_global_dots"):
            for text, pt, color, size in self._global_dots:
                args.Display.Draw2dText(text, color, pt, True, size)
        
        # 2. Local Edge Indices (0, 1, 2...)
        if hasattr(self, "_index_labels"):
            for text, pt, color, size in self._index_labels:
                args.Display.Draw2dText(text, color, pt, True, size)

        # 3. Navigation Status Labels
        if hasattr(self, "_main_labels"):
            for text, pt, color, size in self._main_labels:
                args.Display.Draw2dText(text, color, pt, True, size)

    def AfterRunScript(self):
        self.MaintainDrawSettings = True
# ---------- end py_compas_13 ----------

mesh_analysis_2 = Data(py_compas_12.relaxed_mesh)
py_compas_14 = CompasPyTemplate(mesh=mesh_analysis_2, f_index=Slider(51, range=0..100), e_index=Slider(0, range=0..6))  # inputs f_index: Int32, e_index: Int32
# ---------- py_compas_14: Python ----------
# venv: ca-fs26-focus-work

"""Grasshopper Script Instance"""
import System
import Rhino
import Rhino.Geometry
import Grasshopper

from compas_rhino.conversions import point_to_rhino

class MyComponent(Grasshopper.Kernel.GH_ScriptInstance):

    def RunScript(self, mesh, f_index: int, e_index: int):
        """
        Inputs:
            mesh: compas.datastructures.Mesh
            f_index: int (Face Index)
            e_index: int (Edge Index)
        """
        ghenv.Component.Message = "Topo Explorer"
        
        # --- Storage for Draw ---
        self._lines = []        
        self._main_labels = []  # Navigation labels (Selected, Next, etc.)
        self._index_labels = [] # Face-local edge indices
        self._global_dots = []  # Global Face and Vertex indices
        
        if not mesh:
            return

        # ------------------------------------------------
        # 0. DRAW ALL MESH EDGES (Background Wireframe)
        # ------------------------------------------------
        wire_color = System.Drawing.Color.FromArgb(180, 180, 180) 
        
        for u, v in mesh.edges():
            p_u = point_to_rhino(mesh.vertex_attributes(u, 'xyz'))
            p_v = point_to_rhino(mesh.vertex_attributes(v, 'xyz'))
            self._lines.append((Rhino.Geometry.Line(p_u, p_v), wire_color, 1))

        # ------------------------------------------------
        # 1. GLOBAL VISUALIZATION 
        # ------------------------------------------------
        for fkey in mesh.faces():
            pt = mesh.face_centroid(fkey)
            self._global_dots.append((str(fkey), point_to_rhino(pt), System.Drawing.Color.Blue, 35))
            
        for vkey in mesh.vertices():
            pt = mesh.vertex_point(vkey)
            self._global_dots.append((str(vkey), point_to_rhino(pt), System.Drawing.Color.Magenta, 30))

        # ------------------------------------------------
        # 2. TOPO NAVIGATION LOGIC
        # ------------------------------------------------
        def get_face_centroid(f_key):
            pts = [mesh.vertex_attributes(v, 'xyz') for v in mesh.face_vertices(f_key)]
            c = [sum(axis)/len(axis) for axis in zip(*pts)]
            return point_to_rhino(c)

        def add_face_indices(f_key, color):
            center = get_face_centroid(f_key)
            vertices = mesh.face_vertices(f_key)
            for i in range(len(vertices)):
                p_u = point_to_rhino(mesh.vertex_attributes(vertices[i], 'xyz'))
                p_v = point_to_rhino(mesh.vertex_attributes(vertices[(i + 1) % len(vertices)], 'xyz'))
                mid = (p_u + p_v) / 2.0
                vec_to_center = center - mid
                text_loc = mid + (vec_to_center * 0.15)
                self._index_labels.append((str(i), text_loc, color, 22))

        if f_index is not None and e_index is not None:
            try:
                f_keys = list(mesh.faces())
                if f_index >= len(f_keys): raise IndexError
                f_key = f_keys[f_index]
                
                f_vtx = mesh.face_vertices(f_key)
                if e_index >= len(f_vtx):
                    self.AddRuntimeMessage(Grasshopper.Kernel.GH_RuntimeMessageLevel.Warning, "Edge Index out of range")
                else:
                    # Highlight active face indices
                    add_face_indices(f_key, System.Drawing.Color.DarkGreen)

                    # --- A. Selected Edge (Black) ---
                    u, v = f_vtx[e_index], f_vtx[(e_index + 1) % len(f_vtx)]
                    p1, p2 = point_to_rhino(mesh.vertex_attributes(u, 'xyz')), point_to_rhino(mesh.vertex_attributes(v, 'xyz'))
                    
                    self._lines.append((Rhino.Geometry.Line(p1, p2), System.Drawing.Color.Black, 6))
                    self._main_labels.append(("*Selected*", (p1+p2)/2, System.Drawing.Color.Black, 24))

                    # --- B. Next Edge (Blue) ---
                    w = f_vtx[(e_index + 2) % len(f_vtx)]
                    p3 = point_to_rhino(mesh.vertex_attributes(w, 'xyz'))
                    
                    self._lines.append((Rhino.Geometry.Line(p2, p3), System.Drawing.Color.DodgerBlue, 4))
                    # Added Label Here:
                    self._main_labels.append(("Next Edge", (p2+p3)/2, System.Drawing.Color.DodgerBlue, 20))
                    
                    # --- C. Previous Edge (Red) ---
                    adj_face = mesh.halfedge_face((v, u))
                    if adj_face is not None:
                        add_face_indices(adj_face, System.Drawing.Color.DarkRed)
                        adj_vtx = mesh.face_vertices(adj_face)
                        if u in adj_vtx:
                            u_idx = adj_vtx.index(u)
                            z = adj_vtx[(u_idx + 1) % len(adj_vtx)]
                            p_z = point_to_rhino(mesh.vertex_attributes(z, 'xyz'))
                            
                            self._lines.append((Rhino.Geometry.Line(p1, p_z), System.Drawing.Color.Red, 4))
                            # Renamed Label Here:
                            self._main_labels.append(("Prev. Edge", (p1+p_z)/2, System.Drawing.Color.Red, 20))
                    else:
                        self._main_labels.append(("Boundary", (p1+p2)/2, System.Drawing.Color.Gray, 18))
            
            except IndexError:
                self.AddRuntimeMessage(Grasshopper.Kernel.GH_RuntimeMessageLevel.Warning, "Face Index out of range")

        return None

    def IsPreviewCapable(self):
        return Grasshopper.Kernel.GH_PreviewCapability.Disabled

    def DrawViewportWires(self, args):
        if hasattr(self, "_lines"):
            for line, color, thickness in self._lines:
                args.Display.DrawLine(line, color, thickness)

    def DrawViewportMeshes(self, args):
        # 1. Global Face/Vertex Indices
        if hasattr(self, "_global_dots"):
            for text, pt, color, size in self._global_dots:
                args.Display.Draw2dText(text, color, pt, True, size)
        
        # 2. Local Edge Indices (0, 1, 2...)
        if hasattr(self, "_index_labels"):
            for text, pt, color, size in self._index_labels:
                args.Display.Draw2dText(text, color, pt, True, size)

        # 3. Navigation Status Labels
        if hasattr(self, "_main_labels"):
            for text, pt, color, size in self._main_labels:
                args.Display.Draw2dText(text, color, pt, True, size)

    def AfterRunScript(self):
        self.MaintainDrawSettings = True
# ---------- end py_compas_14 ----------

# ---- group: Trim Overlapping Centerlines
rf_system_merges = Python3Script(
    inner_rf_system=rf_system_inner.rf_system,
    boundary_rf_system=outer_mesh.rf_system,
    parallel_tolerance=Slider(0.143, range=0..1),
    intersection_tolerance=Slider(0.044, range=0..1),
    extension_length=Slider(1, range=0..1))  # -> out, lines, points; inputs parallel_tolerance: Double, intersection_tolerance: Double
# ---------- rf_system_merges: Python ----------
# venv: ca-fs26-focus-work
import sys
import os

from compas_rhino.devtools import DevTools
DevTools.ensure_path()
ghenv.Component.Message = "RF Line Cleaner"

from a03_line_cleaner import extract_lines_from_hybrid

# =============================================================================
# INPUTS (set these in Grasshopper)
# =============================================================================
# inner_rf_system: Your inner RF system (RFSystem, RFSystemTimo, or RFSystemHybrid)
# boundary_rf_system: Your boundary RF system (RFSystem or RFSystemHybrid)

# =============================================================================
# CLEAN CENTERLINES
# =============================================================================

lines, points = extract_lines_from_hybrid(boundary_rf_system, inner_rf_system, intersection_tolerance, parallel_tolerance, extension_length)
# ---------- end rf_system_merges ----------
pt_2 = Point(rf_system_merges.points)
line = Line(rf_system_merges.lines)

# ----
# RF System
compas_mesh_3 = Data(dam)
py_compas_15 = CompasPyTemplate(mesh=compas_mesh_3, eccentricity=Slider(0.34, range=-1..1), extensions=Slider(0.27, range=-1..1))  # -> rf_system, mesh, centerlines; inputs eccentricity: Double
# ---------- py_compas_15: Python ----------
# venv: ca-fs26-focus-work

from compas_rhino.devtools import DevTools
DevTools.ensure_path()
ghenv.Component.Message = "RF Datastracture and lines"

# ------ IMPORTS -------

from a03_rf_system import RFSystem

# --------------------------------------------------
# ------------------- EXECUTION --------------------

rf_system = RFSystem(mesh)

rf_system.create_rf_datastructure()
rf_system.eccentrize_centerlines(eccentricity)
rf_system.extend_centerlines(extensions)

centerlines = rf_system.centerlines
mesh = rf_system.mesh
# ---------- end py_compas_15 ----------
draw_4 = COMPASDraw(cg=py_compas_15.centerlines)  # -> rg; same code as draw_2

# ----
# RF System - Eccentricity w/ Attractor Point
compas_mesh_4 = Data(dam)
pt_3 = Point(Point(-3.606565354, 0.6286702749, 0))
py_compas_16 = CompasPyTemplate(mesh=compas_mesh_4, attractor_point=pt_3, factor=Slider(0.04, range=0..1), extensions=Slider(0.15, range=-1..1))  # -> rf_system, mesh, centerlines; inputs attractor_point: Point3d, extensions: Double
# ---------- py_compas_16: Python ----------
# venv: ca-fs26-focus-work

from compas_rhino.devtools import DevTools
DevTools.ensure_path()
ghenv.Component.Message = "RF Datastracture and lines"

# ------ IMPORTS -------

from compas_rhino.conversions import point_to_compas
from a03_rf_system import RFSystem

# --------------------------------------------------
# ------------------- EXECUTION --------------------

attractor_point = point_to_compas(attractor_point)

rf_system = RFSystem(mesh)

rf_system.create_rf_datastructure()
rf_system.eccentrize_centerlines_attractor_point(attractor_point, factor)
rf_system.extend_centerlines(extensions)

centerlines = rf_system.centerlines
mesh = rf_system.mesh
# ---------- end py_compas_16 ----------
draw_5 = COMPASDraw(cg=py_compas_16.centerlines)  # -> rg; same code as draw_2

# ----
# RF System - Eccentricity w/ Attractor Curve
compas_mesh_5 = Data(dam)
geo_2 = Geometry(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)
py_compas_17 = CompasPyTemplate(mesh=compas_mesh_5, attractor_curve=geo_2, factor=Slider(0.05, range=0..1), extensions=Slider(0.21, range=-1..1))  # -> rf_system, mesh, centerlines; inputs attractor_curve: Curve, extensions: Double
# ---------- py_compas_17: Python ----------
# venv: ca-fs26-focus-work

from compas_rhino.devtools import DevTools
DevTools.ensure_path()
ghenv.Component.Message = "RF Datastracture and lines"

# ------ IMPORTS -------

from compas_rhino.conversions import curve_to_compas
from a03_rf_system import RFSystem

# --------------------------------------------------
# ------------------- EXECUTION --------------------

attractor_curve = curve_to_compas(attractor_curve)

rf_system = RFSystem(mesh)

rf_system.create_rf_datastructure()
rf_system.eccentrize_centerlines_attractor_curve(attractor_curve, factor)
rf_system.extend_centerlines(extensions)

centerlines = rf_system.centerlines
mesh = rf_system.mesh
# ---------- end py_compas_17 ----------
draw_6 = COMPASDraw(cg=py_compas_17.centerlines)  # -> rg; same code as draw_2

# ----
# RF System
number_slider_6 = Slider(0.032, range=0..0.5)
rf_from_centerlines = Python3Script(centerlines=line, base_surface=srf_3, boundary_tolerance=number_slider_6, y=Button())  # -> out, rf_system, boundary_centerlines, interior_centerlines; inputs centerlines: list
# ---------- rf_from_centerlines: Python ----------
# venv: ca-fs26-focus-work

"""
Create a new RFSystemHybrid from centerlines, filtering out invalid lines.

Inputs:
    centerlines: List of Rhino.Geometry.Line objects (from interactive editor)
    base_surface: (Optional) Rhino surface/brep to extract normals from at beam midpoints
    boundary_tolerance: (Optional) Distance tolerance to detect boundary beams (default: 0.1)
    
Outputs:
    rf_system: A new RFSystemHybrid with only valid centerlines
    boundary_centerlines: List of centerlines classified as boundary beams (for visual inspection)
    interior_centerlines: List of centerlines classified as interior beams (for visual inspection)
    valid_count: Number of valid centerlines used
    skipped_count: Number of invalid centerlines skipped
"""

from compas_rhino.devtools import DevTools
DevTools.ensure_path()
ghenv.Component.Message = "RF from Centerlines"

import System
import Rhino
import scriptcontext as sc
from compas.datastructures import Mesh
from compas.geometry import Point, Line, Vector
from compas_rhino.conversions import line_to_compas
from a03_rf_system_hybrid import RFSystemHybrid

# Initialize outputs
rf_system = None
boundary_centerlines = []
interior_centerlines = []
valid_count = 0
skipped_count = 0

# Handle optional inputs
if 'base_surface' not in dir():
    base_surface = None
if 'boundary_tolerance' not in dir():
    boundary_tolerance = 0.1

# Handle input - centerlines might be a single item or list
if not hasattr(centerlines, '__iter__'):
    centerlines = [centerlines] if centerlines else []

if centerlines:
    try:
        print("=" * 60)
        print("Creating RF System from Centerlines")
        print("=" * 60)
        print(f"Input: {len(centerlines)} centerlines")
        
        # Convert Rhino lines to COMPAS lines and filter invalid ones
        valid_lines = []
        for i, item in enumerate(centerlines):
            # Handle Guid references - convert to geometry
            r_line = item
            if isinstance(item, System.Guid):
                rhino_obj = sc.doc.Objects.FindId(item)
                if rhino_obj:
                    r_line = rhino_obj.Geometry
                else:
                    skipped_count += 1
                    continue
            
            # Handle LineCurve - extract the Line
            if isinstance(r_line, Rhino.Geometry.LineCurve):
                r_line = r_line.Line
            
            # Check if it's a valid Rhino Line
            if isinstance(r_line, Rhino.Geometry.Line):
                if r_line.Length >= 0.001:  # Not zero-length
                    c_line = line_to_compas(r_line)
                    valid_lines.append(c_line)
                    valid_count += 1
                else:
                    skipped_count += 1
            else:
                skipped_count += 1
        
        print(f"Valid centerlines: {valid_count}")
        print(f"Skipped invalid: {skipped_count}")
        
        if valid_count == 0:
            print("ERROR: No valid centerlines found!")
        else:
            # Create new mesh from centerlines
            inner_mesh = Mesh()
            vertex_map = {}
            tolerance = 0.01
            
            def get_or_create_vertex(mesh, point, vertex_map):
                """Get existing vertex or create new one."""
                coords = (round(point.x / tolerance) * tolerance,
                         round(point.y / tolerance) * tolerance,
                         round(point.z / tolerance) * tolerance)
                
                if coords in vertex_map:
                    return vertex_map[coords]
                
                vkey = mesh.add_vertex(x=point.x, y=point.y, z=point.z)
                vertex_map[coords] = vkey
                return vkey
            
            # Two-pass approach: First create all vertices, then create edges
            # Pass 1: Create all vertices
            edge_data = []  # Store (u, v, line) tuples
            for line in valid_lines:
                u = get_or_create_vertex(inner_mesh, line.start, vertex_map)
                v = get_or_create_vertex(inner_mesh, line.end, vertex_map)
                if u != v:
                    edge_data.append((u, v, line))
            
            print(f"Created {len(list(inner_mesh.vertices()))} vertices")
            
            # Pass 2: Create faces and edges
            edges_added = 0
            for u, v, line in edge_data:
                if not inner_mesh.has_edge((u, v)):
                    # Find a third vertex to create a face
                    mid = Point(
                        (line.start.x + line.end.x) / 2,
                        (line.start.y + line.end.y) / 2,
                        (line.start.z + line.end.z) / 2
                    )
                    
                    min_dist = float('inf')
                    third = None
                    for vkey in inner_mesh.vertices():
                        if vkey != u and vkey != v:
                            v_coords = inner_mesh.vertex_coordinates(vkey)
                            dist = ((v_coords[0] - mid.x)**2 +
                                   (v_coords[1] - mid.y)**2 +
                                   (v_coords[2] - mid.z)**2)**0.5
                            if dist < min_dist:
                                min_dist = dist
                                third = vkey
                    
                    if third is not None:
                        try:
                            face_key = inner_mesh.add_face([u, v, third])
                            inner_mesh.edge_attribute((u, v), "centerline", line)
                            
                            # Determine normal based on whether we have a base surface
                            normal = None
                            if base_surface:
                                # Evaluate surface normal at beam midpoint
                                try:
                                    # Handle Guid reference - convert to geometry
                                    srf_geom = base_surface
                                    if isinstance(base_surface, System.Guid):
                                        rhino_obj = sc.doc.Objects.FindId(base_surface)
                                        if rhino_obj:
                                            srf_geom = rhino_obj.Geometry
                                    
                                    # Get the first face if it's a Brep
                                    if isinstance(srf_geom, Rhino.Geometry.Brep):
                                        if srf_geom.Faces.Count > 0:
                                            srf_geom = srf_geom.Faces[0]
                                    
                                    # Calculate beam midpoint
                                    mid_pt = Rhino.Geometry.Point3d(
                                        (line.start.x + line.end.x) / 2,
                                        (line.start.y + line.end.y) / 2,
                                        (line.start.z + line.end.z) / 2
                                    )
                                    
                                    # Find closest point on surface and get UV parameters
                                    success, u_param, v_param = srf_geom.ClosestPoint(mid_pt)
                                    if success:
                                        # Evaluate surface normal at UV parameters
                                        srf_normal = srf_geom.NormalAt(u_param, v_param)
                                        # Convert to COMPAS Vector
                                        normal = Vector(srf_normal.X, srf_normal.Y, srf_normal.Z)
                                        normal.unitize()
                                except Exception as e:
                                    print(f"Warning: Could not get surface normal: {e}")
                           
                           # Fallback to face normal or Z-up
                            if normal is None:
                                try:
                                    normal = inner_mesh.face_normal(face_key)
                                except:
                                    normal = Vector(0, 0, 1)
                            
                            inner_mesh.edge_attribute((u, v), "normal", normal)
                            edges_added += 1
                        except Exception as e:
                            print(f"Warning: Could not add edge: {e}")
           
            print(f"Created inner mesh: {len(list(inner_mesh.vertices()))} vertices, {edges_added} edges")
           
            # Add RF topology: next_edge and prev_edge for each edge based on shared vertices
            # Only consider edges that have centerlines (not helper edges from triangulation)
            print("Adding RF topology (next_edge/prev_edge)...")
            valid_edges = [e for e in inner_mesh.edges() if inner_mesh.edge_attribute(e, "centerline") is not None]
            print(f"Found {len(valid_edges)} valid edges with centerlines")
            
            for edge in valid_edges:
                u, v = edge
                # Find edges that share vertex v (next edges) - only valid edges
                next_edges = [e for e in inner_mesh.vertex_edges(v)
                             if e != edge and inner_mesh.edge_attribute(e, "centerline") is not None]
                if next_edges:
                    inner_mesh.edge_attribute(edge, "next_edge", next_edges[0])
                
                # Find edges that share vertex u (prev edges) - only valid edges
                prev_edges = [e for e in inner_mesh.vertex_edges(u)
                             if e != edge and inner_mesh.edge_attribute(e, "centerline") is not None]
                if prev_edges:
                    inner_mesh.edge_attribute(edge, "prev_edge", prev_edges[0])
            
            print("RF topology added")
           
           # Detect boundary beams based on proximity to surface edge
            if base_surface:
                print(f"Detecting boundary beams (tolerance: {boundary_tolerance})...")
               
               # Get surface geometry
                srf_geom = base_surface
                if isinstance(base_surface, System.Guid):
                    rhino_obj = sc.doc.Objects.FindId(base_surface)
                    if rhino_obj:
                        srf_geom = rhino_obj.Geometry
               
               # Get the first face if it's a Brep
                if isinstance(srf_geom, Rhino.Geometry.Brep):
                    if srf_geom.Faces.Count > 0:
                        srf_geom = srf_geom.Faces[0]
               
               # Get surface boundary curves
                boundary_curves = []
                try:
                    # For a BrepFace, get the outer loop
                   if hasattr(srf_geom, 'OuterLoop'):
                       outer_loop = srf_geom.OuterLoop
                       boundary_curves = [outer_loop.To3dCurve()]
                   # For a Surface, get the ISO curves at the edges
                   elif hasattr(srf_geom, 'IsoCurve'):
                       domain_u = srf_geom.Domain(0)
                       domain_v = srf_geom.Domain(1)
                       boundary_curves = [
                           srf_geom.IsoCurve(0, domain_u.Min),
                           srf_geom.IsoCurve(0, domain_u.Max),
                           srf_geom.IsoCurve(1, domain_v.Min),
                           srf_geom.IsoCurve(1, domain_v.Max)
                       ]
                except Exception as e:
                    print(f"Warning: Could not extract boundary curves: {e}")
               
               # Check each edge to see if it's near the boundary
                for edge in inner_mesh.edges():
                    centerline = inner_mesh.edge_attribute(edge, "centerline")
                    if centerline:
                       # Check both endpoints of the centerline
                        start_pt = Rhino.Geometry.Point3d(centerline.start.x, centerline.start.y, centerline.start.z)
                        end_pt = Rhino.Geometry.Point3d(centerline.end.x, centerline.end.y, centerline.end.z)
                       
                        is_boundary = False
                        for boundary_curve in boundary_curves:
                            if boundary_curve:
                               # Check distance from both endpoints to boundary curve
                                success_start, t_start = boundary_curve.ClosestPoint(start_pt)
                                success_end, t_end = boundary_curve.ClosestPoint(end_pt)
                               
                                if success_start and success_end:
                                    dist_start = start_pt.DistanceTo(boundary_curve.PointAt(t_start))
                                    dist_end = end_pt.DistanceTo(boundary_curve.PointAt(t_end))
                                   
                                   # If both endpoints are close to boundary, it's a boundary beam
                                    if dist_start < boundary_tolerance and dist_end < boundary_tolerance:
                                        is_boundary = True
                                        break
                       
                       # Mark edge as boundary or interior
                        inner_mesh.edge_attribute(edge, "is_boundary", is_boundary)
                       
                       # Add to appropriate output list
                        if is_boundary:
                            boundary_centerlines.append(centerline)
                        else:
                            interior_centerlines.append(centerline)
               
                print(f"Found {len(boundary_centerlines)} boundary beams and {len(interior_centerlines)} interior beams")
            else:
               # No surface provided - all beams are interior
                print("No surface provided - all beams classified as interior")
                for edge in inner_mesh.edges():
                    centerline = inner_mesh.edge_attribute(edge, "centerline")
                    if centerline:
                        inner_mesh.edge_attribute(edge, "is_boundary", False)
                        interior_centerlines.append(centerline)
           
           # Create empty boundary mesh
            boundary_mesh = Mesh()
           
           # Create the hybrid system
            rf_system = RFSystemHybrid(inner_mesh, boundary_mesh)
           
            print("=" * 60)
            print(f"RF System created successfully!")
            print(f"Total beams: {len(rf_system.centerlines)}")
            print(f"Boundary: {len(boundary_centerlines)}, Interior: {len(interior_centerlines)}")
            print("=" * 60)
    
    except Exception as e:
        print(f"ERROR creating RF system: {e}")
        import traceback
        traceback.print_exc()
        rf_system = None

else:
    print("ERROR: No centerlines provided")
# ---------- end rf_from_centerlines ----------
draw_7 = COMPASDraw(cg=rf_from_centerlines.interior_centerlines)  # -> rg; same code as draw_2
draw_8 = COMPASDraw(cg=rf_from_centerlines.boundary_centerlines)  # -> rg; same code as draw_2

# ----
# Adjust Centerlines - Bouncy
number_slider_7 = Slider(0.17, range=0..0.5)
goals_5 = Data(goals)
py_compas_18 = CompasPyTemplate(
    rf_system=py_compas_15.rf_system,
    damping=number_slider_7,
    goals=goals_5,
    snap_to_surface=Toggle(True),
    reset=Button(),
    on=Toggle(False))  # -> rf_system, iteration, centerlines; inputs damping: Double, snap_to_surface: Boolean, reset: Boolean
# ---------- py_compas_18: Python ----------
# venv: ca-fs26-focus-work

from compas_rhino.devtools import DevTools
DevTools.ensure_path()

# ------ IMPORTS -------


import scriptcontext as sc

from compas_ghpython import create_id
from compas_ghpython.timer import update_component

# --------------------------------------------------
# ------------------- EXECUTION --------------------

key = create_id(ghenv.Component, "adjusted_rf_system")

# 1. Initialize or Reset
if reset or key not in sc.sticky:
    adjusted_rf_system = rf_system.copy()
    adjusted_rf_system.mesh.attributes["step"] = 0
    sc.sticky[key] = adjusted_rf_system
    ghenv.Component.Message = "Ready"

# 2. Retrieve state
adjusted_rf_system = sc.sticky[key]

# 3. Run step
if on:
    adjusted_rf_system.compute_spring_forces(damping)
    adjusted_rf_system.apply_spring_forces()
    if snap_to_surface:
        adjusted_rf_system.snap_centerlines_to_surface(goals)
    iteration  = adjusted_rf_system.mesh.attributes["step"]
    adjusted_rf_system.mesh.attributes["step"] += 1

    ghenv.Component.Message = f"Spring Adjustment\nIteration #{iteration}"
    update_component(ghenv, 20)

rf_system = adjusted_rf_system
centerlines = rf_system.centerlines
# ---------- end py_compas_18 ----------
dam_2 = DataDam(DataA=py_compas_18.rf_system, BufferDelay=10000000, BufferMode=0)
draw_9 = COMPASDraw(cg=py_compas_18.centerlines)  # -> rg; same code as draw

reloader = CompasDevReloader()
# ---------- reloader: Python ----------
"""
------------------------------
Using VS Code as Python editor
------------------------------

The simplest way to start using VS Code as our editor, is
to place our Python code in files located IN THE SAME FOLDER as our Grasshopper file.

After we have done that, we need 2 steps: 

1. Enable the COMPAS reloader on one component. This tells Grasshopper to watch for changes in the Pythoh files and reload if changed.
2. Every other component that uses Python code from external files needs to start with a method to ensure Grasshopper knows where to load the files from.

"""
# venv: ca-fs26-final-project

from compas_rhino.devtools import DevTools
DevTools.enable_reloader()
# ---------- end reloader ----------

# ----
# Extend Centerlines
number_slider_8 = Slider(0.02, range=-1..1)
py_compas_19 = CompasPyTemplate(rf_system=dam_2, extension=number_slider_8)  # -> rf_system, centerlines; inputs extension: Double
# ---------- py_compas_19: Python ----------
# venv: ca-fs26-focus-work

rf_system = rf_system.copy()

rf_system.extend_centerlines(extension)
centerlines = rf_system.centerlines
# ---------- end py_compas_19 ----------
draw_10 = COMPASDraw(cg=py_compas_19.centerlines)  # -> rg; same code as draw

# ----
# Live Edit Centerlines
rf_system = Data(rf_from_centerlines.rf_system)
goals_6 = Data(goals_2)
py_compas_20 = CompasPyTemplate(rf_system=rf_system)  # -> lines
# ---------- py_compas_20: Python ----------
# venv: ca-fs26-final-project

from compas_rhino.conversions import line_to_rhino
lines = [line_to_rhino(c_lines) for c_lines in rf_system.centerlines]
# ---------- end py_compas_20 ----------
py_compas_21 = CompasPyTemplate(goals=goals_6)  # -> target_surface
# ---------- py_compas_21: Python ----------
# venv: ca-fs26-final-project

from compas_rhino.conversions import surface_to_rhino
target_surface = surface_to_rhino(goals.target_surface)
# ---------- end py_compas_21 ----------
active = BooleanToggle(False)
undo = Button()
live_edit_geometry = CSharpScript(
    lines=py_compas_20,
    reset=Button(),
    active=active,
    tol="50",
    gumball=Toggle(True),
    snap_geom=Toggle(True),
    snap_ext=Toggle(False),
    snap_srf=Toggle(True),
    undo=undo,
    srf=py_compas_21)  # -> out_lines, points; inputs lines: list of Line, reset: Boolean, active: Boolean, tol: Int32, gumball: Boolean, snap_geom: Boolean, snap_ext: Boolean, snap_srf: Boolean, undo: Boolean, srf: Brep
# ---------- live_edit_geometry: C# ----------
using System;
using System.Collections;
using System.Collections.Generic;

using Rhino;
using Rhino.Geometry;

using Grasshopper;
using Grasshopper.Kernel;
using Grasshopper.Kernel.Data;
using Grasshopper.Kernel.Types;

// ------------------------------------------------------------------------------
// C# SCRIPT FOR GRASSHOPPER
// Copy the content below into a C# Script Component
// ------------------------------------------------------------------------------

/* 
 * INPUTS (Rename your Component inputs to match these!):
 * lines     : List<Line>  (List Access)
 * reset     : bool        (Item Access)
 * active    : bool        (Item Access)
 * tol       : int         (Item Access)
 * gumball   : bool        (Item Access)
 * snap_geom : bool        (Item Access)
 * snap_ext  : bool        (Item Access) * snap_ext  : bool        (Item Access) * snap_srf  : bool        (Item Access)
 * srf       : Brep        (Item Access)
 * undo      : bool        (Item Access)
 *
 * OUTPUTS (Rename your Component outputs to match these!):
 * out_lines : List of modified lines
 * points    : List of points
 */


// TODOs / Improvements:
// - snap to grid?
// - snap to ortho (shift key?)
// - store movements: undo-redo stack, but also re-apply movements after reset (triggerd by input button)

public class Script_Instance : GH_ScriptInstance
{
  private void RunScript(
		List<Line> lines,
		bool reset,
		bool active,
		int tol,
		bool gumball,
		bool snap_geom,
		bool snap_ext,
		bool snap_srf,
		bool undo,
		Brep srf,
		ref object out_lines,
		ref object points)
  {
    // 1. Initialize Controller
    if (_controller == null)
    {
      _controller = new InteractionController(this.Component);
    }

    // 2. Handle Reset
    if (reset || _controller.Points == null || _controller.Points.Count == 0)
    {
      _controller.SetPointsFromLines(lines);
      _controller.ClearUndo(); 
    }
    else if (undo)
    {
       _controller.Undo();
    }
    
    if (lines == null || lines.Count == 0) return;

    // 3. Update behavior
    _controller.Enabled = active;
    _controller.Tolerance = (tol > 0) ? tol : 30; 
    _controller.SnapToGeometry = snap_geom;
    _controller.SnapToExtension = snap_ext;
    _controller.SnapToSurface = snap_srf;
    _controller.TargetSurface = srf;
    _controller.UseGumball = gumball;

    // 4. Output
    if (_controller.Points != null)
    {
      points = new List<Point3d>(_controller.Points);
      out_lines = _controller.ReconstructLines();
    }
  }

  private InteractionController _controller;

  // <Custom additional code> 
  
  public class InteractionController : IDisposable
  {
    public List<Point3d> Points { get; private set; }
    public bool Enabled 
    {
      get { return _enabled; }
      set 
      {
        if (_enabled == value) return;
        _enabled = value;
        if (_enabled) Enable();
        else Disable();
      }
    }
    public int Tolerance { get; set; } = 30; // 30px
    public bool SnapToGeometry { get; set; } = false;
    public bool SnapToExtension { get; set; } = false;
    public bool SnapToSurface { get; set; } = false;
    public Brep TargetSurface { get; set; }
    public bool UseGumball { get; set; } = false;

    private bool _enabled = false;
    private IGH_Component _component;
    private EditorConduit _conduit;
    private EditorMouseCallback _mouseCallback;

    public int DragIndex = -1;
    public int HoverIndex = -1;
    public Plane DragPlane;
    public Point3d DragOrigin; // Original point location when drag started
    public Vector3d ConstraintAxis = Vector3d.Unset; // For Gumball
    public Vector3d HoverAxis = Vector3d.Unset; // For Gumball Highlight
    
    // Line Extension Constraint
    public Line ExtensionLine; 
    public bool IsExtensionConstrained = false;

    // TOGGLE: Determines if Line Extension prevents other snaps (True) or if other snaps override it (False)
    public bool ExtensionOverridesSnaps = true; 

    // TOGGLE: Determines if Gumball Axis Movement overrides all snaps (True)
    public bool AxisMoveOverrideSnaps = true;

    // Snap Feedback
    public Point3d CurrentSnapPoint = Point3d.Unset;
    public bool IsSnapped = false;

    // UNDO Stack
    private Stack<List<Point3d>> _undoStack = new Stack<List<Point3d>>();

    public InteractionController(IGH_Component component)
    {
      _component = component;
      Points = new List<Point3d>();
    }

    public void RecordUndo()
    {
        if (Points != null)
        {
            // Deep copy of points
            List<Point3d> state = new List<Point3d>(Points);
            _undoStack.Push(state);
            
            // Limit stack depth if needed
            if (_undoStack.Count > 50) 
            {
               // Stack doesn't have RemoveLast, but for now 50 is plenty
            }
        }
    }

    public void Undo()
    {
        if (_undoStack.Count > 0)
        {
            List<Point3d> prevParams = _undoStack.Pop();
            Points = prevParams;
            if (_component != null) _component.ExpireSolution(true);
        }
    }
    
    public void ClearUndo()
    {
        _undoStack.Clear();
    }

    public void SetPointsFromLines(List<Line> lines)
    {
      Points.Clear();
      if (lines == null) return;
      foreach (Line ln in lines)
      {
        Points.Add(ln.From);
        Points.Add(ln.To);
      }
    }

    public List<Line> ReconstructLines()
    {
      var result = new List<Line>();
      if (Points == null) return result;
      for (int i = 0; i < Points.Count - 1; i += 2)
      {
        result.Add(new Line(Points[i], Points[i + 1]));
      }
      return result;
    }

    private void Enable()
    {
      Disable(); 
      _conduit = new EditorConduit(this);
      _conduit.Enabled = true;

      _mouseCallback = new EditorMouseCallback(this, _component);
      _mouseCallback.Enabled = true;
    }

    private void Disable()
    {
      if (_conduit != null) { _conduit.Enabled = false; _conduit = null; }
      if (_mouseCallback != null) { _mouseCallback.Enabled = false; _mouseCallback = null; }
      
      if (Rhino.RhinoDoc.ActiveDoc != null)
        Rhino.RhinoDoc.ActiveDoc.Views.Redraw();
    }

    public void Dispose()
    {
      Disable();
    }
  }

  public class EditorConduit : Rhino.Display.DisplayConduit
  {
    private InteractionController _controller;
    private System.Drawing.Color _cDef = System.Drawing.Color.Black;
    private System.Drawing.Color _cHover = System.Drawing.Color.Red;
    private System.Drawing.Color _cDrag = System.Drawing.Color.Blue;
    private System.Drawing.Color _cSnap = System.Drawing.Color.Fuchsia;

    public EditorConduit(InteractionController controller)
    {
      _controller = controller;
    }

    protected override void CalculateBoundingBox(Rhino.Display.CalculateBoundingBoxEventArgs e)
    {
      if (_controller != null && _controller.Enabled && _controller.Points != null)
      {
        var bbox = new BoundingBox(_controller.Points);
        e.IncludeBoundingBox(bbox);
      }
    }

    protected override void DrawOverlay(Rhino.Display.DrawEventArgs e)
    {
      if (_controller == null || !_controller.Enabled || _controller.Points == null) return;

      var pts = _controller.Points;

      // Draw Lines
      for (int i = 0; i < pts.Count - 1; i += 2)
      {
          e.Display.DrawLine(pts[i], pts[i + 1], System.Drawing.Color.Black, 2);
      }

      // Draw Points
      for (int i = 0; i < pts.Count; i++)
      {
        var radius = 4;
        var color = _cDef;
        var style = Rhino.Display.PointStyle.RoundControlPoint;

        if (i == _controller.DragIndex)
        {
          color = _cDrag;
          radius = 6;
        }
        else if (i == _controller.HoverIndex)
        {
          color = _cHover;
          radius = 5; 
        }

        e.Display.DrawPoint(pts[i], style, radius, color);
      }

      // Draw Snapping Confirmation
      if (_controller.DragIndex != -1 && _controller.IsSnapped)
      {
          e.Display.DrawPoint(_controller.CurrentSnapPoint, Rhino.Display.PointStyle.X, 8, _cSnap);
          // Optional: Draw Line from Mouse to Snap
      }

      // Draw "Gumball" (Simple Arrows)
      // Show when Dragging or Hovering
      int gumballIndex = -1;
      if (_controller.DragIndex != -1) gumballIndex = _controller.DragIndex;
      else if (_controller.HoverIndex != -1) gumballIndex = _controller.HoverIndex;

      if (_controller.UseGumball && gumballIndex != -1)
      {
         Point3d origin = pts[gumballIndex];
         
         // Use camera oriented scale or fixed world scale? 
         // Fixed world scale is easier, lets guess 1.0 or based on tolerance?
         double scale = 1.0; 
         // Better: Use pixels to world scale
         try {
             double pixelsPerUnit;
             e.Viewport.GetWorldToScreenScale(origin, out pixelsPerUnit);
             if (pixelsPerUnit > 0) scale = 80.0 / pixelsPerUnit; // 80 pixels long
         } catch {}

         // Hide thick highlights when dragging to keep view clean
         bool showHighlights = (_controller.DragIndex == -1);

         // X Axis (Red)
         if (showHighlights && _controller.HoverAxis == Vector3d.XAxis) e.Display.DrawLine(new Line(origin, origin + Vector3d.XAxis * scale), System.Drawing.Color.Gold, 5); // Highlight
         e.Display.DrawArrow(new Line(origin, origin + Vector3d.XAxis * scale), System.Drawing.Color.Red, 3, 0.3);
         
         // Y Axis (Green)
         if (showHighlights && _controller.HoverAxis == Vector3d.YAxis) e.Display.DrawLine(new Line(origin, origin + Vector3d.YAxis * scale), System.Drawing.Color.Gold, 5);
         e.Display.DrawArrow(new Line(origin, origin + Vector3d.YAxis * scale), System.Drawing.Color.FromArgb(0, 200, 0), 3, 0.3);
         
         // Z Axis (Blue)
         if (showHighlights && _controller.HoverAxis == Vector3d.ZAxis) e.Display.DrawLine(new Line(origin, origin + Vector3d.ZAxis * scale), System.Drawing.Color.Gold, 5);
         e.Display.DrawArrow(new Line(origin, origin + Vector3d.ZAxis * scale), System.Drawing.Color.Blue, 3, 0.3);
         
         // Highlight constrained axis
         if (_controller.DragIndex != -1 && _controller.ConstraintAxis != Vector3d.Unset)
         {
             // Draw "infinite" line but controlled length to avoid glitches
             Point3d basePt = (_controller.Enabled) ? _controller.DragOrigin : origin;

             // Length: approx 60 * 80px = 4800px on screen
             double ext = scale * 60.0; 
             
             Line axisLine = new Line(
                 basePt - _controller.ConstraintAxis * ext, 
                 basePt + _controller.ConstraintAxis * ext
             );
             
             // Use standard line, LightGray for subtlety
             e.Display.DrawLine(axisLine, System.Drawing.Color.LightGray, 1);
         }
      }

      // Draw Extension Constraint Line (Inference)
      if (_controller.DragIndex != -1 && _controller.IsExtensionConstrained && _controller.ConstraintAxis == Vector3d.Unset)
      {
           // Calculate scale for length
           double scale = 1.0; 
           try {
               double pixelsPerUnit;
               Point3d mid = _controller.ExtensionLine.From;
               e.Viewport.GetWorldToScreenScale(mid, out pixelsPerUnit);
               if (pixelsPerUnit > 0) scale = 80.0 / pixelsPerUnit; 
           } catch {}

           double ext = scale * 60.0;
           Vector3d dir = _controller.ExtensionLine.Direction;
           dir.Unitize();
           
           // Draw line passing through fixed point (From)
           Point3d fixedPt = _controller.ExtensionLine.From;
           Line visLine = new Line(fixedPt - dir * ext, fixedPt + dir * ext);
           
           // Draw dashed or light gray
           e.Display.DrawLine(visLine, System.Drawing.Color.LightGray, 1);
      }
    }
  }

  public class EditorMouseCallback : Rhino.UI.MouseCallback
  {
    private InteractionController _controller;
    private IGH_Component _component;

    public EditorMouseCallback(InteractionController controller, IGH_Component component)
    {
      _controller = controller;
      _component = component;
    }

    protected override void OnMouseDown(Rhino.UI.MouseCallbackEventArgs e)
    {
      if (_component.OnPingDocument() == null) { this.Enabled = false; return; }

      if (e.Button == System.Windows.Forms.MouseButtons.Left)
      {
        if (_controller.HoverIndex != -1)
        {
          // RECORD STATE BEFORE DRAG BEGINS
          _controller.RecordUndo();

          _controller.DragIndex = _controller.HoverIndex;

          var view = e.View.ActiveViewport;
          var pt = _controller.Points[_controller.DragIndex];
          _controller.DragOrigin = pt; // Store start position for Gumball
          
          // GUMBALL DETECTION (Using pre-calculated HoverAxis)
          _controller.ConstraintAxis = Vector3d.Unset;
          if (_controller.UseGumball && _controller.HoverAxis != Vector3d.Unset)
          {
             _controller.ConstraintAxis = _controller.HoverAxis;
          }

          // Robust Plane creation
          Plane plane;
          if (_controller.ConstraintAxis != Vector3d.Unset)
          {
             // If Constrained, plane doesn't matter as much, but we need one for intersection
             // Create plane calculating "look"
             view.GetCameraFrame(out plane); 
             plane.Origin = pt;
          }
          else
          {
              view.GetCameraFrame(out plane); 
              plane.Origin = pt;
          }
          _controller.DragPlane = plane;

          e.View.Redraw();
          e.Cancel = true; 
        }
      }
      base.OnMouseDown(e);
    }

    // Helper: Min distance between two skew lines (finite segments check approximates)
    private double DistLineLine(Line ray, Line axis)
    {
       double a, b;
       // IntersectLib version handles infinite lines, we need to be careful
       // For Gumball, approximate check: closest point on infinite lines, if within segment
       if (Rhino.Geometry.Intersect.Intersection.LineLine(ray, axis, out a, out b, 0.001, false))
       {
           Point3d pa = ray.PointAt(a);
           Point3d pb = axis.PointAt(b);
           // Check if pb is within axis segment
           double param = axis.ClosestParameter(pb);
           if (param >= 0.0 && param <= 1.0)
               return pa.DistanceTo(pb);
       }
       return double.MaxValue;
    }

    protected override void OnMouseMove(Rhino.UI.MouseCallbackEventArgs e)
    {
      if (_component.OnPingDocument() == null) { this.Enabled = false; return; }

      // DRAGGING
      if (_controller.DragIndex != -1)
      {
        var view = e.View.ActiveViewport;
        Line pickRay;
        
        if (view.GetFrustumLine(e.ViewportPoint.X, e.ViewportPoint.Y, out pickRay))
        {
            Point3d? candidatePos = null;

            // 1. Calculate Raw Position / Constraint Position
            if (_controller.ConstraintAxis != Vector3d.Unset)
            {
                // Project Ray onto Infinite Line defined by DragOrigin and ConstraintAxis
                // Using basic LineLine closest point approach (closest point on axis to ray)
                
                Line axisLine = new Line(_controller.DragOrigin, _controller.DragOrigin + _controller.ConstraintAxis);
                double a, b;
                
                // RhinoCommon LineLine without tolerance finds closest points on infinite lines
                if (Rhino.Geometry.Intersect.Intersection.LineLine(pickRay, axisLine, out a, out b))
                {
                   candidatePos = axisLine.PointAt(b);
                }
            }
            else
            {
               // Planar Drag
               double t;
               if (Rhino.Geometry.Intersect.Intersection.LinePlane(pickRay, _controller.DragPlane, out t))
               {
                  candidatePos = pickRay.PointAt(t);
               }
            }

            if (candidatePos.HasValue)
            {
               Point3d newPt = candidatePos.Value;
               _controller.IsSnapped = false;
               _controller.IsExtensionConstrained = false;

               // A. LINE EXTENSION CONSTRAINT (Inference)
               // Only check if dragging freely (not locked by Gumball) AND Extension Snapping is enabled
               bool isAxisLocked = (_controller.ConstraintAxis != Vector3d.Unset);
               if (!isAxisLocked && _controller.SnapToExtension)
               {
                   // Define the axis of the line being dragged (from its other endpoint)
                   int otherIndex = _controller.DragIndex ^ 1; // 0->1, 1->0, 2->3 etc.
                   Point3d fixedPt = _controller.Points[otherIndex];
                   Vector3d dir = _controller.DragOrigin - fixedPt; // Original direction vector
                   
                   if (dir.Length > 1e-6) // Ignore zero length lines
                   {
                       // Create infinite extension line
                       Line extLine = new Line(fixedPt, fixedPt + dir);
                       
                       // Check proximity of Ray to this line
                       double a, b;
                       if (Rhino.Geometry.Intersect.Intersection.LineLine(pickRay, extLine, out a, out b))
                       {
                           // Point on line
                           Point3d projPt = extLine.PointAt(b);
                           
                           // Screen Projection
                           var screenProj = view.WorldToClient(projPt);
                           
                           // Mouse position
                           double mx = e.ViewportPoint.X;
                           double my = e.ViewportPoint.Y;
                           
                           double dScreen = Math.Sqrt(Math.Pow(screenProj.X - mx, 2) + Math.Pow(screenProj.Y - my, 2));
                           
                           // Use snapping tolerance (e.g. 15px) -> reduced to 0.35 for stricter release
                           if (dScreen < _controller.Tolerance * 0.35)
                           {
                               newPt = projPt;
                               _controller.IsExtensionConstrained = true;
                               _controller.ExtensionLine = extLine;
                           }
                       }
                   }
               }
               
               // 2. SNAP to SURFACE 
               // Condition: Snap enabled AND (Extension not active OR Extension doesn't override)
               // AND Gumball Axis not overriding
               bool canSnapSrf = (!_controller.IsExtensionConstrained || !_controller.ExtensionOverridesSnaps)
                                 && (!isAxisLocked || !_controller.AxisMoveOverrideSnaps);
               
               if (_controller.SnapToSurface && _controller.TargetSurface != null && canSnapSrf)
               {
                   Point3d closest = _controller.TargetSurface.ClosestPoint(newPt);
                   newPt = closest; 
               }

               // 3. SNAP to GEOMETRY
               // Condition: Snap enabled AND (Extension not active OR Extension doesn't override)
               // AND Gumball Axis not overriding
               bool canSnapGeom = (!_controller.IsExtensionConstrained || !_controller.ExtensionOverridesSnaps)
                                  && (!isAxisLocked || !_controller.AxisMoveOverrideSnaps);

               if (_controller.SnapToGeometry && canSnapGeom)
               {
                   Point3d snapPt = newPt;
                   double bestDist = double.MaxValue;
                   bool vertexSnapped = false;

                   // Use 50% of tolerance
                   double snapTol = _controller.Tolerance * 0.5;

                   // Mouse position on screen
                   double mx = e.ViewportPoint.X;
                   double my = e.ViewportPoint.Y;

                   // A. Snap to Vertices (Priority 1)
                   for (int i=0; i<_controller.Points.Count; i++)
                   {
                       if (i == _controller.DragIndex) continue;
                       
                       // Project candidate point to screen
                       var screenPt = view.WorldToClient(_controller.Points[i]);
                       
                       double dx = screenPt.X - mx;
                       double dy = screenPt.Y - my;
                       double distScreen = Math.Sqrt(dx*dx + dy*dy);

                       if (distScreen < snapTol && distScreen < bestDist) {
                           bestDist = distScreen;
                           snapPt = _controller.Points[i];
                           vertexSnapped = true;
                           _controller.IsSnapped = true;
                       }
                   }

                   // B. Snap to Lines (Priority 2) - Only if no vertex found
                   if (!vertexSnapped)
                   {
                        for (int j = 0; j < _controller.Points.Count - 1; j += 2)
                        {
                            // Avoid snapping to self (lines connected to dragged point)
                            if (_controller.DragIndex == j || _controller.DragIndex == j + 1) continue;

                            Point3d p1 = _controller.Points[j];
                            Point3d p2 = _controller.Points[j+1];

                            // Screen Projection
                            var s1 = view.WorldToClient(p1);
                            var s2 = view.WorldToClient(p2);

                            // Distance Point to Segment (2D)
                            double px = s2.X - s1.X;
                            double py = s2.Y - s1.Y;
                            double lenSq = px*px + py*py;
                            double u = ((mx - s1.X) * px + (my - s1.Y) * py) / (lenSq > 0 ? lenSq : 1.0);
                            
                            if (u < 0) u = 0; 
                            if (u > 1) u = 1;

                            double cx = s1.X + u * px;
                            double cy = s1.Y + u * py;
                            
                            double dx = mx - cx;
                            double dy = my - cy;
                            double distScreen = Math.Sqrt(dx*dx + dy*dy);

                            if (distScreen < snapTol && distScreen < bestDist) 
                            {
                                bestDist = distScreen;
                                
                                // Calculate 3D Snap Point on Line
                                Line targetLine = new Line(p1, p2);
                                double a, b;
                                if (Rhino.Geometry.Intersect.Intersection.LineLine(pickRay, targetLine, out a, out b))
                                {
                                    // Constrain to segment
                                    Point3d rawPt = targetLine.PointAt(b);
                                    double t = targetLine.ClosestParameter(rawPt);
                                    if (t < 0) t = 0; if (t > 1) t = 1;
                                    snapPt = targetLine.PointAt(t);
                                    _controller.IsSnapped = true;
                                }
                            }
                        }
                   }
                   
                   if (_controller.IsSnapped) newPt = snapPt;
               }

               _controller.Points[_controller.DragIndex] = newPt;
               _controller.CurrentSnapPoint = newPt; // For display
               
               _component.ExpireSolution(true);
            }
        }
      }
      // HOVERING
      else
      {
        double minDist = _controller.Tolerance;
        int closest = -1;
        var pts = _controller.Points;
        var view = e.View.ActiveViewport;
        
        int mx = (int)e.ViewportPoint.X;
        int my = (int)e.ViewportPoint.Y;

        // Try to keep selection if interacting with Gumball
        bool isOnGumball = false;
        Vector3d hoverAxis = Vector3d.Unset;

        if (_controller.UseGumball && _controller.HoverIndex != -1)
        {
            Point3d pt = pts[_controller.HoverIndex];
            
            // 1. Dead Zone Check (Screen Space)
            // Ensure we can grab the point center without hitting axes
            Point2d sPt = view.WorldToClient(pt);
            double distToCenter = Math.Sqrt(Math.Pow(sPt.X - mx, 2) + Math.Pow(sPt.Y - my, 2));
            double deadZone = 12.0; // Pixels

            // Only check axes if we are OUTSIDE the dead zone
            if (distToCenter > deadZone)
            {
               Line ray;
               if (view.GetFrustumLine(e.ViewportPoint.X, e.ViewportPoint.Y, out ray))
               {
                   double scale = 1.0;
                   double pixelsPerUnit;
                   view.GetWorldToScreenScale(pt, out pixelsPerUnit);
                   if (pixelsPerUnit > 0) scale = 80.0 / pixelsPerUnit;

                   Line lx = new Line(pt, pt + Vector3d.XAxis * scale);
                   Line ly = new Line(pt, pt + Vector3d.YAxis * scale);
                   Line lz = new Line(pt, pt + Vector3d.ZAxis * scale);

                   // 2. Expanded Tolerance
                   // Make axes easier to grab when not in center
                   double screenTol = _controller.Tolerance * 0.8; // e.g. 24px
                   double worldTol = screenTol;
                   if (pixelsPerUnit > 0) worldTol /= pixelsPerUnit;

                   if (DistLineLine(ray, lx) < worldTol) hoverAxis = Vector3d.XAxis;
                   else if (DistLineLine(ray, ly) < worldTol) hoverAxis = Vector3d.YAxis;
                   else if (DistLineLine(ray, lz) < worldTol) hoverAxis = Vector3d.ZAxis;

                   if (hoverAxis != Vector3d.Unset)
                   {
                       isOnGumball = true;
                       closest = _controller.HoverIndex; // Maintain selection
                   }
               }
            }
        }
        
        // Normal Point Search
        if (!isOnGumball)
        {
            for (int i = 0; i < pts.Count; i++)
            {
              var screenPt = view.WorldToClient(pts[i]);
              double dx = screenPt.X - mx;
              double dy = screenPt.Y - my;
              double dist = Math.Sqrt(dx*dx + dy*dy);

              if (dist < minDist)
              {
                minDist = dist;
                closest = i;
              }
            }
        }

        if (_controller.HoverIndex != closest || _controller.HoverAxis != hoverAxis)
        {
          _controller.HoverIndex = closest;
          _controller.HoverAxis = hoverAxis;
          e.View.Redraw();
        }
      }
      base.OnMouseMove(e);
    }

    protected override void OnMouseUp(Rhino.UI.MouseCallbackEventArgs e)
    {
      if (_controller.DragIndex != -1)
      {
        _controller.DragIndex = -1;
        _controller.ConstraintAxis = Vector3d.Unset;
        _controller.IsSnapped = false;
        if (_component != null) _component.ExpireSolution(true);
      }
      base.OnMouseUp(e);
    }
  }
  // </Custom additional code> 
}
# ---------- end live_edit_geometry ----------
swap = Python3Script(rf_system=rf_system, lines=live_edit_geometry.out_lines)  # -> out_rf, out_lines; inputs lines: list of Line
# ---------- swap: Python ----------
# venv: ca-fs26-final-project

from compas_rhino.devtools import DevTools
DevTools.ensure_path()

import System
import Rhino
import scriptcontext as sc
from compas.datastructures import Mesh
from compas.geometry import Point, Line, Vector
from compas_ghpython import warning

from a03_rf_system_hybrid import RFSystemHybrid

def rhino_line_to_compas(r_line):
    """Convert a Rhino Line to a Compas Line."""
    s = r_line.From
    e = r_line.To
    return Line(Point(s.X, s.Y, s.Z), Point(e.X, e.Y, e.Z))


if rf_system and lines:
    
    # 1. Convert valid Rhino lines to Compas
    valid_lines = []
    for r_line in lines:
        if r_line and r_line.IsValid and r_line.Length >= 0.001:
            valid_lines.append(rhino_line_to_compas(r_line))
            
    # 2. Rebuild the mesh topology
    inner_mesh = Mesh()
    vertex_map = {}
    tolerance = 0.01

    def get_or_create_vertex(mesh, point, vertex_map):
        coords = (round(point.x / tolerance) * tolerance,
                  round(point.y / tolerance) * tolerance,
                  round(point.z / tolerance) * tolerance)
        if coords in vertex_map: 
            return vertex_map[coords]
        vkey = mesh.add_vertex(x=point.x, y=point.y, z=point.z)
        vertex_map[coords] = vkey
        return vkey

    # Pass 1: Add all vertices and prepare edges
    edge_data = []
    for line in valid_lines:
        u = get_or_create_vertex(inner_mesh, line.start, vertex_map)
        v = get_or_create_vertex(inner_mesh, line.end, vertex_map)
        if u != v: 
            edge_data.append((u, v, line))

    # Pass 2: Create topological face mapping to force mesh edge creation
    edges_added = 0
    for u, v, line in edge_data:
        if not inner_mesh.has_edge((u, v)):
            
            # Find a third closest vertex to create a face
            mid = Point(
                (line.start.x + line.end.x) / 2,
                (line.start.y + line.end.y) / 2,
                (line.start.z + line.end.z) / 2
            )
            
            min_dist = float('inf')
            third = None
            for vkey in inner_mesh.vertices():
                if vkey != u and vkey != v:
                    v_coords = inner_mesh.vertex_coordinates(vkey)
                    dist = ((v_coords[0] - mid.x)**2 +
                           (v_coords[1] - mid.y)**2 +
                           (v_coords[2] - mid.z)**2)**0.5
                    if dist < min_dist:
                        min_dist = dist
                        third = vkey
            
            if third is not None:
                try:
                    # Creating a face generates the mesh-edge
                    inner_mesh.add_face([u, v, third])
                    inner_mesh.edge_attribute((u, v), "centerline", line)
                    
                    # Retrieve original normal through proximity
                    normal = Vector(0, 0, 1) # Default
                    is_boundary = False
                    
                    if hasattr(rf_system, 'inner_mesh'):
                        for old_edge in rf_system.inner_mesh.edges():
                            old_cl = rf_system.inner_mesh.edge_attribute(old_edge, "centerline")
                            if old_cl:
                                dist_to_mid = old_cl.midpoint.distance_to_point(line.midpoint)
                                if dist_to_mid < 0.15:
                                    old_norm = rf_system.inner_mesh.edge_attribute(old_edge, "normal")
                                    if old_norm:
                                        normal = old_norm
                                    
                                    old_bound = rf_system.inner_mesh.edge_attribute(old_edge, "is_boundary")
                                    if old_bound is not None:
                                        is_boundary = old_bound
                                    break
                    
                    inner_mesh.edge_attribute((u, v), "normal", normal)
                    inner_mesh.edge_attribute((u, v), "is_boundary", is_boundary)
                    edges_added += 1
                except Exception as e:
                    print(f"Warning: Could not create edge/face logic: {e}")

    # Remove topological filler edges that were generated by add_face but don't hold centerlines
    edges_to_remove = []
    for edge in inner_mesh.edges():
        if inner_mesh.edge_attribute(edge, "centerline") is None:
            edges_to_remove.append(edge)
    
    # COMPAS doesn't allow direct edge deletion easily without removing faces, 
    # but GeometricTimberModelCreator skips edges with "centerline" == None 
    # so we're safe without manually trying to sever the mesh graph.
            
    # 3. Output updated system
    out_rf = RFSystemHybrid(inner_mesh, Mesh())
    out_lines = out_rf.centerlines
    
    print(f"Reconstructed Mesh: {inner_mesh.number_of_vertices()} Vertices, {edges_added} Real Edges")
else:
    if not rf_system:
        warning(ghenv.Component, "Input 'rf_system' is missing.")
    if not lines:
        warning(ghenv.Component, "Input 'lines' is missing.")
    out_rf = None
    out_lines = []
# ---------- end swap ----------

# ----
# Live Edit Centerlines
rf_system_2 = Data(rf_from_centerlines.rf_system)
goals_7 = Data(goals_2)
py_compas_22 = CompasPyTemplate(rf_system=rf_system_2)  # -> lines; same code as py_compas_20
py_compas_23 = CompasPyTemplate(goals=goals_7)  # -> target_surface; same code as py_compas_21
active_2 = BooleanToggle(False)
undo_2 = Button()
live_edit_geometry_2 = CSharpScript(
    lines=py_compas_22,
    reset=Button(),
    active=active_2,
    tol="50",
    gumball=Toggle(True),
    snap_geom=Toggle(True),
    snap_ext=Toggle(False),
    snap_srf=Toggle(True),
    undo=undo_2,
    srf=py_compas_23)  # -> out_lines, points; inputs lines: list of Line, reset: Boolean, active: Boolean, tol: Int32, gumball: Boolean, snap_geom: Boolean, snap_ext: Boolean, snap_srf: Boolean, undo: Boolean, srf: Brep; same code as live_edit_geometry
swap_2 = Python3Script(rf_system=rf_system_2, lines=live_edit_geometry_2.out_lines)  # -> out_rf, out_lines; inputs lines: list of Line; same code as swap

# ----
# Live Edit Centerlines
rf_system_3 = Data(py_compas_19.rf_system)
goals_8 = Data(goals)
py_compas_24 = CompasPyTemplate(rf_system=rf_system_3)  # -> lines; same code as py_compas_20
py_compas_25 = CompasPyTemplate(goals=goals_8)  # -> target_surface; same code as py_compas_21
active_3 = BooleanToggle(False)
undo_3 = Button()
live_edit_geometry_3 = CSharpScript(
    lines=py_compas_24,
    reset=Button(),
    active=active_3,
    tol="50",
    gumball=Toggle(True),
    snap_geom=Toggle(True),
    snap_ext=Toggle(False),
    snap_srf=Toggle(True),
    undo=undo_3,
    srf=py_compas_25)  # -> out_lines, points; inputs lines: list of Line, reset: Boolean, active: Boolean, tol: Int32, gumball: Boolean, snap_geom: Boolean, snap_ext: Boolean, snap_srf: Boolean, undo: Boolean, srf: Brep; same code as live_edit_geometry
swap_3 = Python3Script(rf_system=rf_system_3, lines=live_edit_geometry_3.out_lines)  # -> out_rf, out_lines; inputs lines: list of Line
# ---------- swap_3: Python ----------
# venv: ca-fs26-focus-work

"""
Script to update the out_lines of an RFSystem with new Rhino lines.

Inputs:
    rf_system: The RFSystem object to update.
    lines: A list of Rhino.Geometry.Line objects (the new out_lines).

Outputs:
   out_rf: The updated RFSystem with new out_lines.
"""

import Rhino
from compas.geometry import Point
from compas.geometry import Line
from compas_ghpython import warning


def rhino_line_to_compas(r_line):
    """Convert a Rhino Line to a Compas Line."""
    s = r_line.From
    e = r_line.To
    return Line(Point(s.X, s.Y, s.Z), Point(e.X, e.Y, e.Z))


if rf_system and lines:
    # 1. Create a copy of the system to avoid mutating the input in-place
    # This assumes RFSystem has a .copy() method (which we checked it does)
    new_system = rf_system.copy()
    
    # 2. Get all edges from the mesh
    # Note: mesh.edges() is a generator, so we convert to list for indexing/zipping
    # The order of edges is deterministic, so as long as the input 'lines' 
    # were generated from this same mesh's edges originally, the order matches.
    edges = list(new_system.mesh.edges())

    # 3. Validation
    if len(edges) != len(lines):
        print("Error: Edge count ({}) does not match Line count ({})".format(len(edges), len(lines)))
        out_rf = None
    else:
        # 4. Update the 'centerline' attribute for each edge
        for edge, r_line in zip(edges, lines):
            if r_line and r_line.IsValid:
                c_line = rhino_line_to_compas(r_line)
                new_system.mesh.edge_attribute(edge, "centerline", c_line)
        
        out_rf = new_system
        out_lines = out_rf.centerlines
else:
    if not rf_system:
        warning(ghenv.Component, "Input 'rf_system' is missing.")
    if not lines:
        warning(ghenv.Component, "Input 'lines' is missing.")
    out_rf = None
# ---------- end swap_3 ----------

# ----
# Timber Model
dam_3 = DataDam(DataA=swap.out_rf, BufferDelay=10000000, BufferMode=0)
py_compas_26 = CompasPyTemplate(
    rf_system=dam_3,
    process_joinery=Toggle(True),
    beam_width=Slider(0.06, range=0..0.2),
    beam_height=Slider(0.08, range=0..0.2),
    sampling_points=Slider(100, range=5..100))  # -> timber_model, beams, joining_errors
# ---------- py_compas_26: Python ----------
# venv: ca-fs26-focus-work

from compas_rhino.devtools import DevTools
DevTools.ensure_path()
ghenv.Component.Message = "Timber Model (Geometric)"

# -------------------- IMPORTS ---------------------

from a03_timber_model_geometric import GeometricTimberModelCreator
from a03_rf_system_hybrid import RFSystemHybrid

# ------------------- EXECUTION --------------------

# Handle RFSystemHybrid - wrap it to provide a 'mesh' attribute
rf_system_copy = rf_system

print(f"RF System type: {type(rf_system_copy)}")
print(f"RF System class name: {type(rf_system_copy).__name__}")

# Check if it's a hybrid system
is_hybrid = (isinstance(rf_system_copy, RFSystemHybrid) or
             type(rf_system_copy).__name__ == 'RFSystemHybrid' or
             hasattr(rf_system_copy, 'get_combined_mesh'))

if is_hybrid:
    print("Wrapping RFSystemHybrid with mesh accessor...")
    
    # Check if this is a simple hybrid (no boundary beams) - use inner_mesh directly
    boundary_count = len([e for e in rf_system_copy.boundary_mesh.edges()
                         if rf_system_copy.boundary_mesh.is_edge_on_boundary(e)])
    
    if boundary_count == 0:
        print("No boundary beams detected - using inner_mesh directly")
        class RFSystemWrapper:
            def __init__(self, hybrid):
                self.mesh = hybrid.inner_mesh
        rf_system_copy = RFSystemWrapper(rf_system_copy)
    else:
        print(f"Hybrid system with {boundary_count} boundary beams - using combined mesh")
        class RFSystemWrapper:
            def __init__(self, hybrid):
                self._hybrid = hybrid
                self._mesh = None
            
            @property
            def mesh(self):
                """Lazy evaluation - only create combined mesh when accessed."""
                if self._mesh is None:
                    print("Lazy-loading combined mesh...")
                    self._mesh = self._hybrid.get_combined_mesh()
                return self._mesh
        rf_system_copy = RFSystemWrapper(rf_system_copy)
    
    print(f"Wrapped type: {type(rf_system_copy)}, has mesh property: {hasattr(rf_system_copy, 'mesh')}")

# Get sampling_points parameter (default 20)
sampling_points = int(sampling_points) if sampling_points > 2 else 20

# Initialize geometric creator
creator = GeometricTimberModelCreator(rf_system_copy, beam_width, beam_height, sampling_points)

# Create model with geometric intersection detection
timber_model = creator.create_timber_model(process_joinery=process_joinery)
joining_errors = creator.joining_errors

if len(joining_errors):
    ghenv.Component.Message = f"Found {len(joining_errors)} joining errors!"

# Output geometry
beams = []
geometry_errors = []
for beam in timber_model.beams:
    try:
        beams.append(beam.geometry)
    except Exception as e:
        geometry_errors.append(e)
        print(f"Could not add geometry of beam: {e}")

if len(geometry_errors) > 0:
    ghenv.Component.Message = f"{len(geometry_errors)} beams failed to generate geometry!"

# Made with Bob
# ---------- end py_compas_26 ----------
draw_11 = COMPASDraw(cg=py_compas_26.beams)  # -> rg; same code as draw_2
wires = BrepWireframe(Brep=draw_11, Density=-1)
timber_model = Data(py_compas_26.timber_model)
preview = CustomPreview(Geometry=draw_11, Material=ColourSwatch(SwatchColor=RGBA(214, 188, 139, 144)))
preview_2 = CustomPreview(Geometry=wires, Material=ColourSwatch(SwatchColor=RGB(0, 0, 0)))

# ----
# Timber Model
dam_4 = DataDam(DataA=swap_3.out_rf, BufferDelay=10000000, BufferMode=0)
py_compas_27 = CompasPyTemplate(
    rf_system=dam_4,
    process_joinery=Toggle(True),
    beam_width=Slider(0.06, range=0..0.2),
    beam_height=Slider(0.08, range=0..0.2),
    tolerance=Slider(0.04, range=0..0.5))  # -> timber_model, beams, joining_errors
# ---------- py_compas_27: Python ----------
# venv: ca-fs26-focus-work

from compas_rhino.devtools import DevTools
DevTools.ensure_path()
ghenv.Component.Message = "Timber model"

# -------------------- IMPORTS ---------------------

from a03_timber_model import TimberModelCreator

# ------------------- EXECUTION --------------------

# Copy the RF system on start, because that's the way Grasshopper always behaves
rf_system = rf_system.copy()

# Initialize creator
creator = TimberModelCreator(rf_system, beam_width, beam_height, tolerance=tolerance)

# Create model and apply joints
timber_model = creator.create_timber_model(process_joinery=process_joinery)
joining_errors = creator.joining_errors

if len(joining_errors):
    ghenv.Component.Message = f"Found {len(joining_errors)} joining errors!"

# Output geometry
beams = []
geometry_errors = []
for beam in timber_model.beams:
    try:
        beams.append(beam.geometry)
    except Exception as e:
        geometry_errors.append(e)
        print(f"Could you add geometry of beam: {e}")

if len(geometry_errors) > 0:
    ghenv.Component.Message = f"{len(geometry_errors)} beams failed to generate geometry!"
# ---------- end py_compas_27 ----------
draw_12 = COMPASDraw(cg=py_compas_27.beams)  # -> rg; same code as draw_2
wires_2 = BrepWireframe(Brep=draw_12, Density=-1)
timber_model_2 = Data(py_compas_27.timber_model)
preview_3 = CustomPreview(Geometry=draw_12, Material=ColourSwatch(SwatchColor=RGBA(214, 188, 139, 144)))
preview_4 = CustomPreview(Geometry=wires_2, Material=ColourSwatch(SwatchColor=RGB(0, 0, 0)))

# ----
# Milling Toolpaths
dam_5 = DataDam(DataA=timber_model, BufferDelay=10000000, BufferMode=0)
machining_side = ValueList({"Auto": -1, "0", "1", "2", "3"}, selected="1")
rotation = ValueList({"0", "90", "180", "270"}, selected="0")
# Robot Simulation
number_slider_9 = Slider(0, range=0..10)
toolpath = Script(
    model=dam_5,
    beam_key=Slider(8, range=0..200),
    machining_side=machining_side,
    tool_radius=Slider(0.02, range=0.01..1),
    stepdown=Slider(0.01, range=0.01..2),
    stepsize=Slider(0.02, range=0.01..2),
    approach_height=Slider(0.2, range=0.01..10),
    flip_direction=Toggle(True),
    rotation=rotation,
    selected_processing=number_slider_9)  # -> out, beam_at_target, processing_geo_at_target, toolpath, machining_ref_frame, slices, slicing_frames; inputs beam_key: Int32, machining_side: Int32, selected_processing: Int32
# ---------- toolpath: Python ----------
# venv: ca-fs26-focus-work

from compas_rhino.devtools import DevTools
DevTools.ensure_path()

import math
from compas.geometry import Line, Point, Vector, Frame
from compas.geometry import Transformation
from compas.geometry import Rotation
from compas_rhino.conversions import frame_to_rhino_plane
from a03_extra_toolpath import get_toolpath_from_processing

# 1. Select beam
beams = {i: b for i, b in enumerate(model.beams)}
selected_beam = beams[beam_key]
ref_frame = selected_beam.frame.copy()

# Manual rotation
if rotation > 0:
    ref_frame.rotate(math.radians(rotation), ref_frame.xaxis, ref_frame.point)

# --- Target frame defined in robot space ---
# Position: x=0.4, y=-0.4, z=0.0
target_point = Point(0.4, -0.4, 0.0)
target_frame = Frame(target_point, Vector(1, 0, 0), Vector(0, 1, 0))

# Rotate world Z axes 90 degrees
target_frame.rotate(math.radians(90), Vector(0, 0, 1), target_point)

# Frame transformations from Design-Space (ref_frame) to robot frame (target_frame)
machining_transformation = Transformation.from_frame_to_frame(ref_frame, target_frame)
# ---------------------------------------------------------

# Transform geometry for visualization
beam_at_target = selected_beam.geometry.transformed(machining_transformation)

# Reference-side for the machining
f = selected_beam.ref_sides[machining_side]
machining_ref_frame = frame_to_rhino_plane(f.transformed(machining_transformation))

# Generate toolpaths
print(f"Beam {beam_key} has {len(selected_beam.features)} features")
current_processing_count = 0
for feature in selected_beam.features:
    print(f" - {type(feature)}")

    results = get_toolpath_from_processing(
        selected_beam,
        feature,  # processing
        machining_transformation,
        tool_radius=tool_radius,
        stepdown=stepdown,
        min_step=stepsize,
        flip_direction=flip_direction,
        approach_height=approach_height,
        machining_side=machining_side
    )

    if results:
        if selected_processing == current_processing_count:
            if results[0] == "subtraction":
                _result_type, toolpath, processing_geo_at_target, slices, slicing_frames = results
                slicing_frames = list(map(frame_to_rhino_plane, slicing_frames))
            elif results[0] == "cut":
                _result_type, toolpath, processing_geo_at_target, slices = results

            # Convert toolpath frames to Rhino planes
            toolpath = list(map(frame_to_rhino_plane, toolpath))

        current_processing_count += 1
# ---------- end toolpath ----------
tool_path_frames = Geometry(toolpath.toolpath)
compas_draw = COMPASDraw(cg=toolpath.beam_at_target)  # -> rg; same code as draw
compas_draw_2 = COMPASDraw(cg=toolpath.processing_geo_at_target)  # -> rg; same code as draw

# ----
# Save to BTLx
dam_6 = DataDam(DataA=timber_model, BufferDelay=10000000, BufferMode=0)
file_path = FilePath("/Users/timofeddern/Developer/ETH/coding_architecture_fs26/assignments/A03-design-project/test.btlx")
ct_writebtlx = CTWriteBTLx(model=dam_6, path=file_path, write=Button())  # -> BTLx; inputs write: Boolean
#   port model: Model object.
#   port path: Filepath for new BTLx.
#   port write: Write to file.
#   port BTLx: Pretty BTLx string
# ---------- ct_writebtlx: Python ----------
# venv: ca-fs26-focus-work

"""Writes a BTLx file for machining of model parts."""

# flake8: noqa
import Grasshopper
import Rhino

from compas_timber.fabrication import BTLxWriter
from timber_design.ghpython.ghcomponent_helpers import item_input_valid_cpython


class WriteBTLx(Grasshopper.Kernel.GH_ScriptInstance):
    def RunScript(self, model, path, write: bool):
        if not item_input_valid_cpython(ghenv, model, "Model"):
            return

        btlx = BTLxWriter(file_name=str(Rhino.RhinoDoc.ActiveDoc.Name))

        if write:
            if not item_input_valid_cpython(ghenv, path, "Path"):
                return
            XML = btlx.write(model, path)
        else:
            XML = btlx.model_to_xml(model)

        return XML
# ---------- end ct_writebtlx ----------

# ----
# 3D Printing
dam_7 = DataDam(DataA=timber_model, BufferDelay=10000000, BufferMode=0)
py_compas_28 = CompasPyTemplate(timber_model=dam_7, scale_factor=Slider(20, range=0..100), engraving=Toggle(False))  # -> stats, meshes, boundaries, label_loc, label_text, texts_3d, texts_2d; inputs scale_factor: Double, engraving: Boolean
# ---------- py_compas_28: Python ----------
# venv: ca-fs26-focus-work

import Rhino.Geometry as rg
from compas_rhino.devtools import DevTools
DevTools.ensure_path()

# Import the module
from importlib import reload
import a03_extra_3d_printing as printer

# Reload is important when you are editing the module repeatedly
reload(printer)

# ==============================================================================
# 1. PREPARE
# ==============================================================================
# Input: timber_model, scale_factor, engraving (bool)
print_items = printer.prepare_beams_for_printing(
    timber_model, 
    scale_factor, 
    engraving,
    text_size_factor=0.9
)

# ==============================================================================
# 2. PACK
# ==============================================================================
# Inputs: plate_width, plate_length, spacing
packed_plates = printer.solve_shelf_packing(
    print_items, 
    plate_width=0.400, 
    plate_length=0.400, 
    spacing=0.01
)

# ==============================================================================
# 3. VISUALIZE
# ==============================================================================
# visual_meshes, visual_curves, visual_texts, visual_3d_texts, visual_2d_text_curves
meshes, boundaries, labels, texts_3d, texts_2d = printer.visualize_print_setup(
    packed_plates, 
    plate_width=0.400, 
    plate_length=0.400
)

# Unpack labels for standard Rhino Text dots
label_text = [t[0] for t in labels]
label_loc = [t[1] for t in labels]

# Output: 
# meshes (Die Balken ohne Abzug)
# texts_3d (Die 3D-Texte für Boolean in GH)
# texts_2d (Die 2D-Textkurven auf der Oberfläche)

# ==============================================================================
# 4. STATS
# ==============================================================================
stats = printer.get_print_stats(
    packed_plates, 
    duration_per_mm3=0.00215, 
    cost_per_mm3=0.000035
)
print(stats)
# ---------- end py_compas_28 ----------
panel = Panel(py_compas_28.stats)

# ----
# Assembly Sequencing - Graph Traversal
dam_8 = DataDam(DataA=timber_model, BufferDelay=10000000, BufferMode=0)
py3 = Python3Script(timber_model=dam_8, start_node=Slider(0, range=0..220), end_node=Slider(149, range=0..220))  # -> out, a, sequence, b
# ---------- py3: Python ----------
# venv: ca-fs26-focus-work

from compas.datastructures import Graph
from compas.geometry import Line

# import BFS and DFS algorithms
from compas.topology import breadth_first_ordering 
from compas.topology import depth_first_ordering 

# ASSEMBLY SEQUENCE PLANNING 
a = []
g = Graph()

for joint in timber_model.joints:
    ea, eb = joint.elements 
    pa = ea.centerline.midpoint
    pb = eb.centerline.midpoint

    # a.append(pa)
    # a.append(pb)

    # Define the key of the node a and b
    na = g.add_node(str(ea.guid), x=pa.x, y=pa.y, z=pa.z)
    nb = g.add_node(str(eb.guid), x=pb.x, y=pb.y, z=pb.z)
    
    g.add_edge(na, nb)

START_NODE=None

for i, node in enumerate(g.nodes()):
    print(node)
    a.append(g.node_point(node))
    if i == 0:
        START_NODE = node
    if i == start_node:
        PT_START_NODE = node
    if i == end_node:
        PT_END_NODE = node

for na, nb in g.edges():
    # to visualize the edges i create a line between the node points
    line = Line(g.node_point(na), g.node_point(nb))
    a.append(line)

# Fix the starting point of the sequence and select the algorithm (DFS or BFS) for fabrication sequency
start = "63a21126-ac9c-4a9a-9d78-ad2c8829ebfa"
bfs = breadth_first_ordering(g.adjacency, START_NODE) 
# print(bfs) 

sequence = []

#for element_guid in bfs:
    #beam = timber_model.get_element(element_guid)
   # sequence.append(beam.geometry)

for element_guid in bfs:
    beam = timber_model.get_element(element_guid)
    if beam is None:
        print(f"No beam found for guid: {element_guid}")
        continue  # skip instead of crash
    try: 
        sequence.append(beam.geometry)
    except Exception as e:
        print(e)
        continue

# GRAPH TRAVERSAL AND LOAD PATHS
# Take a couple of nodes (beams) e1 and e2: we want to know what's the shortest path between them
b = []
# b.append(timber_model.get_element(e1))
# b.append(timber_model.get_element(e1))

path = g.shortest_path(PT_START_NODE, PT_END_NODE)
print(path) 

# to display on rhino the sequence of beams:
for e in path:
    beam = timber_model.get_element(e)
    b.append(beam.geometry)
# ---------- end py3 ----------
draw_13 = COMPASDraw(cg=py3.b)  # -> rg
#   port cg: The COMPAS geometry or datastructure to be drawn.
#   port rg: The Rhino geometry object.
# ---------- draw_13: Python ----------
# r: compas==2.15.0,compas_timber==1.0.4
# venv: ca-fs26

from typing import Any

import Grasshopper

from compas.scene import SceneObject


class CompasToRhinoGeometry(Grasshopper.Kernel.GH_ScriptInstance):
    def RunScript(self, cg):
        if not cg:
            return None

        return SceneObject(item=cg).draw()
# ---------- end draw_13 ----------
draw_14 = COMPASDraw(cg=py3.a)  # -> rg; same code as draw_13
draw_15 = COMPASDraw(cg=py3.sequence)  # -> rg; same code as draw_13
split = SplitList(List=draw_15, Index=Slider(182, range=0..182))  # -> ListA, ListB
preview_5 = CustomPreview(Geometry=split.ListA, Material=ColourSwatch(SwatchColor=RGB(211, 210, 205)))

run = Button()
# Structural Analysis
model = Data(timber_model)
path = FilePath("/Users/timofeddern/Developer/ETH/coding_architecture_fs26/assignments/A03-design-project/timbermodel2.json")
save_model = Python3Script(model=model, path=path, run=run)
# ---------- save_model: Python ----------
# venv: ca-fs26-focus-work

from compas.data import json_dump

if run and path:
    if not path.lower().endswith('.json'):
        path += '.json'
        
    json_dump(model, path)
    
    print("Model successfully saved to: {}".format(path))
else:
    print("Check 'run' state and ensure 'path' is a complete file path.")
# ---------- end save_model ----------

# ----
# Stats and Arrange
dam_9 = DataDam(DataA=timber_model, BufferDelay=10000000, BufferMode=0)

# ---- group: Robot
robot_model = ValueList({"UR10e": "ur10e", "UR10": "ur10"}, selected="UR10")
reload = Button()
robot_working_volume = Brep(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)
robot_working_area = Curve(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)
list_4 = ValueList({"Joint", "Linear"}, selected="Joint")
ur10e = Python3Script(R=reload, U=robot_model)  # -> M
# ---------- ur10e: Python ----------
# venv: ca-fs26-focus-work

import os
import compas_fab
from compas_robots import RobotModel
from compas_robots.resources import LocalPackageMeshLoader

canvas = ghenv.Component.OnPingDocument()
gh_file_path = canvas.FilePath

if gh_file_path:
    gh_dir = os.path.dirname(gh_file_path)
    robot_data_dir = os.path.join(gh_dir, "ur10_robot")
    urdf_file = os.path.join(robot_data_dir, U + ".urdf")

    model = RobotModel.from_urdf_file(urdf_file)
    loader_path = os.path.join(robot_data_dir, "universal_robot")
    loader = LocalPackageMeshLoader(loader_path, "ur_description")
    
    model.load_geometry(loader, precision=12)
    
    M = model
else:
    print("Please save the Grassahopper file first!")
# ---------- end ur10e ----------
solver = Python3Script(M=ur10e, S=robot_model)  # -> R
# ---------- solver: Python ----------
# venv: ca-fs26-final-project

import os
import compas_fab
from compas.scene import Scene
from compas_fab.backends import AnalyticalInverseKinematics
from compas_fab.backends.interfaces import ClientInterface
from compas_fab.robots import Robot
from compas_fab.robots import RobotSemantics

canvas = ghenv.Component.OnPingDocument()
gh_file_path = canvas.FilePath

if gh_file_path:
    gh_dir = os.path.dirname(gh_file_path)
    
    robot_data_dir = os.path.join(gh_dir, "ur10_robot")
    
    srdf_file = os.path.join(robot_data_dir, 'ur10e.srdf')
    semantics = RobotSemantics.from_srdf_file(srdf_file, M)

    # 3. IK Solver und Client Setup
    client = ClientInterface()
    client.is_connected = True
    client.inverse_kinematics = AnalyticalInverseKinematics(solver=S)

    scene = Scene()
    scene_object = scene.add(M)

    R = Robot(M, scene_object, client=client, semantics=semantics)
else:
    print("Please save the Grasshopper file first!")
# ---------- end solver ----------

# ----
pt_4 = Point(Point(2.31887332, 8.754053132, 0))
py_compas_29 = CompasPyTemplate(
    timber_model=dam_9,
    origin=pt_4,
    stock_length=Slider(5, range=0..10),
    saw_gap=Slider(0.02, range=0..0.05),
    beam_spacing=Slider(0.6, range=0..1),
    beam_offset=Slider(0.2, range=0..1),
    price_lm=Slider(5.1, range=0..10))  # -> model_stats, visual_stocks, visual_beams, packing_stats; inputs origin: Point3d, stock_length: Double, saw_gap: Double, price_lm: Double
# ---------- py_compas_29: Python ----------
# venv: ca-fs26-focus-work

from compas_rhino.devtools import DevTools
DevTools.ensure_path()

from compas_rhino.conversions import point_to_compas
from a03_extra_packing_stats import get_general_stats, solve_bin_packing, visualize_packing, get_packing_stats




model_stats = get_general_stats(timber_model)

stocks = solve_bin_packing(timber_model, stock_length, saw_gap)
origin = point_to_compas(origin)
visual_stocks, visual_beams = visualize_packing(stocks, origin, stock_length, beam_spacing, beam_offset)
packing_stats = get_packing_stats(stocks, stock_length, price_lm)
# ---------- end py_compas_29 ----------
panel_2 = Panel(py_compas_29.packing_stats)
panel_3 = Panel(py_compas_29.model_stats)

# ---- group: Robotic Setup
ur10_table = Geometry([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])
preview_6 = CustomPreview(Geometry=ur10_table, Material=ColourSwatch(SwatchColor=RGBA(222, 222, 222, 114)))

# ---- group: Robot configuration
robot_configuration_type = ValueList({"0", "1", "2", "3", "4", "5", "6", "7"}, selected="2")

# ---- group: Global parameters
speed_0_to_80_mm_s_max = Panel("20")
zone_blend_radius_mm = Panel("10")
acceleration_mm_s = Panel("10")

# ----
texts_2d = Data(py_compas_28.texts_2d)
texts_3d = Data(py_compas_28.texts_3d)

point = Point(Point(0.1775, 0, 0))
mesh_5 = Mesh(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)

# ---- group: Toolhead
point_2 = Point(Point(0.05330083955, -0.0001206596429, -0.1706613512))
mesh_6 = Mesh(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)

tcp = ConstructPlane(Origin=point_2, XAxis=Vector(1, 0, 0), YAxis=Vector(0, 1, 0))
compas_fab_attached_tool = Python3Script(robot=solver, visual_mesh=mesh_6, tcf_plane=tcp, connected_to="flange")  # -> robot; inputs visual_mesh: Mesh, collision_mesh: Mesh
#   port visual_mesh: A visual mesh for the tool.
#   port collision_mesh: A collision mesh for the tool.
#   port tcf_plane: The frame of the tool in tool0 frame.
#   port group: The planning group to which the tool should be attached.
#   port connected_to: The link to which the tool should be connected to.
# ---------- compas_fab_attached_tool: Python ----------
# venv: ca-fs26-focus-work

"""
Attach a tool to the robot.

COMPAS FAB v1.0.1
"""
import Rhino
import Grasshopper
import rhinoscriptsyntax

from compas.geometry import Frame
from compas_rhino.conversions import mesh_to_compas
from compas_rhino.conversions import plane_to_compas_frame

from compas_fab.robots import Tool

class AttachToolComponent(Grasshopper.Kernel.GH_ScriptInstance):
    def RunScript(self,
            robot,
            visual_mesh: Rhino.Geometry.Mesh,
            collision_mesh: Rhino.Geometry.Mesh,
            tcf_plane,
            group,
            connected_to):
        if robot and robot.client and robot.client.is_connected and visual_mesh:
            if not collision_mesh:
                collision_mesh = visual_mesh

            c_visual_mesh = mesh_to_compas(visual_mesh)
            c_collision_mesh = mesh_to_compas(collision_mesh)

            if not tcf_plane:
                frame = Frame.worldXY()
            else:
                frame = plane_to_compas_frame(tcf_plane)
            tool = Tool(c_visual_mesh, frame, c_collision_mesh, connected_to=connected_to)

            robot.attach_tool(tool, group)

        return robot
# ---------- end compas_fab_attached_tool ----------

# ---- group: Home position / Scanning
reference_point = Point(Point(0.651073194, 0.01404171417, 0.6266659301))
wating_time_s = Slider(5, range=0..10000)
tcp_2 = ConstructPlane(Origin=reference_point, XAxis=Vector(1, 0, 0), YAxis=Vector(0, 1, 0))
compas_fab_inverse_kinematics = Python3Script(
    R=compas_fab_attached_tool,
    P=tcp_2,
    CT=robot_configuration_type,
    S=speed_0_to_80_mm_s_max,
    A=acceleration_mm_s,
    B=zone_blend_radius_mm)  # -> C
#   port P: The plane or frame to calculate the inverse kinematic for.
#   port CT: If passed, calculates the inverse such that the joint positions differ the least from the start_configuration. Defaults to the zero configuration.
#   port C: The planning group's configuration.
# ---------- compas_fab_inverse_kinematics: Python ----------
# venv: ca-fs26-focus-work

"""
Calculate the robot's inverse kinematic for a given plane.

COMPAS FAB v1.0.1
"""
import math
import Grasshopper
from compas_rhino.conversions import plane_to_compas_frame

class InverseKinematics(Grasshopper.Kernel.GH_ScriptInstance):
    def RunScript(self, R, P, M, CT, S, A, B):
        robot = R
        plane = P
        motion_type = M or "Linear"
        config_type = CT
        speed = S
        accel = A
        blend = B
        configuration = None
        
        if motion_type not in ("Joint", "Linear"):
            raise ValueError("Invalid motion type selected")

        if robot and robot.client and robot.client.is_connected and plane:
            frame = plane_to_compas_frame(plane)

            configs = robot.iter_inverse_kinematics(frame, start_configuration=None, options={'keep_order': True})
            configuration = list(configs)[config_type]
            configuration.motion_type = motion_type
            configuration.speed = float(speed) / 1000.
            configuration.accel = float(accel) / 1000.
            configuration.blend = float(blend) / 1000.

            if configuration["shoulder_pan_joint"] > math.pi:
                configuration["shoulder_pan_joint"] -= math.pi * 2

            # Fix ARM Flip!
            configuration["shoulder_pan_joint"] += math.pi
            configuration["shoulder_lift_joint"] -= math.pi * 2
#                
#            elif configuration["shoulder_pan_joint"] < math.pi:
#                configuration["shoulder_pan_joint"] += math.pi * 2

        return configuration
# ---------- end compas_fab_inverse_kinematics ----------
wait = Python3Script(T=wating_time_s)  # -> C
# ---------- wait: Python ----------
# venv: ca-fs26-focus-work

class WaitCommand(object):
    def __init__(self, wait_time):
        self.wait_time = wait_time
    def ToString(self):
        return "Wait({} seconds)".format(self.wait_time)
    def command(self):
        return "wait"
    def to_command_data(self):
        return {"command": self.command(), "wait_time": self.wait_time}

C = WaitCommand(T)
# ---------- end wait ----------

# ----
tool_path_frames_2 = Geometry(tool_path_frames)
pflip = FlipPlane(Plane=tool_path_frames_2, ReverseX=False, ReverseY=False, SwapAxes=True)
py3_2 = Python3Script(x=pflip)  # -> a; inputs x: list of Plane
# ---------- py3_2: Python ----------
import Rhino.Geometry as rg

def interpolate_planes(planes, step_dist):
    if not planes or len(planes) < 2:
        return planes

    result = []
    
    for i in range(len(planes) - 1):
        p1 = planes[i]
        p2 = planes[i+1]
        
        result.append(p1)
        
        # Abstand zwischen den Ursprungspunkten
        dist = p1.Origin.DistanceTo(p2.Origin)
        
        if dist > step_dist:
            # Anzahl der Schritte basierend auf dem exakten Abstand
            num_steps = int(dist // step_dist)
            
            for j in range(1, num_steps + 1):
                # Parameter t (0.0 bis 1.0) basierend auf der Distanz
                t = (j * step_dist) / dist
                
                # Falls t fast 1.0 ist, überspringen wir es (da p2 am Ende zugefügt wird)
                if t > 0.99: continue
                
                # Ursprung interpolieren
                new_origin = p1.Origin + (p2.Origin - p1.Origin) * t
                
                # Achsen interpolieren
                new_xaxis = p1.XAxis + (p2.XAxis - p1.XAxis) * t
                new_yaxis = p1.YAxis + (p2.YAxis - p1.YAxis) * t
                
                # Neue Ebene erstellen (Rhino sorgt für Orthonormalität)
                new_plane = rg.Plane(new_origin, new_xaxis, new_yaxis)
                result.append(new_plane)
                
    result.append(planes[-1])
    return result

# Inputs: planes (List of Plane), step_distance (Number)

step_distance = 0.05
a = interpolate_planes(x, step_distance)
# ---------- end py3_2 ----------
compas_fab_inverse_kinematics_2 = Python3Script(
    R=compas_fab_attached_tool,
    P=py3_2,
    CT=robot_configuration_type,
    S=speed_0_to_80_mm_s_max,
    A=acceleration_mm_s,
    B=zone_blend_radius_mm)  # -> C; same code as compas_fab_inverse_kinematics

deplane = DeconstructPlane(Plane=tcp)  # -> Origin, XAxis, YAxis, ZAxis
pl = ConstructPlane(Origin=deplane.Origin, XAxis=deplane.ZAxis, YAxis=Vector(0, 1, 0))
entwine = Entwine(
    Branch00=[compas_fab_inverse_kinematics, wait],
    Branch01=compas_fab_inverse_kinematics_2,
    Branch02=[compas_fab_inverse_kinematics, wait],
    FlattenInputs=True)  # -> flatten(Result)

draw_16 = COMPASDraw(cg=py_compas_29.visual_stocks)  # -> rg; same code as draw
draw_17 = COMPASDraw(cg=py_compas_29.visual_beams)  # -> rg; same code as draw
preview_7 = CustomPreview(Geometry=draw_16, Material=ColourSwatch(SwatchColor=RGB(142, 199, 125)))
preview_8 = CustomPreview(Geometry=draw_17, Material=ColourSwatch(SwatchColor=RGB(214, 188, 139)))

deconstruct_plane = DeconstructPlane(Plane=tool_path_frames)  # -> Origin, XAxis, YAxis, ZAxis
shift_list = ShiftList(List=deconstruct_plane.Origin, Shift=1, Wrap=False)
line_2 = Line(StartPoint=deconstruct_plane.Origin, EndPoint=shift_list)

panel_4 = Panel(toolpath.out)

swatch = ColourSwatch(SwatchColor=RGB(79, 67, 67))
pt_5 = Point(Point(8.945159179, 13.94173332, 0))
pt_6 = Point(Point(8.968776228, 11.60903239, 0))
tag = TextTag3D(Location=pt_5, Text=panel_3, Size="0.2", Colour=swatch, Justification=7)
tag_2 = TextTag3D(Location=pt_6, Text=panel_2, Size="0.2", Colour=swatch, Justification=7)

# ---- group: SIMULATION
filter = Python3Script(P=entwine)  # -> C, D; inputs P: list
# ---------- filter: Python ----------
# r: compas
# venv: ca-fs26

from compas_robots import Configuration

program = P

configs = []
for i in program:
    if isinstance(i, Configuration):
        configs.append(i)
        
C = configs

D = "0 To {}".format(len(C) - 1)
# ---------- end filter ----------
percent = Slider(0, range=0..100)
remap_numbers = RemapNumbers(Value=percent, Source="0 To 100", Target=filter.D)  # -> Mapped, Clipped
list_item = ListItem(List=filter.C, Index=remap_numbers.Mapped, Wrap=True)
compas_fab_robot_visualize = Python3Script(robot=compas_fab_attached_tool, configuration=list_item)  # -> visual, collision, collision_meshes, attached_meshes, frames, base_frame, ee_frame; inputs group: String, show_visual: Boolean, show_collision: Boolean, show_frames: Boolean, show_base_frame: Boolean, show_end_effector_frame: Boolean, show_cm: Boolean, show_acm: Boolean
#   port group: The planning group used for end-effector and base visualization.
#   port configuration: The robot's full configuration.
#   port show_visual: Whether or not to show the robot's visual meshes.
#   port show_collision: Whether or not to show the robot's collision meshes.
#   port show_frames: Whether or not to show the robot's joint frames.
#   port show_base_frame: Whether or not to show the robot's base frame.
#   port show_end_effector_frame: Whether or not to show the robot's end-effector frame.
#   port show_cm: Whether or not to show the collision meshes (if any).
#   port show_acm: Whether or not to show the attached collision meshes (if any).
#   port visual: Rhino meshes of the robot's visual geometry (if any).
#   port collision: Rhino meshes of the robot's collision geometry (if any).
#   port collision_meshes: Rhino meshes of the scene's collision meshes (if any).
#   port attached_meshes: Rhino meshes of the scene's attached collision meshes (if any).
#   port frames: The robot's joint frames as Rhino planes (if any).
#   port base_frame: The robot's base frame as a Rhino plane (if any).
#   port ee_frame: The robot's end-effector frame as a Rhino plane (if any).
# ---------- compas_fab_robot_visualize: Python ----------
# venv: ca-fs26-focus-work

"""
Visualizes the robot.

COMPAS FAB v1.0.1
"""

import time
import Grasshopper
from compas.geometry import Frame
from compas.geometry import Transformation
from compas.scene import SceneObject
from compas_ghpython import create_id
from compas_rhino.conversions import frame_to_rhino_plane
from scriptcontext import sticky as st

from compas_fab.backends import BackendFeatureNotSupportedError
from compas_fab.robots import PlanningScene


class RobotVisualize(Grasshopper.Kernel.GH_ScriptInstance):
    def RunScript(self,
            robot,
            group: str,
            configuration,
            show_visual: bool,
            show_collision: bool,
            show_frames: bool,
            show_base_frame: bool,
            show_end_effector_frame: bool,
            show_cm: bool,
            show_acm: bool):
        visual = None
        collision = None
        collision_meshes = None
        attached_meshes = None
        frames = None
        base_frame = None
        ee_frame = None

        if robot:
            show_visual = True if show_visual is None else show_visual
            show_cm = True if show_cm is None else show_cm
            show_acm = True if show_acm is None else show_acm
            configuration = configuration or robot.zero_configuration()

            robot.update(configuration, visual=show_visual, collision=show_collision)
            compas_frames = robot.transformed_frames(configuration, group)

            if show_visual:
                visual = robot.scene_object.draw_visual()

            if show_collision:
                collision = robot.scene_object.draw_collision()

            if show_base_frame:
                base_compas_frame = compas_frames[0]
                base_frame = frame_to_rhino_plane(base_compas_frame)

            if show_end_effector_frame:
                options = dict(solver="model")
                if robot.attached_tool:
                    options["link"] = robot.attached_tool.connected_to

                ee_compas_frame = robot.forward_kinematics(configuration, group, options=options)
                ee_frame = frame_to_rhino_plane(ee_compas_frame)

            if show_frames:
                frames = []
                for compas_frame in compas_frames[1:]:
                    frame = frame_to_rhino_plane(compas_frame)
                    frames.append(frame)

            cached_scene_key = create_id(ghenv.Component, "cached_scene")

            if show_cm or show_acm:
                cached_scene = st.get(cached_scene_key)
                if not cached_scene:
                    cached_scene = {"time": 0}

                # expire cache if the component has not been executed in the last 2 seconds
                # this allows to slide through a list of configurations
                # without triggering refreshes of the scene in the middle of it
                if time.time() - cached_scene["time"] > 2:
                    update_scene = True
                else:
                    update_scene = False

                if update_scene:
                    scene = PlanningScene(robot)
                    try:
                        scene = robot.client.get_planning_scene()
                    except BackendFeatureNotSupportedError:
                        print("The selected backend does not support displaying collision meshes. Feature disabled")
                        scene = None
                        show_cm = False
                        show_acm = False

                if update_scene and show_cm:
                    collision_meshes = []

                    for co in scene.world.collision_objects:
                        header = co.header
                        frame_id = header.frame_id
                        cms = co.to_collision_meshes()

                        for cm in cms:
                            if cm.frame != Frame.worldXY():
                                t = Transformation.from_frame(cm.frame)
                                mesh = cm.mesh.transformed(t)
                            else:
                                mesh = cm.mesh

                            collision_meshes.extend(SceneObject(mesh).draw())

                        cached_scene["cm"] = collision_meshes

                collision_meshes = cached_scene.get("cm", [])

                if update_scene and show_acm:
                    attached_meshes = []

                    for aco in scene.robot_state.attached_collision_objects:
                        for acm in aco.to_attached_collision_meshes():
                            frame_id = aco.object["header"]["frame_id"]
                            frame = robot.forward_kinematics(configuration, options=dict(link=frame_id))
                            t = Transformation.from_frame(frame)

                            # Local CM frame
                            if acm.collision_mesh.frame and acm.collision_mesh.frame != Frame.worldXY():
                                t = t * Transformation.from_frame(acm.collision_mesh.frame)

                            mesh = acm.collision_mesh.mesh.transformed(t)

                            attached_meshes.extend(SceneObject(mesh).draw())

                    cached_scene["acm"] = attached_meshes

                attached_meshes = cached_scene.get("acm", [])

                cached_scene["time"] = time.time()
                st[cached_scene_key] = cached_scene

        return (
            visual,
            collision,
            collision_meshes,
            attached_meshes,
            frames,
            base_frame,
            ee_frame,
        )
# ---------- end compas_fab_robot_visualize ----------

# ----
deg = Python3Script(C=list_item)  # -> out
# ---------- deg: Python ----------
# venv: ca-fs26-final-project

import math

if C:
    for name in C.joint_names:
        print("{:<20}: {:.2f}".format(name, math.degrees(C[name])))
# ---------- end deg ----------
panel_5 = Panel(deg)
