# Grasshopper definition a03_preferred_face_tbutt_joint.ghx (Grasshopper 1.0.8)
# Copyright: Lorin Wiedemeier

crv = Curve(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)
crv_2 = Curve(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)
install = CompasPyTemplate(a=crv)  # -> a
# ---------- install: Python ----------
# r: compas==2.15.1,timber_design==0.2.0,compas_fab==1.1.4
# venv: ca-fs26-focus-work

ghenv.Component.Message = "Install"
# ---------- end install ----------
forced_joint = Python3Script(main_curve=install, cross_curve=crv_2, mill_depth=Slider(0.008, range=0..0.1))  # -> out, main_beam_out, cross_beam_out; inputs main_curve: Curve, cross_curve: Curve
# ---------- forced_joint: Python ----------
# r: compas==2.15.1,timber_design==0.2.0,compas_fab==1.1.4
# venv: ca-fs26-focus-work

from compas_rhino.devtools import DevTools

DevTools.ensure_path()
ghenv.Component.Message = "Test Preferred TButt"

import Rhino.Geometry as rg

from compas.geometry import Line
from compas.geometry import Point
from compas.geometry import Vector
from compas.scene import SceneObject
from compas_timber.elements import Beam
from compas_timber.model import TimberModel
from timber_design.workflow import DirectRule
from timber_design.workflow import JointRuleSolver

from a03_preferred_face_tbutt_joint import PreferredFaceTButtJoint


beam_width = vars().get("beam_width") or 0.060
beam_height = vars().get("beam_height") or 0.080
joint_max_distance = vars().get("joint_max_distance") or 0.020
mill_depth = vars().get("mill_depth") or 0.001
process_joinery = True if vars().get("process_joinery") is None else vars().get("process_joinery")
preferred_face_vector = vars().get("preferred_face_vector") or Vector(0, 0, 1)
cross_beam_ref_side_index = vars().get("cross_beam_ref_side_index")


def rhino_curve_to_line(curve):
    if isinstance(curve, rg.Line):
        line = curve
    elif isinstance(curve, rg.LineCurve):
        line = curve.Line
    elif isinstance(curve, rg.PolylineCurve):
        polyline = curve.ToPolyline()
        if polyline.Count < 2:
            raise ValueError("PolylineCurve must have at least two points.")
        line = rg.Line(polyline[0], polyline[polyline.Count - 1])
    else:
        success, line = rg.Curve.TryGetLine(curve)
        if not success:
            line = rg.Line(curve.PointAtStart, curve.PointAtEnd)

    return Line(
        Point(line.From.X, line.From.Y, line.From.Z),
        Point(line.To.X, line.To.Y, line.To.Z),
    )


def vector_to_compas(vector):
    if isinstance(vector, Vector):
        return vector
    return Vector(vector.X, vector.Y, vector.Z)


def make_beam(curve):
    return Beam.from_centerline(
        rhino_curve_to_line(curve),
        width=beam_width,
        height=beam_height,
        z_vector=Vector(0, 0, 1),
    )


def to_rhino(geometry, errors):
    try:
        return SceneObject(item=geometry).draw()
    except Exception as error:
        errors.append("Rhino conversion: {!r}".format(error))
        return None


errors = []
timber_model = TimberModel()

main_beam = make_beam(main_curve)
cross_beam = make_beam(cross_curve)

timber_model.add_element(main_beam)
timber_model.add_element(cross_beam)

rule = DirectRule(
    PreferredFaceTButtJoint,
    [main_beam, cross_beam],
    max_distance=joint_max_distance,
    mill_depth=mill_depth,
    preferred_face_vector=vector_to_compas(preferred_face_vector),
    cross_beam_ref_side_index=cross_beam_ref_side_index,
)

solver = JointRuleSolver([rule])
joining_errors, unjoined_clusters = solver.apply_rules_to_model(timber_model)

if process_joinery:
    timber_model.process_joinery()

joints = list(getattr(timber_model, "joints", None) or getattr(timber_model, "interactions", None) or [])
joint_count = len(joints)
joint_errors = [getattr(error, "debug_info", repr(error)) for error in joining_errors]

beams = [main_beam, cross_beam]
beams_out = []
beams_rhino = []
for beam in beams:
    try:
        geometry = beam.geometry
        beams_out.append(geometry)
        beams_rhino.append(to_rhino(geometry, errors))
    except Exception as error:
        errors.append("{} geometry: {!r}".format(type(beam).__name__, error))
        beams_out.append(None)
        beams_rhino.append(None)

cross_ref_side_index = None
cross_ref_side = None
if joints:
    cross_ref_side_index = joints[0].cross_beam_ref_side_index
    cross_ref_side = cross_beam.ref_sides[cross_ref_side_index]

main_beam_out = main_beam.geometry
cross_beam_out = cross_beam.geometry
# ---------- end forced_joint ----------
# Focus Work - Preffered Face TButt Joint
draw = COMPASDraw(cg=forced_joint.main_beam_out)  # -> rg
#   port cg: The COMPAS geometry or datastructure to be drawn.
#   port rg: The Rhino geometry object.
# ---------- draw: Python ----------
# r: compas>=2.14.1
"""
Draws COMPAS geometry in Grasshopper.
"""

from typing import Any

import Grasshopper

from compas.scene import SceneObject


class CompasToRhinoGeometry(Grasshopper.Kernel.GH_ScriptInstance):
    def RunScript(self, cg):
        if not cg:
            return None

        return SceneObject(item=cg).draw()
# ---------- end draw ----------
draw_2 = COMPASDraw(cg=forced_joint.cross_beam_out)  # -> rg; same code as draw

reloader = CompasDevReloader()
# ---------- reloader: Python ----------
"""
------------------------------
Using VS Code as Python editor
------------------------------

The simplest way to start using VS Code as our editor, is
to place our Python code in files located IN THE SAME FOLDER as our Grasshopper file.

After we have done that, we need 2 steps: 

1. Enable the COMPAS reloader on one component. This tells Grasshopper to watch for changes in the Pythoh files and reload if changed.
2. Every other component that uses Python code from external files needs to start with a method to ensure Grasshopper knows where to load the files from.

"""
# venv: ca-fs26-focus-work

from compas_rhino.devtools import DevTools
DevTools.enable_reloader()
# ---------- end reloader ----------
