# Grasshopper definition a03_stencil.ghx (Grasshopper 1.0.8)
# Copyright: Lorin Wiedemeier

crv = Curve([<curve referenced from the Rhino model> x9])
crv_2 = Curve(<curve referenced from the Rhino model>)
merge = Merge(Data1=crv, Data2=crv_2)
explode = Explode(Curve=merge, Recursive=True)  # -> flatten(Segments), Vertices
crv_3 = Curve([<curve referenced from the Rhino model> x2])
pt = Point([<point referenced from the Rhino model> x13])
py3 = Python3Script(rectangles=crv_3, points=pt, lines=explode.Segments)  # -> out, timber_model, plates, beams_out; inputs rectangles: list of Rectangle3d, points: list of Point3d, lines: list of Line
# ---------- py3: Python ----------
# r: compas==2.15.1,timber_design==0.2.0,compas_fab==1.1.4
# venv: ca-fs26-focus-work-2

ghenv.Component.Message = "Install"


"""
Stencil script: plates from rectangles, holes from points, beams from lines.

Grasshopper inputs:
    rectangles
    points
    lines
    plate_thickness
    hole_radius
    beam_width
    beam_height

Outputs:
    plates
    beams
    timber_model
"""

import Rhino.Geometry as rg
from compas.geometry import Line
from compas.geometry import Point
from compas.geometry import Vector
from compas_timber.elements import Beam
from compas_timber.model import TimberModel


plate_thickness = plate_thickness or 0.010
hole_radius = hole_radius or 0.015
beam_width = beam_width or 0.060
beam_height = beam_height or 0.080


def rhino_line_to_compas(line):
    return Line(
        Point(line.From.X, line.From.Y, line.From.Z),
        Point(line.To.X, line.To.Y, line.To.Z),
    )


def make_beams(lines):
    beams = []
    z_vector = Vector(0, 0, 1)

    for line in lines:
        centerline = rhino_line_to_compas(line)
        beam = Beam.from_centerline(
            centerline,
            width=beam_width,
            height=beam_height,
            z_vector=z_vector,
        )
        beams.append(beam)

    return beams


def points_in_rectangle(rectangle, points):
    return [
        point
        for point in points
        if rectangle.Contains(point) != rg.PointContainment.Outside
    ]


def make_hole_cutter(rectangle, point):
    plane = rg.Plane(rectangle.Plane)
    plane.Origin = point

    circle = rg.Circle(plane, hole_radius).ToNurbsCurve()
    cutter = rg.Extrusion.Create(circle, plate_thickness * 3.0, True).ToBrep()

    normal = rectangle.Plane.Normal
    normal.Unitize()
    cutter.Transform(rg.Transform.Translation(-normal * plate_thickness))

    return cutter


def make_plate(rectangle, points):
    outline = rectangle.ToNurbsCurve()
    plate = rg.Extrusion.Create(outline, plate_thickness, True).ToBrep()

    cutters = [make_hole_cutter(rectangle, point) for point in points_in_rectangle(rectangle, points)]
    if cutters:
        result = rg.Brep.CreateBooleanDifference([plate], cutters, 0.001)
        if result:
            plate = result[0]

    return plate


def make_plates(rectangles, points):
    return [make_plate(rectangle, points) for rectangle in rectangles]


plates = make_plates(rectangles, points)
beams = make_beams(lines)

beams_out = []

timber_model = TimberModel()
for beam in beams:
    timber_model.add_element(beam)
    beams_out.append(beam.geometry)
# ---------- end py3 ----------
# Focus Work - Stencil
draw = COMPASDraw(cg=py3.beams_out)  # -> rg
#   port cg: The COMPAS geometry or datastructure to be drawn.
#   port rg: The Rhino geometry object.
# ---------- draw: Python ----------
# r: compas>=2.14.1
"""
Draws COMPAS geometry in Grasshopper.
"""

from typing import Any

import Grasshopper

from compas.scene import SceneObject


class CompasToRhinoGeometry(Grasshopper.Kernel.GH_ScriptInstance):
    def RunScript(self, cg):
        if not cg:
            return None

        return SceneObject(item=cg).draw()
# ---------- end draw ----------

len = Length(Curve=explode.Segments)
ma = MassAddition(Input=len)  # -> Result, PartialResults
panel = Panel(ma.Result)

reloader = CompasDevReloader()
# ---------- reloader: Python ----------
"""
------------------------------
Using VS Code as Python editor
------------------------------

The simplest way to start using VS Code as our editor, is
to place our Python code in files located IN THE SAME FOLDER as our Grasshopper file.

After we have done that, we need 2 steps: 

1. Enable the COMPAS reloader on one component. This tells Grasshopper to watch for changes in the Pythoh files and reload if changed.
2. Every other component that uses Python code from external files needs to start with a method to ensure Grasshopper knows where to load the files from.

"""
# venv: ca-fs26-focus-work

from compas_rhino.devtools import DevTools
DevTools.enable_reloader()
# ---------- end reloader ----------
