# Grasshopper definition export_hops.ghx (Grasshopper 1.0.8)
# plug-ins: Human, Increment

number_slider = Slider(62, range=0..100)
number_slider_2 = Slider(162, range=0..1000)

py3 = Python3Script(unload=Button())  # inputs unload: Boolean
# ---------- py3: Python ----------
from compas_rhino import unload_modules

import easyhops
if unload:
    unload_modules("easyhops")
# ---------- end py3 ----------

allow_flip = BooleanToggle(True)
hops = Button()
list = ValueList({"A", "B", "C", "D", "E", "F", "G"}, selected="A")
list_2 = ValueList({"RefSide0": 0, "RefSide1": 1, "RefSide2": 2, "RefSide3": 3}, selected="RefSide2")
increment = Increment(BeginningNumber=0, StepSize=1, currentValue=21, increment=1, oldStart=0)  # -> Output, Item
path = FilePath("C:\Users\kapso\GitHub\coding_architecture_fs26_focus_work\fabrication\btlx_1506_laprefside.btlx")
panel = Panel(path)
py3_2 = Python3Script(filepath=path, index=increment.Output, group=list, ref_side=list_2, allow_flip=allow_flip, export=hops)  # -> out, model, geometry, processing_report, element; inputs filepath: String, index: Int32, group: String, ref_side: Int32, export: Boolean
# ---------- py3_2: Python ----------
import os, sys, importlib

from compas.scene import Scene
from compas.geometry import angle_vectors

gh_dir = os.path.dirname(ghenv.Component.OnPingDocument().FilePath)
if gh_dir not in sys.path:
    sys.path.insert(0, gh_dir)

import hops_exporter as he
importlib.reload(he)

repo_root = os.path.dirname(os.path.dirname(gh_dir))
hops_dir = gh_dir + "\\HOPS\\"

scene = Scene()

model = he.load_btlx(filepath)

element = he.resolve_element(element(model, index, group, ref_side))
he.override_features(element, allow_flip)
geometry = he.visualize_geometry(element, ghenv=ghenv)
processing_report = he.get_processing_report(element)
 
if export:
    HOPSJob = he.export_hop(element, hops_dir)
# ---------- end py3_2 ----------
panel_2 = Panel(py3_2.out)
panel_3 = Panel(py3_2.processing_report)
py3_3 = Python3Script(unload=Button())  # -> out
# ---------- py3_3: Python ----------
from compas_rhino import unload_modules
import compas_timber

if unload:
    unload_modules("compas_timber")
    print("Succesfully unloaded CT!")
# ---------- end py3_3 ----------
panel_4 = Panel(py3_3)
py3_4 = Python3Script(beam=py3_2.element)  # -> out, a
# ---------- py3_4: Python ----------
from compas_timber.fabrication import Lap
from compas.scene import Scene

scene = Scene()

for f in beam.features:
    if isinstance(f, Lap):
        if (
            f.width == 10.0 and f.start_y == 110.0
        ):  # heuristic for identifying the "dummy" lap features that mark the opposite side for drilling
            volume = f.volume_from_params_and_beam(beam)
            print(f.params.as_dict())
            print("-----------------------")
            scene.add(volume)
            new_feature = Lap.from_volume_and_beam(
                volume, beam, ref_side_index=(f.ref_side_index + 1) % 4
            )
        elif f.width == 10.0 and f.start_y == 0.0:
            volume = f.volume_from_params_and_beam(beam)
            scene.add(volume)
            new_feature = Lap.from_volume_and_beam(
                volume, beam, ref_side_index=1
            )
        else:
            continue  # skip non-dummy laps
        # beam.remove_features(f)
        # beam.add_feature(new_feature)
scene.add(beam.geometry)
a = scene.draw()
# ---------- end py3_4 ----------
panel_5 = Panel(py3_4.out)
cluster = Cluster(data=py3_2.geometry)  # -> A, B
py3_5 = Python3Script(model=py3_2.model, viz=Toggle(False))  # -> a, b
# ---------- py3_5: Python ----------
from compas.scene import Scene
from compas_rhino.conversions import line_to_compas
scene = Scene()
debug_scene = Scene()

if viz:
    try:
        for element in model.elements():
            scene.add(element.geometry)
            if element.debug_info:
                for fae in element.debug_info:
                    if isinstance(fae.feature_geometry, list):
                        debug_scene.add(fae.feature_geometry[0])
                    else:
                        debug_scene.add(fae.feature_geometry)
    except Exception as e:
        print(e)
    a = scene.draw()
    b = debug_scene.draw()
# ---------- end py3_5 ----------
brep = Brep(py3_4.a)
edges = BrepEdges(Brep=py3_5.a)  # -> Naked, Interior, NonManifold
null = NullItem(Item=brep)  # -> NullFlags, InvalidFlags, Description
dispatch = Dispatch(List=py3_4.a, DispatchPattern=null.NullFlags)  # -> ListA, ListB
preview = CustomPreview(Geometry=py3_5.a, Material=ColourSwatch(SwatchColor=RGBA(158, 150, 108, 184)))
preview_2 = CustomPreview(Geometry=cluster.B, Material=ColourSwatch(SwatchColor=RGBA(158, 150, 108, 184)))
previewlw = CustomPreviewLineweights(Geometry=edges.Interior, Shader=ColourSwatch(SwatchColor=RGBA(0, 0, 0, 184)), Absolute=False)
previewlw_2 = CustomPreviewLineweights(Geometry=cluster.A, Shader=ColourSwatch(SwatchColor=RGBA(255, 0, 0, 184)), Absolute=False)
preview_3 = CustomPreview(Geometry=dispatch.ListB, Material=ColourSwatch(SwatchColor=RGBA(158, 150, 108, 184)))
preview_4 = CustomPreview(Geometry=dispatch.ListA, Material=ColourSwatch(SwatchColor=RGBA(255, 0, 0, 184)))

# ==== cluster Cluster
data = ClusterInput()
data_2 = Data(data)
brep = Brep(data_2)
null = NullItem(Item=brep)  # -> NullFlags, InvalidFlags, Description
dispatch = Dispatch(List=data_2, DispatchPattern=null.NullFlags)  # -> ListA, ListB
A = ClusterOutput(dispatch.ListA)
B = ClusterOutput(dispatch.ListB)
