# Grasshopper definition drilling_analysis.ghx (Grasshopper 1.0.8)
# Copyright: Lorin Wiedemeier
# plug-ins: Bifocals

install = CompasPyTemplate()  # -> done
# ---------- install: Python ----------
# r: compas==2.15.1,timber_design==0.2.0,compas_fab==1.1.4
# venv: ca-fs26-focus-work

ghenv.Component.Message = "Install"
done = "ok"
# ---------- end install ----------
number_slider = Slider(24, range=0..183)  # disabled
number_slider_2 = Slider(25, range=0..183)  # disabled
number_slider_3 = Slider(59, range=0..183)  # disabled
number_slider_4 = Slider(61, range=0..183)  # disabled
number_slider_5 = Slider(68, range=0..183)  # disabled
number_slider_6 = Slider(69, range=0..183)  # disabled
# Brep Meshing
# Modifiers
number_slider_7 = Slider(70, range=0..183)  # disabled
number_slider_8 = Slider(28, range=0..183)  # disabled
load = Python3Script(ok=install)  # -> geo, btlx_filename, timber_model
# ---------- load: Python ----------
# venv: ca-fs26-focus-work
from compas_rhino import DevTools
DevTools.ensure_path()

import os
import scriptcontext

from compas.data import json_load
from compas_timber.model import TimberModel

# Pre-load custom joints
from a03_preferred_face_tbutt_joint import PreferredFaceTButtJoint
from a03_preferred_face_tbutt_joint import TopFaceTButtJoint

filepath = scriptcontext.doc.Component.OnPingDocument().FilePath
dirname = os.path.dirname(filepath)
btlx_filename = os.path.join(dirname, "metal_plate_lap_bug_model.btlx")

print("Loading timber model...")
timber_model :TimberModel = json_load(os.path.join(dirname, "..", "..", "..", "timber_models/json_1506_new.json"))

from compas_rhino.conversions import brep_to_rhino
geo = []
for i, beam in enumerate(timber_model.beams):
    if i not in (24, 25, 28, 59, 61, 68, 69, 70):
        for joint in timber_model.get_joints_for_element(beam):
            timber_model.remove_joint(joint)
        timber_model.remove_element(beam)

timber_model.process_joinery()
beams = timber_model.beams
# for beam in [beams[17], beams[115], beams[125]]: #] + timber_model.beams[125:126]:
for beam in beams:
    geo.append(brep_to_rhino(beam.geometry))
# ---------- end load ----------
lamcp_bridge = LAMCPBridge(enable=Toggle(True))  # -> status; inputs enable: Boolean, port: Int32
#   port enable: Toggle to start (True) or stop (False) the local HTTP server.
#   port port: Port to listen on (loopback only). Defaults to 8765.
#   port status: Current server status string.
# ---------- lamcp_bridge: Python ----------
"""
LAMCP Bridge: local HTTP server inside Rhino 8 / Grasshopper CPython.

Exposes `POST /exec` (JSON: `{"code": "...", "timeout": 30}`) which
exec()s `code` and returns
`{"stdout": "...", "stderr": "...", "result": "...", "error": null|str}`.

Pair with the `lamcp` FastMCP server, which translates Claude's
`run_python_script` MCP tool calls into POSTs to this endpoint.

Binds to 127.0.0.1 only. NEVER expose beyond localhost â€” it exec()s
arbitrary Python with full Rhino API access.

LAMCP v0.1.0
"""

import contextlib
import io
import json
import threading
import traceback
from http.server import BaseHTTPRequestHandler
from http.server import HTTPServer

import Grasshopper
import scriptcontext as sc


SHARED_GLOBALS_KEY = "_lamcp_bridge_globals"
SERVER_KEY = "_lamcp_bridge_server"


def _exec_code(code, timeout):
    """Run `code` on the HTTP-server thread and capture stdout/stderr/result.

    NOTE: this is intentionally NOT marshalled to Rhino's UI thread for the
    spike â€” `Rhino.RhinoApp.InvokeOnUiThread` was queueing actions that
    never fired in Rhino 8 CPython. Most read-only RhinoCommon access is
    safe cross-thread; mutations may crash. Add Eto-based marshalling
    back here when we need it.
    """
    out = io.StringIO()
    err = io.StringIO()
    g = sc.sticky.setdefault(SHARED_GLOBALS_KEY, {"__name__": "__lamcp_bridge__"})
    error_text = None
    result_repr = None
    try:
        with contextlib.redirect_stdout(out), contextlib.redirect_stderr(err):
            exec(code, g, g)
            result_repr = repr(g.get("_"))
    except BaseException:
        error_text = traceback.format_exc()

    return {
        "stdout": out.getvalue(),
        "stderr": err.getvalue(),
        "result": result_repr,
        "error": error_text,
    }


class _ExecHandler(BaseHTTPRequestHandler):
    # Silence default request logging so it doesn't clog the Rhino command line.
    def log_message(self, fmt, *args):
        pass

    def _send(self, code, payload):
        body = json.dumps(payload).encode("utf-8")
        self.send_response(code)
        self.send_header("Content-Type", "application/json")
        self.send_header("Content-Length", str(len(body)))
        self.end_headers()
        self.wfile.write(body)

    def do_GET(self):
        if self.path == "/health":
            self._send(200, {"status": "ok"})
        else:
            self._send(404, {"error": "not found"})

    def do_POST(self):
        if self.path != "/exec":
            self._send(404, {"error": "not found"})
            return
        length = int(self.headers.get("Content-Length", "0"))
        try:
            raw = self.rfile.read(length).decode("utf-8")
            body = json.loads(raw)
            code = body.get("code", "")
            timeout = float(body.get("timeout", 30.0))
        except Exception as exc:
            self._send(400, {"error": "bad request: " + repr(exc)})
            return
        result = _exec_code(code, timeout)
        self._send(200, result)


def _start_server(port):
    server = HTTPServer(("127.0.0.1", port), _ExecHandler)
    thread = threading.Thread(
        target=server.serve_forever, daemon=True, name="lamcp-bridge"
    )
    thread.start()
    return {"server": server, "thread": thread, "port": port}


def _stop_server(state):
    try:
        state["server"].shutdown()
        state["server"].server_close()
    except Exception:
        pass


class LamcpBridgeComponent(Grasshopper.Kernel.GH_ScriptInstance):
    def RunScript(self, enable: bool, port: int):
        port = int(port) if port else 8765

        state = sc.sticky.get(SERVER_KEY)

        if not enable:
            if state is not None:
                _stop_server(state)
                del sc.sticky[SERVER_KEY]
            return "stopped"

        # Already running on the requested port: no-op.
        if (
            state is not None
            and state.get("port") == port
            and state["thread"].is_alive()
        ):
            return "listening on http://127.0.0.1:{}".format(port)

        # Port changed or server died: tear down and restart.
        if state is not None:
            _stop_server(state)
            del sc.sticky[SERVER_KEY]

        try:
            sc.sticky[SERVER_KEY] = _start_server(port)
        except OSError as exc:
            ghenv.Component.AddRuntimeMessage(  # noqa: F821
                Grasshopper.Kernel.GH_RuntimeMessageLevel.Error,
                "Failed to bind 127.0.0.1:{}: {}".format(port, exc),
            )
            return "error: {}".format(exc)

        return "listening on http://127.0.0.1:{}".format(port)
# ---------- end lamcp_bridge ----------
list_item = ListItem(
    List=load.geo,
    Index=[number_slider_2, number_slider_4, number_slider_6, number_slider_7, number_slider_5, number_slider_3, number_slider_8, number_slider],
    Wrap=True)  # disabled
# Mesh Relaxation
panel = Panel([number_slider, number_slider_2, number_slider_8, number_slider_3, number_slider_5, number_slider_4, number_slider_7, number_slider_6])  # disabled

# ----
# Drillings
# Gramazio Kohler Research
# Gonzalo Casas, Lorin Wiedemeier, Eric Gozzi
# Project by Timo Feddern, Alessia Martino, Zan Kocunik
py3 = Python3Script(
    timber_model=load.timber_model,
    process_drillings=Toggle(True),
    screw_diameter=Slider(0.006, range=0.005..0.01),
    screw_length=Slider(0.1, range=0.1..0.19))  # -> summary, drilled_model, beams, screws, failed_labels, extrema_labels, screw_colors; inputs process_drillings: Boolean, screw_diameter: Double, screw_length: Double
# ---------- py3: Python ----------
# venv: ca-fs26-focus-work

from compas_rhino.devtools import DevTools
DevTools.ensure_path()
DevTools.unload_modules("rf_drilling")

ghenv.Component.Message = "Drilling & Procurement"

# -------------------- IMPORTS ---------------------
import Rhino.Geometry as rg
import System  # Added for ARGB color mapping
import traceback

# ------------------- EXECUTION --------------------

# Default outputs
drilled_model = timber_model.copy()
beams = []
screws = [] 
screw_colors = []      # Now populated by the color loop
oversized_labels = []  # Added to store dynamic text dots for oversized items
geometry_errors = []
failed_screws = []
failed_labels = []
extrema_screws = []
extrema_labels = []

# Default summary state
summary = "Waiting to run..." 

if process_drillings and timber_model:
    try:
        # Import inside the execution block to ensure we grab the freshest save
        from rf_drilling import DrillingProcessor
        
        dia = screw_diameter if screw_diameter else 0.008
        length = screw_length if screw_length else 0.150

        d_type = drill_type if 'drill_type' in globals() else "both"
 
        # Initialize the processor 
        processor = DrillingProcessor(timber_model, screw_diameter=dia, screw_length=length, drill_type= d_type)
        
        drilled_model = processor.process_drillings()
        
        # 1. GRAB THE SUMMARY TEXT
        summary = processor.summary_text 
        
        # 2. GENERATE 3D SOLID CYLINDERS & APPLY COLOR CODING
        radius = dia / 2.0
        # Iterate through lines and assigned lengths concurrently
        for compas_line, assigned_len in zip(processor.screw_lines, processor.screw_assigned_lengths):
            # Convert COMPAS geometry to Rhino geometry
            start_pt = rg.Point3d(compas_line.start.x, compas_line.start.y, compas_line.start.z)
            end_pt = rg.Point3d(compas_line.end.x, compas_line.end.y, compas_line.end.z)
            direction = end_pt - start_pt
            
            # Prevent zero-length errors
            if direction.Length > 0.001:
                # Create a plane facing the direction of the screw
                base_plane = rg.Plane(start_pt, direction)
                base_circle = rg.Circle(base_plane, radius)
                
                # Extrude the circle into a cylinder matching the screw length
                rhino_cylinder = rg.Cylinder(base_circle, direction.Length)
                
                # ToBrep(True, True) caps the ends to make it a solid pipe
                screws.append(rhino_cylinder.ToBrep(True, True)) 
                
                # --- COLOR CODING LOGIC ---
                if assigned_len == 100:
                    screw_colors.append(System.Drawing.Color.FromArgb(255, 100, 200, 100)) # Green
                elif assigned_len == 130:
                    screw_colors.append(System.Drawing.Color.FromArgb(255, 100, 150, 255)) # Blue
                elif assigned_len == 150:
                    screw_colors.append(System.Drawing.Color.FromArgb(255, 255, 150, 100)) # Orange
                elif assigned_len > 150:
                    # Anything more than 150mm is forced to Orange per request
                    screw_colors.append(System.Drawing.Color.FromArgb(255, 255, 150, 100)) # Orange
                    
                    # Generate dynamic tracking label for the oversized screw
                    mid_pt = start_pt + (direction / 2.0)
                    actual_length_mm = direction.Length * 1000.0
                    label_text = "OVERSIZED\n{:.1f}mm".format(actual_length_mm)
                    oversized_labels.append(rg.TextDot(label_text, mid_pt))
                else:
                    # Fallback color for anything unexpected or smaller
                    screw_colors.append(System.Drawing.Color.FromArgb(255, 200, 50, 50))   # Red
                
            
        # 3. VISUALIZE LONGEST AND SHORTEST SCREWS PER JOINT TYPE
        for j_type, extrema_info in processor.extrema_screws_by_type.items():
            # Longest screw
            longest_line = extrema_info["longest"]["line"]
            longest_length = extrema_info["longest"]["length"]
            
            start_pt = rg.Point3d(longest_line.start.x, longest_line.start.y, longest_line.start.z)
            end_pt = rg.Point3d(longest_line.end.x, longest_line.end.y, longest_line.end.z)
            extrema_screws.append(rg.Line(start_pt, end_pt))
            
            mid_pt = (start_pt + end_pt) / 2.0
            label_text = "{}\nLONGEST: {:.1f}mm".format(j_type.split(" - ")[-1], longest_length * 1000.0)
            extrema_labels.append(rg.TextDot(label_text, mid_pt))
            
            # Shortest screw
            shortest_line = extrema_info["shortest"]["line"]
            shortest_length = extrema_info["shortest"]["length"]
            
            start_pt = rg.Point3d(shortest_line.start.x, shortest_line.start.y, shortest_line.start.z)
            end_pt = rg.Point3d(shortest_line.end.x, shortest_line.end.y, shortest_line.end.z)
            extrema_screws.append(rg.Line(start_pt, end_pt))
            
            mid_pt = (start_pt + end_pt) / 2.0
            label_text = "{}\nSHORTEST: {:.1f}mm".format(j_type.split(" - ")[-1], shortest_length * 1000.0)
            extrema_labels.append(rg.TextDot(label_text, mid_pt))
            
        # 4. OUTPUT FAILED SCREW TRAJECTORIES AND LABELS
        for info in processor.failed_screw_info:
            compas_line = info["line"]
            j_type = info["type"]
            
            start_pt = rg.Point3d(compas_line.start.x, compas_line.start.y, compas_line.start.z)
            end_pt = rg.Point3d(compas_line.end.x, compas_line.end.y, compas_line.end.z)
            failed_screws.append(rg.Line(start_pt, end_pt))
            
            mid_pt = (start_pt + end_pt) / 2.0
            failed_labels.append(rg.TextDot(j_type, mid_pt))
            
        ghenv.Component.Message = f"Generated {processor.drilling_count} drillings"

    except Exception as e:
        summary = "ERROR DURING EXECUTION:\n" + traceback.format_exc()
        ghenv.Component.Message = "Script Crashed"

elif not process_drillings:
    summary = "Drilling skipped"
    ghenv.Component.Message = "Drilling skipped"

# --- OUTPUT TIMBER GEOMETRY ---
if drilled_model:
    for beam in drilled_model.beams:
        try:
            beams.append(beam.geometry)
        except Exception as e:
            geometry_errors.append(e)

    if len(geometry_errors) > 0:
        print(f"Failed to load {len(geometry_errors)} beam geometries.")
# ---------- end py3 ----------
geo = Geometry(py3.extrema_labels)
geo_2 = Geometry(py3.failed_labels)
data = Data(py3.screws)
compas_draw = COMPASDraw(cg=py3.beams)  # -> rg
#   port cg: The COMPAS geometry or datastructure to be drawn.
#   port rg: The Rhino geometry object.
# ---------- compas_draw: Python ----------
# r: compas>=2.14.1
"""
Draws COMPAS geometry in Grasshopper.
"""

from typing import Any

import Grasshopper

from compas.scene import SceneObject


class CompasToRhinoGeometry(Grasshopper.Kernel.GH_ScriptInstance):
    def RunScript(self, cg):
        if not cg:
            return None

        return SceneObject(item=cg).draw()
# ---------- end compas_draw ----------
preview = CustomPreview(Geometry=py3.screws, Material=py3.screw_colors)

# ----
# RF System
# RF System - Eccentricity w/ Attractor Point
# RF System - Eccentricity w/ Attractor Curve
colour_swatch = ColourSwatch(SwatchColor=RGB(255, 0, 0))
clearance_probes = ClearanceProbes(model=py3.drilled_model)  # -> clearance
#   port clearance: Output clearance
# ---------- clearance_probes: Python ----------
import Grasshopper
import Rhino.Geometry as rg


class Script_Instance(Grasshopper.Kernel.GH_ScriptInstance):
    def RunScript(self, model):
        # Draw the drill/driver clearance probes: a line per screw, starting at the
        # screw head and extending outwards (same length as the screw). Whatever a
        # probe passes through is a beam that blocks the driver.
        clearance = []
        if model is not None:
            coords = getattr(model, "rf_clearance_lines", None) or []
            for s, e in coords:
                clearance.append(
                    rg.Line(rg.Point3d(s[0], s[1], s[2]), rg.Point3d(e[0], e[1], e[2]))
                )
        return clearance
# ---------- end clearance_probes ----------
custom_preview = CustomPreview(Geometry=clearance_probes, Material=colour_swatch)

# ---- group: BTLx roundtrip
writebtlx = CTWriteBTLx(model=py3.drilled_model, path=load.btlx_filename, write=Toggle(True))  # -> done; inputs write: Boolean
#   port model: Model object.
#   port path: Filepath for new BTLx.
#   port write: Write to file.
#   port done: Pretty BTLx string
# ---------- writebtlx: Python ----------
# venv: ca-fs26-focus-work

"""Writes a BTLx file for machining of model parts."""

# flake8: noqa
import Rhino

from compas_timber.fabrication import BTLxWriter


if not model:
    XML = None
    errors = ["Missing model."]
else:
    btlx = BTLxWriter(file_name=str(Rhino.RhinoDoc.ActiveDoc.Name))

    if write:
        if not path:
            XML = None
            errors = ["Missing path."]
        else:
            XML = btlx.write(model, str(path))
            errors = list(getattr(btlx, "errors", []) or [])
    else:
        XML = btlx.model_to_xml(model)
        errors = list(getattr(btlx, "errors", []) or [])

    print("BTLx writer errors: {}".format(len(errors)))
    for index, error in enumerate(errors):
        print("[{}] {}".format(index, error))
        print("    error type: {}".format(type(error).__name__))

        part = getattr(error, "part", None)
        feature = getattr(error, "feature", None)

        if part:
            print("    part: {}".format(part))
            print("    part id: {}".format(getattr(part, "id", None)))
            print("    part name: {}".format(getattr(part, "name", None)))

        if feature:
            print("    feature type: {}".format(type(feature).__name__))
            print("    feature dict: {}".format(getattr(feature, "__dict__", {})))

    for beam in model.beams:
        if getattr(beam, "name", None) in ("A18", "A14"):
            print("{} features:".format(beam.name))
            for i, feature in enumerate(getattr(beam, "features", []) or []):
                print("  [{}] {} {}".format(i, type(feature).__name__, getattr(feature, "__dict__", {})))
        
done = "ok"
# ---------- end writebtlx ----------
read_btlx = CTWriteBTLx(start=writebtlx, path=load.btlx_filename)  # -> model, errors, element_count
#   port path: Filepath for new BTLx.
#   port model: Pretty BTLx string
# ---------- read_btlx: Python ----------
# venv: ca-fs26-focus-work

"""Reads a BTLx file into a COMPAS Timber model."""

# flake8: noqa
import os

import Grasshopper

from compas_timber.btlx import BTLxReader
from timber_design.ghpython.ghcomponent_helpers import item_input_valid_cpython


class ReadBTLx(Grasshopper.Kernel.GH_ScriptInstance):
    def RunScript(self, start, path):
        if not item_input_valid_cpython(ghenv, path, "Path"):
            return None, [], 0

        path = str(path)
        if not os.path.exists(path):
            raise FileNotFoundError("BTLx file not found: {}".format(path))

        reader = BTLxReader()
        model = reader.read(path)
        errors = list(getattr(reader, "errors", []) or [])

        try:
            element_count = len(list(model.elements()))
        except Exception:
            element_count = 0

        return model, errors, element_count
# ---------- end read_btlx ----------
viz = Python3Script(model=read_btlx.model)  # -> a
# ---------- viz: Python ----------
# r: compas==2.15.1,timber_design==0.2.0
# venv: ca-fs26-final-project

from compas_rhino.devtools import DevTools
DevTools.ensure_path()

import a03_preferred_face_tbutt_joint
# import a03_cutoff_l_lap_joint

# Only keep this if the loaded model needs joinery regeneration.
# For BTLx-read models, features are usually already present.
model.process_joinery()

issues = []

for beam_index, beam in enumerate(model.beams):
    try:
        _ = beam.geometry
    except Exception as error:
        issues.append("beam {} geometry failed: {!r}".format(beam_index, error))
        for feature_index, feature in enumerate(getattr(beam, "features", []) or []):
            issues.append(
                "  feature {}: {}".format(feature_index, type(feature).__name__)
            )

for issue in issues:
    print(issue)

from compas.scene import Scene

scene = Scene()
for beam in model.beams:
    try:
        scene.add(beam.geometry)
    except Exception:
        pass

a = scene.draw()
# ---------- end viz ----------
# Live Edit Centerlines
# Adjust Centerlines - Bouncy
# Extend Centerlines
scale = Scale(Geometry=viz, Center=Point(0, 0, 0), Factor=Slider(0.001, range=0..0.001))  # -> Geometry, Transform
# Timber Model
panel_2 = Panel(read_btlx.errors)

# ----
reloader = CompasDevReloader()
# ---------- reloader: Python ----------
"""
------------------------------
Using VS Code as Python editor
------------------------------

The simplest way to start using VS Code as our editor, is
to place our Python code in files located IN THE SAME FOLDER as our Grasshopper file.

After we have done that, we need 2 steps: 

1. Enable the COMPAS reloader on one component. This tells Grasshopper to watch for changes in the Pythoh files and reload if changed.
2. Every other component that uses Python code from external files needs to start with a method to ensure Grasshopper knows where to load the files from.

"""
# venv: ca-fs26-focus-work

from compas_rhino.devtools import DevTools
DevTools.enable_reloader()
# ---------- end reloader ----------
