# Grasshopper definition einfache_timber_model.ghx (Grasshopper 1.0.8)

number_slider = Slider(0.08, range=0..0.2)
curve = Curve(<curve referenced from the Rhino model>)
curve_2 = Curve(<curve referenced from the Rhino model>)
python_3_script = Python3Script(line_a=curve, line_b=curve_2, width=number_slider, height=Slider(0.1, range=0..0.2))  # -> out, timber_model, beams_geo; inputs line_a: Curve, line_b: Curve, width: Double, height: Double
# ---------- python_3_script: Python ----------
import Rhino.Geometry as rg
from compas_rhino.conversions import line_to_compas, brep_to_rhino, box_to_rhino
from compas_timber.elements import Beam
from compas.geometry import Vector
from compas_timber.model import TimberModel
from compas_timber.connections import LMiterJoint

import importlib
import a03_timber_model_geometric
import a03_extra_split_beams


from a03_timber_model_geometric import GeometricTimberModelCreator
from a03_extra_split_beams import mark_support_points_on_beams
from a03_rf_system_hybrid import RFSystemHybrid


if False:
    line_a = line_b = width = height = None
    timber_model = beams_geo = None

width  = vars().get("width")  or 0.08
height = vars().get("height") or 0.14
TOL    = 0.001

timber_model = None
beams_geo    = []

def rh_to_compas_line(obj):
    if isinstance(obj, rg.Line):
        return line_to_compas(obj)
    if isinstance(obj, (rg.LineCurve, rg.Curve)):
        return line_to_compas(rg.Line(obj.PointAtStart, obj.PointAtEnd))
    raise TypeError("Expected Line or Curve")

def away_dir(beam, joint_pt):
    cl = beam.centerline
    ds = cl.start.distance_to_point(joint_pt)
    de = cl.end.distance_to_point(joint_pt)
    v = Vector.from_start_end(cl.start, cl.end) if ds < de else Vector.from_start_end(cl.end, cl.start)
    v.unitize()
    return v

def miter_cut(beam, joint_pt, dir_self, dir_other):
    blank = rg.Brep.CreateFromBox(box_to_rhino(beam.blank))
    if not blank:
        return None

    # Bisector plane at the joint point
    bx = dir_self.x + dir_other.x
    by = dir_self.y + dir_other.y
    bz = dir_self.z + dir_other.z
    bis = rg.Vector3d(bx, by, bz)
    bis.Unitize()

    jpt  = rg.Point3d(joint_pt.x, joint_pt.y, joint_pt.z)
    L    = beam.centerline.length * 3
    srf  = rg.PlaneSurface(rg.Plane(jpt, bis), rg.Interval(-L, L), rg.Interval(-L, L))
    pieces = blank.Split([srf.ToBrep()], TOL)

    if not pieces:
        print("  Split failed, returning blank")
        return blank

    # Pick the piece whose centroid is on the beam's side (away from joint)
    dir_rh = rg.Vector3d(dir_self.x, dir_self.y, dir_self.z)
    best = None
    for piece in pieces:
        mp = rg.AreaMassProperties.Compute(piece)
        if mp and (mp.Centroid - jpt) * dir_rh > 0:
            best = piece
            break
    if best is None:
        best = pieces[0]

    capped = best.CapPlanarHoles(TOL)
    return capped if (capped and capped.IsSolid) else best

if line_a is not None and line_b is not None:
    model  = TimberModel()
    beam_a = Beam.from_centerline(rh_to_compas_line(line_a), width=width, height=height)
    beam_b = Beam.from_centerline(rh_to_compas_line(line_b), width=width, height=height)
    beam_a.attributes["category"] = "arch"
    beam_b.attributes["category"] = "arch"
    model.add_element(beam_a)
    model.add_element(beam_b)

    try:
        LMiterJoint.create(model, beam_a, beam_b)
        print("LMiterJoint created")
    except Exception as e:
        print("LMiterJoint failed: {}".format(e))

    timber_model = model

    # Locate the shared endpoint
    joint_pt = None
    for joint in model.joints:
        if isinstance(joint, LMiterJoint) and joint.location:
            joint_pt = joint.location
            break
    if joint_pt is None:
        best_d = float("inf")
        for pa in [beam_a.centerline.start, beam_a.centerline.end]:
            for pb in [beam_b.centerline.start, beam_b.centerline.end]:
                d = pa.distance_to_point(pb)
                if d < best_d:
                    best_d, joint_pt = d, pa

    if joint_pt:
        da = away_dir(beam_a, joint_pt)
        db = away_dir(beam_b, joint_pt)
        for beam, ds, do in [(beam_a, da, db), (beam_b, db, da)]:
            brep = miter_cut(beam, joint_pt, ds, do)
            if brep:
                beams_geo.append(brep)

    print("Beams: {}, Geometry: {}, Solid: {}".format(
        len(list(timber_model.beams)),
        len(beams_geo),
        all(b.IsSolid for b in beams_geo)))
# ---------- end python_3_script ----------
geometry = Geometry(python_3_script.beams_geo)

# ----
# Metal Plates & Laps （Foundation LLapJoint, Arch LMiterJoint）
boolean_toggle = BooleanToggle(False)
python_3_script_2 = Python3Script(timber_model=python_3_script.timber_model, arch_beam_width=number_slider, use_llap_joint=boolean_toggle)  # -> out, base_plates, metal_plates, all_plates, base_lap_count, metal_lap_count, base_lap_volumes, metal_lap_volumes, timber_model_out, beams; inputs points: list of Point3d, arch_beam_width: Double, base_beam_height: Double, use_llap_joint: Boolean
# ---------- python_3_script_2: Python ----------
from compas_rhino.devtools import DevTools
DevTools.ensure_path()
ghenv.Component.Message = "Metal Plates + Base Laps"

import importlib
import Rhino.Geometry as rg
from compas_rhino.conversions import box_to_rhino, brep_to_compas, brep_to_rhino
import base_lap
import metal_plate_lap
importlib.reload(base_lap)
importlib.reload(metal_plate_lap)
from base_lap import create_base_beam_plates_from_points, apply_laps_single_beam
from metal_plate_lap import create_metal_plates, apply_laps
#   use_llap_joint    : bool, True = LLap (no base plates), False = LMiter (with base plates)

if False:
    timber_model = points = base_lap_size = beam_width = use_llap_joint = None
    arch_beam_height = arch_plate_size = base_beam_height = base_plate_size = None
    timber_model_out = base_lap_count = metal_lap_count = base_plates = metal_plates = all_plates = None
    base_lap_volumes = metal_lap_volumes = beams = None

base_lap_size    = tuple(vars().get("base_lap_size")   or (0.100, 0.140, 0.010))
beam_width       = vars().get("beam_width")             or None
arch_beam_width  = vars().get("arch_beam_height")       or 0.08
arch_beam_height  = vars().get("arch_beam_height")       or 0.10
arch_plate_size  = tuple(vars().get("arch_plate_size")  or (0.065, 0.146, 0.0025))
base_beam_height = vars().get("base_beam_height")       or 0.14
base_plate_size  = tuple(vars().get("base_plate_size")  or (0.065, 0.146, 0.0025))
use_llap_joint = bool(vars().get("use_llap_joint") or False)


base_plates       = []
metal_plates      = []
base_lap_volumes  = []
metal_lap_volumes = []
base_lap_count    = 0
metal_lap_count   = 0
timber_model_out  = None
beams = []

if timber_model is not None:
    from compas.data import json_dumps
    #test = json_dumps(timber_model)

    #timber_model = timber_model.copy()

    # --- Step 1: Base beam laps ---
    # Filter base beams from the full model by their category attribute.
    if points:
        base_beams = [b for b in timber_model.beams
                      if b.attributes.get("category") == "base"]
        print(f"Found {len(base_beams)} base beams")

        base_plate_data = create_base_beam_plates_from_points(
            base_beams,
            points,
            plate_size=base_lap_size,
            beam_width=beam_width,
        )

        base_compas_breps = []
        base_beam_list    = []

        for box, beam, contact_normal in base_plate_data:
            try:
                rhino_brep = rg.Brep.CreateFromBox(box_to_rhino(box))
                if not rhino_brep:
                    print("Warning: base plate CreateFromBox returned None")
                    continue
                base_plates.append(rhino_brep)
                base_compas_breps.append(brep_to_compas(rhino_brep))
                base_beam_list.append(beam)
            except Exception as e:
                print(f"Warning: could not convert base plate: {e}")

        base_lap_pairs = apply_laps_single_beam(base_compas_breps, base_beam_list)
        base_lap_count = len(base_lap_pairs)
        for lap, beam in base_lap_pairs:
            try:
                base_lap_volumes.append(brep_to_rhino(lap.volume.transformed(beam.modeltransformation)))
            except Exception as e:
                print(f"Warning: could not visualize base lap: {e}")

    # --- Step 2: Metal plate laps at LMiterJoints ---
    metal_plate_data = create_metal_plates(
        timber_model,
        use_llap_joint=use_llap_joint,
        arch_beam_height=arch_beam_height,
        arch_plate=arch_plate_size,
        base_beam_height=base_beam_height,
        base_plate=base_plate_size,
    )
    lap_brep_beam = []


    for box, beam_a, beam_b, contact_normal, lap_box_a, lap_box_b in metal_plate_data:
        try:
            # Visual plate for viewport display.
            rhino_brep = rg.Brep.CreateFromBox(box_to_rhino(box))
            if not rhino_brep:
                print("Warning: metal plate CreateFromBox returned None")
                continue
            metal_plates.append(rhino_brep)

            # Per-beam lap breps — each positioned at that beam's own side face.
            for lap_box, beam in [(lap_box_a, beam_a), (lap_box_b, beam_b)]:
                lap_rhino = rg.Brep.CreateFromBox(box_to_rhino(lap_box))
                if lap_rhino:
                    lap_brep_beam.append((brep_to_compas(lap_rhino), beam))
        except Exception as e:
            print(f"Warning: could not convert metal plate: {e}")

    metal_lap_pairs = apply_laps(lap_brep_beam)
    metal_lap_count = len(metal_lap_pairs)
    for lap, beam in metal_lap_pairs:
        try:
            metal_lap_volumes.append(brep_to_rhino(lap.volume.transformed(beam.modeltransformation)))
        except Exception as e:
            print(f"Warning: could not visualize metal lap: {e}")

    # Both steps modify beams in-place — expose the updated model once at the end.
    timber_model_out = timber_model

all_plates =metal_plates

# Collect processed beam geometry (beams with all pockets subtracted).
beams = []
if timber_model_out:
    for beam in timber_model_out.beams:
        try:
            beams.append(brep_to_rhino(beam.geometry))
        except Exception as e:
            print(f"Warning: beam geometry failed: {e}")

print(f"Base plates: {len(base_plates)} ({base_lap_count} laps), Metal plates: {len(metal_plates)} ({metal_lap_count} laps)")
# ---------- end python_3_script_2 ----------
panel = Panel(python_3_script_2.timber_model_out)
custom_preview = CustomPreview(Geometry=python_3_script_2.base_plates, Material=ColourSwatch(SwatchColor=RGBA(99, 48, 0, 144)))
custom_preview_2 = CustomPreview(Geometry=python_3_script_2.metal_plates, Material=ColourSwatch(SwatchColor=RGBA(99, 48, 0, 144)))
custom_preview_3 = CustomPreview(Geometry=python_3_script_2.base_lap_volumes, Material=ColourSwatch(SwatchColor=RGBA(17, 255, 0, 144)))
custom_preview_4 = CustomPreview(Geometry=python_3_script_2.metal_lap_volumes, Material=ColourSwatch(SwatchColor=RGBA(17, 255, 0, 144)))
geometry_2 = Geometry(python_3_script_2.beams)

# ----
# Save to BTLx
file_path = FilePath("/Users/leona/Desktop/test")
ct_writebtlx = CTWriteBTLx(model=python_3_script_2.timber_model_out, path=file_path, write=Button())  # -> BTLx; inputs write: Boolean
#   port model: Model object.
#   port path: Filepath for new BTLx.
#   port write: Write to file.
#   port BTLx: Pretty BTLx string
# ---------- ct_writebtlx: Python ----------
# venv: ca-fs26-focus-work

"""Writes a BTLx file for machining of model parts."""

# flake8: noqa
import Rhino

from compas_timber.fabrication import BTLxWriter


if not model:
    XML = None
    errors = ["Missing model."]
else:
    btlx = BTLxWriter(file_name=str(Rhino.RhinoDoc.ActiveDoc.Name))

    if write:
        if not path:
            XML = None
            errors = ["Missing path."]
        else:
            XML = btlx.write(model, str(path))
            errors = list(getattr(btlx, "errors", []) or [])
    else:
        XML = btlx.model_to_xml(model)
        errors = list(getattr(btlx, "errors", []) or [])

    print("BTLx writer errors: {}".format(len(errors)))
    for index, error in enumerate(errors):
        print("[{}] {}".format(index, error))
        print("    error type: {}".format(type(error).__name__))

        part = getattr(error, "part", None)
        feature = getattr(error, "feature", None)

        if part:
            print("    part: {}".format(part))
            print("    part id: {}".format(getattr(part, "id", None)))
            print("    part name: {}".format(getattr(part, "name", None)))

        if feature:
            print("    feature type: {}".format(type(feature).__name__))
            print("    feature dict: {}".format(getattr(feature, "__dict__", {})))

    for beam in model.beams:
        if getattr(beam, "name", None) in ("A18", "A14"):
            print("{} features:".format(beam.name))
            for i, feature in enumerate(getattr(beam, "features", []) or []):
                print("  [{}] {} {}".format(i, type(feature).__name__, getattr(feature, "__dict__", {})))
# ---------- end ct_writebtlx ----------

# ----
# Load BTLx
dam = DataDam(BufferDelay=10000000, BufferMode=0)
file_path_2 = FilePath("/Users/leona/Desktop/test.btlx")
ct_writebtlx_2 = CTWriteBTLx(path=file_path_2, read=Button())  # -> model, errors, element_count; inputs read: Boolean
#   port path: Filepath for new BTLx.
#   port read: Write to file.
#   port model: Pretty BTLx string
# ---------- ct_writebtlx_2: Python ----------
# venv: ca-fs26-focus-work

"""Reads a BTLx file into a COMPAS Timber model."""

# flake8: noqa
import os

import Grasshopper

from compas_timber.btlx import BTLxReader
from timber_design.ghpython.ghcomponent_helpers import item_input_valid_cpython


class ReadBTLx(Grasshopper.Kernel.GH_ScriptInstance):
    def RunScript(self, path, read: bool):
        if not read:
            return None, [], 0

        if not item_input_valid_cpython(ghenv, path, "Path"):
            return None, [], 0

        path = str(path)
        if not os.path.exists(path):
            raise FileNotFoundError("BTLx file not found: {}".format(path))

        reader = BTLxReader()
        model = reader.read(path)
        errors = list(getattr(reader, "errors", []) or [])

        try:
            element_count = len(list(model.elements()))
        except Exception:
            element_count = 0

        return model, errors, element_count
# ---------- end ct_writebtlx_2 ----------

viz = Python3Script(model=ct_writebtlx_2.model)  # -> a
# ---------- viz: Python ----------
# r: compas==2.15.1,timber_design==0.2.0
# venv: ca-fs26-final-project

from compas_rhino.devtools import DevTools
DevTools.ensure_path()

import a03_preferred_face_tbutt_joint
import a03_cutoff_l_lap_joint

# Only keep this if the loaded model needs joinery regeneration.
# For BTLx-read models, features are usually already present.
# model.process_joinery()

issues = []

for beam_index, beam in enumerate(model.beams):
    try:
        _ = beam.geometry
    except Exception as error:
        issues.append("beam {} geometry failed: {!r}".format(beam_index, error))
        for feature_index, feature in enumerate(getattr(beam, "features", []) or []):
            issues.append(
                "  feature {}: {}".format(feature_index, type(feature).__name__)
            )

for issue in issues:
    print(issue)

from compas.scene import Scene

scene = Scene()
for beam in model.beams:
    try:
        scene.add(beam.geometry)
    except Exception:
        pass

a = scene.draw()
# ---------- end viz ----------
