# Grasshopper definition metal_plates_lap_bug.ghx (Grasshopper 1.0.8)
# Copyright: Lorin Wiedemeier
# plug-ins: Bifocals

install = CompasPyTemplate()  # -> done
# ---------- install: Python ----------
# r: compas==2.15.1,timber_design==0.2.0,compas_fab==1.1.4
# venv: ca-fs26-focus-work

ghenv.Component.Message = "Install"
done = "ok"
# ---------- end install ----------
load = Python3Script(ok=install)  # -> geo, btlx_filename, timber_model
# ---------- load: Python ----------
# venv: ca-fs26-focus-work
from compas_rhino import DevTools
DevTools.ensure_path()

import os
import scriptcontext

from compas.data import json_load
from compas_timber.model import TimberModel

# Pre-load custom joints
from a03_preferred_face_tbutt_joint import PreferredFaceTButtJoint
from a03_preferred_face_tbutt_joint import TopFaceTButtJoint

filepath = scriptcontext.doc.Component.OnPingDocument().FilePath
dirname = os.path.dirname(filepath)
btlx_filename = os.path.join(dirname, "metal_plate_lap_bug_model.btlx")

print("Loading timber model...")
timber_model :TimberModel = json_load(os.path.join(dirname, "metal_plate_lap_bug_model.json"))

from compas_rhino.conversions import brep_to_rhino
geo = []
for i, beam in enumerate(timber_model.beams):
    if i not in (17, 115, 125):
        for joint in timber_model.get_joints_for_element(beam):
            timber_model.remove_joint(joint)
        timber_model.remove_element(beam)

timber_model.process_joinery()
beams = timber_model.beams
# for beam in [beams[17], beams[115], beams[125]]: #] + timber_model.beams[125:126]:
for beam in beams:
    geo.append(brep_to_rhino(beam.geometry))
# ---------- end load ----------
lamcp_bridge = LAMCPBridge(enable=Toggle(True))  # -> status; inputs enable: Boolean, port: Int32
#   port enable: Toggle to start (True) or stop (False) the local HTTP server.
#   port port: Port to listen on (loopback only). Defaults to 8765.
#   port status: Current server status string.
# ---------- lamcp_bridge: Python ----------
"""
LAMCP Bridge: local HTTP server inside Rhino 8 / Grasshopper CPython.

Exposes `POST /exec` (JSON: `{"code": "...", "timeout": 30}`) which
exec()s `code` and returns
`{"stdout": "...", "stderr": "...", "result": "...", "error": null|str}`.

Pair with the `lamcp` FastMCP server, which translates Claude's
`run_python_script` MCP tool calls into POSTs to this endpoint.

Binds to 127.0.0.1 only. NEVER expose beyond localhost â€” it exec()s
arbitrary Python with full Rhino API access.

LAMCP v0.1.0
"""

import contextlib
import io
import json
import threading
import traceback
from http.server import BaseHTTPRequestHandler
from http.server import HTTPServer

import Grasshopper
import scriptcontext as sc


SHARED_GLOBALS_KEY = "_lamcp_bridge_globals"
SERVER_KEY = "_lamcp_bridge_server"


def _exec_code(code, timeout):
    """Run `code` on the HTTP-server thread and capture stdout/stderr/result.

    NOTE: this is intentionally NOT marshalled to Rhino's UI thread for the
    spike â€” `Rhino.RhinoApp.InvokeOnUiThread` was queueing actions that
    never fired in Rhino 8 CPython. Most read-only RhinoCommon access is
    safe cross-thread; mutations may crash. Add Eto-based marshalling
    back here when we need it.
    """
    out = io.StringIO()
    err = io.StringIO()
    g = sc.sticky.setdefault(SHARED_GLOBALS_KEY, {"__name__": "__lamcp_bridge__"})
    error_text = None
    result_repr = None
    try:
        with contextlib.redirect_stdout(out), contextlib.redirect_stderr(err):
            exec(code, g, g)
            result_repr = repr(g.get("_"))
    except BaseException:
        error_text = traceback.format_exc()

    return {
        "stdout": out.getvalue(),
        "stderr": err.getvalue(),
        "result": result_repr,
        "error": error_text,
    }


class _ExecHandler(BaseHTTPRequestHandler):
    # Silence default request logging so it doesn't clog the Rhino command line.
    def log_message(self, fmt, *args):
        pass

    def _send(self, code, payload):
        body = json.dumps(payload).encode("utf-8")
        self.send_response(code)
        self.send_header("Content-Type", "application/json")
        self.send_header("Content-Length", str(len(body)))
        self.end_headers()
        self.wfile.write(body)

    def do_GET(self):
        if self.path == "/health":
            self._send(200, {"status": "ok"})
        else:
            self._send(404, {"error": "not found"})

    def do_POST(self):
        if self.path != "/exec":
            self._send(404, {"error": "not found"})
            return
        length = int(self.headers.get("Content-Length", "0"))
        try:
            raw = self.rfile.read(length).decode("utf-8")
            body = json.loads(raw)
            code = body.get("code", "")
            timeout = float(body.get("timeout", 30.0))
        except Exception as exc:
            self._send(400, {"error": "bad request: " + repr(exc)})
            return
        result = _exec_code(code, timeout)
        self._send(200, result)


def _start_server(port):
    server = HTTPServer(("127.0.0.1", port), _ExecHandler)
    thread = threading.Thread(
        target=server.serve_forever, daemon=True, name="lamcp-bridge"
    )
    thread.start()
    return {"server": server, "thread": thread, "port": port}


def _stop_server(state):
    try:
        state["server"].shutdown()
        state["server"].server_close()
    except Exception:
        pass


class LamcpBridgeComponent(Grasshopper.Kernel.GH_ScriptInstance):
    def RunScript(self, enable: bool, port: int):
        port = int(port) if port else 8765

        state = sc.sticky.get(SERVER_KEY)

        if not enable:
            if state is not None:
                _stop_server(state)
                del sc.sticky[SERVER_KEY]
            return "stopped"

        # Already running on the requested port: no-op.
        if (
            state is not None
            and state.get("port") == port
            and state["thread"].is_alive()
        ):
            return "listening on http://127.0.0.1:{}".format(port)

        # Port changed or server died: tear down and restart.
        if state is not None:
            _stop_server(state)
            del sc.sticky[SERVER_KEY]

        try:
            sc.sticky[SERVER_KEY] = _start_server(port)
        except OSError as exc:
            ghenv.Component.AddRuntimeMessage(  # noqa: F821
                Grasshopper.Kernel.GH_RuntimeMessageLevel.Error,
                "Failed to bind 127.0.0.1:{}: {}".format(port, exc),
            )
            return "error: {}".format(exc)

        return "listening on http://127.0.0.1:{}".format(port)
# ---------- end lamcp_bridge ----------

# ----
# Brep Meshing
# Modifiers
boolean_toggle = BooleanToggle(True)
metal_plates_and_laps = Python3Script(
    source_timber_model=load.timber_model,
    arch_plate_size_x=Slider(0.065, range=0..0.2),
    arch_plate_size_y=Slider(0.146, range=0..0.2),
    arch_plate_size_z=Slider(0.005, range=0..0.2),
    arch_plate_width_offset=Slider(0.0024, range=0..0.01),
    use_llap_joint=boolean_toggle)  # -> out, base_plates, metal_plates, all_plates, base_lap_count, metal_lap_count, base_lap_volumes, metal_lap_volumes, timber_model_out, beams; inputs arch_plate_size_x: Double, arch_plate_size_y: Double, arch_plate_size_z: Double, points: list of Point3d, arch_beam_width: Double, base_beam_height: Double, use_llap_joint: Boolean
# ---------- metal_plates_and_laps: Python ----------
# venv: ca-fs26-focus-work
from compas_rhino.devtools import DevTools
DevTools.ensure_path()
DevTools.unload_modules("metal_plate")
ghenv.Component.Message = "Metal Plates + Base Laps"

timber_model = source_timber_model.copy()

import importlib
import Rhino.Geometry as rg
from compas_rhino.conversions import box_to_rhino, brep_to_compas, brep_to_rhino
import base_lap
import metal_plate_lap
importlib.reload(base_lap)
importlib.reload(metal_plate_lap)
from base_lap import create_base_beam_plates_from_points, apply_laps_single_beam
from metal_plate_lap import create_metal_plates, apply_laps
#   use_llap_joint    : bool, True = LLap (no base plates), False = LMiter (with base plates)


# GH inputs — add these as component inputs in Grasshopper:
#   timber_model      : full TimberModel
#   points            : points on base beam centerlines for base lap locations
#   base_lap_size     : list [x, y, z] in metres, e.g. [0.100, 0.140, 0.015]
#   beam_width        : float, optional cross-section width override for base beams
#   arch_beam_height  : float, e.g. 0.10
#   arch_plate_size   : list [w, l, t], e.g. [0.040, 0.105, 0.005]
#   base_beam_height  : float, e.g. 0.14
#   base_plate_size   : list [w, l, t], e.g. [0.045, 0.185, 0.005]
#   use_llap_joint    : bool, True = LLap (no base plates), False = LMiter (with base plates)

if False:
    timber_model = points = base_lap_size = beam_width = use_llap_joint = None
    arch_beam_height = arch_plate_size = base_beam_height = base_plate_size = None
    timber_model_out = base_lap_count = metal_lap_count = base_plates = metal_plates = all_plates = None
    base_lap_volumes = metal_lap_volumes = beams = None

base_lap_size    = tuple(vars().get("base_lap_size")   or (0.100, 0.140, 0.01))
beam_width       = vars().get("beam_width")             or None
arch_beam_width  = vars().get("arch_beam_height")       or 0.08
arch_beam_height  = vars().get("arch_beam_height")       or 0.10
arch_plate_size  = (arch_plate_size_x, arch_plate_size_y, arch_plate_size_z)
arch_plate_width_offset  = vars().get("arch_plate_width_offset")
# arch_plate_size  = tuple(vars().get("arch_plate_size")  or (0.065, 0.146, 0.005))
base_beam_height = vars().get("base_beam_height")       or 0.14
base_plate_size  = tuple(vars().get("base_plate_size")  or (0.065, 0.146, 0.005))
use_llap_joint = bool(vars().get("use_llap_joint") or False)


base_plates       = []
metal_plates      = []
base_lap_volumes  = []
metal_lap_volumes = []
base_lap_count    = 0
metal_lap_count   = 0
timber_model_out  = None
beams = []

if timber_model is not None:
    from compas.data import json_dumps

    # --- Step 1: Base beam laps ---
    # Filter base beams from the full model by their category attribute.
    if points:
        base_beams = [b for b in timber_model.beams
                      if b.attributes.get("category") == "base"]
        print(f"Found {len(base_beams)} base beams")

        base_plate_data = create_base_beam_plates_from_points(
            base_beams,
            points,
            plate_size=base_lap_size,
            beam_width=beam_width,
        )

        base_compas_breps = []
        base_beam_list    = []

        for box, beam, contact_normal in base_plate_data:
            try:
                rhino_brep = rg.Brep.CreateFromBox(box_to_rhino(box))
                if not rhino_brep:
                    print("Warning: base plate CreateFromBox returned None")
                    continue
                base_plates.append(rhino_brep)
                base_compas_breps.append(brep_to_compas(rhino_brep))
                base_beam_list.append(beam)
            except Exception as e:
                print(f"Warning: could not convert base plate: {e}")

        base_lap_pairs = apply_laps_single_beam(base_compas_breps, base_beam_list)
        base_lap_count = len(base_lap_pairs)
        for lap, beam in base_lap_pairs:
            try:
                base_lap_volumes.append(brep_to_rhino(lap.volume.transformed(beam.modeltransformation)))
            except Exception as e:
                print(f"Warning: could not visualize base lap: {e}")

    # --- Step 2: Metal plate laps at LMiterJoints ---
    metal_plate_data = create_metal_plates(
        timber_model,
        use_llap_joint=use_llap_joint,
        arch_beam_height=arch_beam_height,
        arch_plate=arch_plate_size,
        base_beam_height=base_beam_height,
        base_plate=base_plate_size,
        arch_plate_width_offset=arch_plate_width_offset
    )
    lap_brep_beam = []


    for visual_box, beam_a, beam_b, contact_normal, lap_box_a, lap_box_b in metal_plate_data:
        try:
            # Visual plate for viewport display.
            rhino_brep = rg.Brep.CreateFromBox(box_to_rhino(visual_box))
            if not rhino_brep:
                print("Warning: metal plate CreateFromBox returned None")
                continue
            # metal_plates.append(rhino_brep)

            # Per-beam lap breps — each positioned at that beam's own side face.
            for lap_box, beam in [(lap_box_a, beam_a), (lap_box_b, beam_b)]:
                lap_rhino = rg.Brep.CreateFromBox(box_to_rhino(lap_box))
                if lap_rhino:
                    lap_brep_beam.append((brep_to_compas(lap_rhino), beam))
        except Exception as e:
            print(f"Warning: could not convert metal plate: {e}")

    metal_lap_pairs = apply_laps(lap_brep_beam)
    metal_lap_count = len(metal_lap_pairs)
    for lap, beam in metal_lap_pairs:
        try:
            metal_lap_volumes.append(brep_to_rhino(lap.volume.transformed(beam.modeltransformation)))
        except Exception as e:
            print(f"Warning: could not visualize metal lap: {e}")

    # Both steps modify beams in-place — expose the updated model once at the end.
    timber_model_out = timber_model

all_plates = base_plates + metal_plates

# Collect processed beam geometry (beams with all pockets subtracted).
beams = []
if timber_model_out:
    for beam in timber_model_out.beams:
        try:
            beams.append(brep_to_rhino(beam.geometry))
        except Exception as e:
            print(f"Warning: beam geometry failed: {e}")

print(f"Base plates: {len(base_plates)} ({base_lap_count} laps), Metal plates: {len(metal_plates)} ({metal_lap_count} laps)")
# ---------- end metal_plates_and_laps ----------
# Mesh Relaxation
panel = Panel(metal_plates_and_laps.timber_model_out)
custom_preview = CustomPreview(Geometry=metal_plates_and_laps.metal_lap_volumes, Material=ColourSwatch(SwatchColor=RGBA(17, 255, 0, 144)))
# Lap bug - repro
# Gramazio Kohler Research
# Gonzalo Casas, Lorin Wiedemeier, Eric Gozzi
# Project by Timo Feddern, Alessia Martino, Zan Kocunik
timber_model_with_plates = Data(metal_plates_and_laps.timber_model_out)
geometry = Geometry(metal_plates_and_laps.beams)

# ---- group: BTLx roundtrip
# RF System
# RF System - Eccentricity w/ Attractor Point
# RF System - Eccentricity w/ Attractor Curve
number_slider = Slider(0.001, range=0..0.001)
writebtlx = CTWriteBTLx(model=timber_model_with_plates, path=load.btlx_filename, write=Toggle(True))  # -> done; inputs write: Boolean
#   port model: Model object.
#   port path: Filepath for new BTLx.
#   port write: Write to file.
#   port done: Pretty BTLx string
# ---------- writebtlx: Python ----------
# venv: ca-fs26-focus-work

"""Writes a BTLx file for machining of model parts."""

# flake8: noqa
import Rhino

from compas_timber.fabrication import BTLxWriter


if not model:
    XML = None
    errors = ["Missing model."]
else:
    btlx = BTLxWriter(file_name=str(Rhino.RhinoDoc.ActiveDoc.Name))

    if write:
        if not path:
            XML = None
            errors = ["Missing path."]
        else:
            XML = btlx.write(model, str(path))
            errors = list(getattr(btlx, "errors", []) or [])
    else:
        XML = btlx.model_to_xml(model)
        errors = list(getattr(btlx, "errors", []) or [])

    print("BTLx writer errors: {}".format(len(errors)))
    for index, error in enumerate(errors):
        print("[{}] {}".format(index, error))
        print("    error type: {}".format(type(error).__name__))

        part = getattr(error, "part", None)
        feature = getattr(error, "feature", None)

        if part:
            print("    part: {}".format(part))
            print("    part id: {}".format(getattr(part, "id", None)))
            print("    part name: {}".format(getattr(part, "name", None)))

        if feature:
            print("    feature type: {}".format(type(feature).__name__))
            print("    feature dict: {}".format(getattr(feature, "__dict__", {})))

    for beam in model.beams:
        if getattr(beam, "name", None) in ("A18", "A14"):
            print("{} features:".format(beam.name))
            for i, feature in enumerate(getattr(beam, "features", []) or []):
                print("  [{}] {} {}".format(i, type(feature).__name__, getattr(feature, "__dict__", {})))
        
done = "ok"
# ---------- end writebtlx ----------
read_btlx = CTWriteBTLx(start=writebtlx, path=load.btlx_filename)  # -> model, errors, element_count
#   port path: Filepath for new BTLx.
#   port model: Pretty BTLx string
# ---------- read_btlx: Python ----------
# venv: ca-fs26-focus-work

"""Reads a BTLx file into a COMPAS Timber model."""

# flake8: noqa
import os

import Grasshopper

from compas_timber.btlx import BTLxReader
from timber_design.ghpython.ghcomponent_helpers import item_input_valid_cpython


class ReadBTLx(Grasshopper.Kernel.GH_ScriptInstance):
    def RunScript(self, start, path):
        if not item_input_valid_cpython(ghenv, path, "Path"):
            return None, [], 0

        path = str(path)
        if not os.path.exists(path):
            raise FileNotFoundError("BTLx file not found: {}".format(path))

        reader = BTLxReader()
        model = reader.read(path)
        errors = list(getattr(reader, "errors", []) or [])

        try:
            element_count = len(list(model.elements()))
        except Exception:
            element_count = 0

        return model, errors, element_count
# ---------- end read_btlx ----------
viz = Python3Script(model=read_btlx.model)  # -> a
# ---------- viz: Python ----------
# r: compas==2.15.1,timber_design==0.2.0
# venv: ca-fs26-final-project

from compas_rhino.devtools import DevTools
DevTools.ensure_path()

import a03_preferred_face_tbutt_joint
# import a03_cutoff_l_lap_joint

# Only keep this if the loaded model needs joinery regeneration.
# For BTLx-read models, features are usually already present.
model.process_joinery()

issues = []

for beam_index, beam in enumerate(model.beams):
    try:
        _ = beam.geometry
    except Exception as error:
        issues.append("beam {} geometry failed: {!r}".format(beam_index, error))
        for feature_index, feature in enumerate(getattr(beam, "features", []) or []):
            issues.append(
                "  feature {}: {}".format(feature_index, type(feature).__name__)
            )

for issue in issues:
    print(issue)

from compas.scene import Scene

scene = Scene()
for beam in model.beams:
    try:
        scene.add(beam.geometry)
    except Exception:
        pass

a = scene.draw()
# ---------- end viz ----------
# Live Edit Centerlines
# Adjust Centerlines - Bouncy
# Extend Centerlines
scale = Scale(Geometry=viz, Center=Point(0, 0, 0), Factor=number_slider)  # -> Geometry, Transform
# Timber Model
panel_2 = Panel(read_btlx.errors)

# ----
reloader = CompasDevReloader()
# ---------- reloader: Python ----------
"""
------------------------------
Using VS Code as Python editor
------------------------------

The simplest way to start using VS Code as our editor, is
to place our Python code in files located IN THE SAME FOLDER as our Grasshopper file.

After we have done that, we need 2 steps: 

1. Enable the COMPAS reloader on one component. This tells Grasshopper to watch for changes in the Pythoh files and reload if changed.
2. Every other component that uses Python code from external files needs to start with a method to ensure Grasshopper knows where to load the files from.

"""
# venv: ca-fs26-focus-work

from compas_rhino.devtools import DevTools
DevTools.enable_reloader()
# ---------- end reloader ----------
