# Grasshopper definition a03_split_foundation.ghx (Grasshopper 1.0.8)
# Copyright: Lorin Wiedemeier

pt = Point([Point(6.320433967, -0.9730781939, 0), Point(5.931578864, -0.06064285781, 0), Point(5.848574792, 0.4435185358, 0), Point(5.819837356, 0.9036836072, 0), Point(5.881704824, 1.408768984, 0), Point(5.993755914, 1.917782917, 0), Point(6.262487147, 2.607902664, 0), Point(6.069811975, -0.4441314226, 0), Point(-0.7752509022, 1.631618815, 0), Point(-0.7438110721, 1.376232185, 0), Point(-0.7351361851, -0.1735075838, 0), Point(-0.7795655316, -0.4877027433, 0), Point(-0.7001634871, 0.7895940129, 0), Point(-0.7037674401, 0.2050965172, 0)])

reloader = CompasDevReloader()
# ---------- reloader: Python ----------
"""
------------------------------
Using VS Code as Python editor
------------------------------

The simplest way to start using VS Code as our editor, is
to place our Python code in files located IN THE SAME FOLDER as our Grasshopper file.

After we have done that, we need 2 steps: 

1. Enable the COMPAS reloader on one component. This tells Grasshopper to watch for changes in the Pythoh files and reload if changed.
2. Every other component that uses Python code from external files needs to start with a method to ensure Grasshopper knows where to load the files from.

"""
# venv: ca-fs26-focus-work

from compas_rhino.devtools import DevTools
DevTools.enable_reloader()
# ---------- end reloader ----------

# ---- group: Load Timber Model
path = FilePath("/Users/lorinwiedemeier/Library/CloudStorage/GoogleDrive-lorinw@ethz.ch/Geteilte Ablagen/GKR_Teaching/Coding_Architecture/CAII/ADMIN/12_Focus-Work/01_GitHub/coding_architecture_fs26_focus_work/timber_models/patrick 2.json")

# ----
env = Python3Script(x=path)  # -> a
# ---------- env: Python ----------
# r: compas==2.15.1,timber_design==0.2.0
# venv: ca-fs26-focus-work



a = x
# ---------- end env ----------

# ---- group: Load Timber Model (continued)
load = Python3Script(path=env)  # -> model
# ---------- load: Python ----------
# r: compas==2.15.1,timber_design==0.2.0
# venv: ca-fs26-final-project

from compas import json_load


model = json_load(path)

print(model)
# ---------- end load ----------

# ----
viz = Python3Script(model=load)  # -> model, a
# ---------- viz: Python ----------
from compas.scene import Scene

scene = Scene()

model.process_joinery()

for beam in model.beams:
    scene.add(beam.geometry)
    scene.add(beam.geometry)



a = scene.draw()
# ---------- end viz ----------

# ---- group: Save Timber Model
run = Button()
model = Data(load)
path_2 = FilePath("/Users/lorinwiedemeier/Library/CloudStorage/GoogleDrive-lorinw@ethz.ch/Geteilte Ablagen/GKR_Teaching/Coding_Architecture/CAII/ADMIN/12_Focus-Work/01_GitHub/coding_architecture_fs26_focus_work/timber_models/TimberModel_for_Patrick-Fixed-3.json")
save_model = Python3Script(model=model, path=path_2, run=run)
# ---------- save_model: Python ----------
# from compas.data import json_dump

# if run and path:
#     if not path.lower().endswith('.json'):
#         path += '.json'
        
#     json_dump(model, path)
    
#     print("Model successfully saved to: {}".format(path))
# else:
#     print("Check 'run' state and ensure 'path' is a complete file path.")

from compas.data import json_dump
import os
import re

if run and path:

    # Ensure .json extension
    if not path.lower().endswith(".json"):
        path += ".json"

    directory = os.path.dirname(path)
    filename = os.path.basename(path)

    # Match names like:
    # model.json
    # model_2.json
    # model_15.json
    match = re.match(r"^(.*?)(?:_(\d+))?\.json$", filename)

    if match:
        base = match.group(1)
        number = match.group(2)

        if number:
            counter = int(number)
        else:
            counter = 1

        # Find next available filename
        while os.path.exists(path):
            counter += 1
            new_filename = "{}_{}.json".format(base, counter)
            path = os.path.join(directory, new_filename)

    json_dump(model, path)

    print("Model successfully saved to: {}".format(path))

else:
    print("Check 'run' state and ensure 'path' is a complete file path.")
# ---------- end save_model ----------

# ----
py3 = Python3Script(model=viz.model, rhino_points=pt)  # -> out, model; inputs rhino_points: list of Point3d
# ---------- py3: Python ----------
# venv: ca-fs26-focus-work

from compas_rhino.devtools import DevTools
DevTools.ensure_path()
ghenv.Component.Message = "Split Foundations"

from a03_extra_split_beams import split_beams_at_points_with_i_joints

model = split_beams_at_points_with_i_joints(
    model,
    rhino_points,
    tolerance=0.01,
)
# ---------- end py3 ----------
panel = Panel(env)

structural_model = Python3Script(model=py3.model)  # -> nodes, elements, element_ids, element_sections, element_planes, virtual_elements, virtual_element_ids, support_nodes
# ---------- structural_model: Python ----------
# r: compas==2.15.1,timber_design==0.2.0
# venv: ca-fs26-final-project

import Rhino.Geometry as rg
from Grasshopper import DataTree
from Grasshopper.Kernel.Data import GH_Path

from compas_rhino.devtools import DevTools
DevTools.ensure_path()
ghenv.Component.Message = "Structural Model"

import a03_extra_structural_analysis as structural_analysis 
from compas_rhino.conversions import point_to_rhino, line_to_rhino, frame_to_rhino_plane

# --------------------------------------------------
# HELPERS 
# --------------------------------------------------

def list_to_tree(data):
    """Converts a list of lists into a Grasshopper DataTree."""
    tree = DataTree[object]()
    for i, branch in enumerate(data):
        path = GH_Path(i)
        if isinstance(branch, (list, tuple)):
            for item in branch:
                tree.Add(item, path)
        else:
            tree.Add(branch, path)
    return tree

# --------------------------------------------------
# EXECUTION 
# --------------------------------------------------

# 1. Analyse im Modul durchführen
result = structural_analysis.process_structural_model(model)

# 2. NODES & SUPPORTS konvertieren
nodes = []
support_nodes = []
support_node_indices = []

for node in result["nodes"]:
    rhino_pt = point_to_rhino(node["point"])
    nodes.append(rhino_pt)
    if node["is_support"]:
        support_nodes.append(rhino_pt)
        support_node_indices.append(node["index"])

# 3. BEAM ELEMENTS konvertieren (DataTrees)
e_lines, e_sections, e_planes, e_indices, e_ids = [], [], [], [], []

for beam_segments in result["beams"]:
    b_lines, b_sections, b_planes, b_indices, b_ids = [], [], [], [], []
    for seg in beam_segments:
        b_lines.append(line_to_rhino(seg["line"]))
        b_planes.append(frame_to_rhino_plane(seg["frame"]))
        b_sections.append("{},{}".format(seg["width"], seg["height"]))
        b_indices.append("{},{}".format(seg["node_indices"][0], seg["node_indices"][1]))
        b_ids.append(seg["id"])
    
    e_lines.append(b_lines)
    e_sections.append(b_sections)
    e_planes.append(b_planes)
    e_indices.append(b_indices)
    e_ids.append(b_ids)

elements = list_to_tree(e_lines)
element_sections = list_to_tree(e_sections)
element_planes = list_to_tree(e_planes)
element_node_indices = list_to_tree(e_indices)
element_ids = list_to_tree(e_ids)

# 4. VIRTUAL ELEMENTS konvertieren
virtual_elements = []
virtual_node_indices = []
virtual_element_ids = []

for vseg in result["virtual"]:
    virtual_elements.append(line_to_rhino(vseg["line"]))
    virtual_node_indices.append("{},{}".format(vseg["node_indices"][0], vseg["node_indices"][1]))
    virtual_element_ids.append(vseg["id"])
# ---------- end structural_model ----------

data = Data(flatten(structural_model.elements))
data_2 = Data(structural_model.nodes)
data_3 = Data(structural_model.virtual_elements)
end = EndPoints(Curve=data)  # -> Start, End
merge = Merge(Data1=end.Start, Data2=end.End)
duppt = RemoveDuplicatePts(Points=merge, Tolerance=0.01)
