# Grasshopper definition a03_load_model.ghx (Grasshopper 1.0.8)
# Copyright: Lorin Wiedemeier

# ---- group: Load Timber Model
# Load Timber Model
path = FilePath("/Users/lorinwiedemeier/Library/CloudStorage/GoogleDrive-lorinw@ethz.ch/Geteilte Ablagen/GKR_Teaching/Coding_Architecture/CAII/ADMIN/12_Focus-Work/01_GitHub/coding_architecture_fs26_focus_work/timber_models/timber_model_w2-tuesday-02.json")
load = Python3Script(path=path)  # -> model
# ---------- load: Python ----------
# r: compas==2.15.1,timber_design==0.2.0
# venv: ca-fs26-final-project

from compas_rhino.devtools import DevTools
DevTools.ensure_path()

from compas import json_load

# LOAD CUSTOM JOINT CLASSES !
import a03_preferred_face_tbutt_joint
import a03_cutoff_l_lap_joint

from compas.data import json_load
model = json_load(path)

model.process_joinery()

ghenv.Component.Message = f"{len(list(model.elements()))} element(s) and {len(model.joints)} joint(s)"
print(model)
# ---------- end load ----------
# A03 Load timber model
# Gramazio Kohler Research
# Gonzalo Casas, Lorin Wiedemeier, Eric Gozzi
viz = Python3Script(model=load)  # -> a
# ---------- viz: Python ----------
from compas.scene import Scene

scene = Scene()
for beam in model.beams:
    scene.add(beam.geometry)

a = scene.draw()
# ---------- end viz ----------

# ----
reloader = CompasDevReloader()
# ---------- reloader: Python ----------
"""
------------------------------
Using VS Code as Python editor
------------------------------

The simplest way to start using VS Code as our editor, is
to place our Python code in files located IN THE SAME FOLDER as our Grasshopper file.

After we have done that, we need 2 steps: 

1. Enable the COMPAS reloader on one component. This tells Grasshopper to watch for changes in the Pythoh files and reload if changed.
2. Every other component that uses Python code from external files needs to start with a method to ensure Grasshopper knows where to load the files from.

"""
# venv: ca-fs26-final-project

from compas_rhino.devtools import DevTools
DevTools.enable_reloader()
# ---------- end reloader ----------
