# Grasshopper definition a03_debug_timber_model.ghx (Grasshopper 1.0.8)
# Copyright: Lorin Wiedemeier

# ---- group: Load Timber Model
# Load Timber Model
path = FilePath("/Users/lorinwiedemeier/Library/CloudStorage/GoogleDrive-lorinw@ethz.ch/Geteilte Ablagen/GKR_Teaching/Coding_Architecture/CAII/ADMIN/12_Focus-Work/01_GitHub/coding_architecture_fs26_focus_work/timber_models/timber_model_wednesday.json")
load = Python3Script(path=path)  # -> model
# ---------- load: Python ----------
# r: compas==2.15.1,timber_design==0.2.0
# venv: ca-fs26-final-project

from compas import json_load


model = json_load(path)
model.process_joinery()

ghenv.Component.Message = f"{len(list(model.elements()))} element(s) and {len(model.joints)} joint(s)"
print(model)
# ---------- end load ----------
viz = Python3Script(model=load)  # -> a
# ---------- viz: Python ----------
from compas.scene import Scene

scene = Scene()
for beam in model.beams:
    scene.add(beam.geometry)

a = scene.draw()
# ---------- end viz ----------

path_2 = FilePath("/Users/lorinwiedemeier/Library/CloudStorage/GoogleDrive-lorinw@ethz.ch/Geteilte Ablagen/GKR_Teaching/Coding_Architecture/CAII/ADMIN/12_Focus-Work/01_GitHub/coding_architecture_fs26_focus_work/timber_models/timber_model_wednesday_cleaned.json")
load_2 = Python3Script(path=path_2)  # -> model; same code as load
viz_2 = Python3Script(model=load_2)  # -> a; same code as viz

# ----
viz_3 = Python3Script(model=load)  # -> beam_centerlines, beam_tags, joint_points, joint_tags, joint_links, candidate_points, candidate_tags, candidate_links
# ---------- viz_3: Python ----------
# venv: ca-fs26-focus-work

from compas_rhino.devtools import DevTools
DevTools.ensure_path()

import importlib
import a03_debug_timber_model_visualizer
importlib.reload(a03_debug_timber_model_visualizer)

from a03_debug_timber_model_visualizer import create_timber_model_debug_geometry

debug = create_timber_model_debug_geometry(model, show_candidates=True)

beam_centerlines = debug["beam_centerlines"]
beam_tags = debug["beam_tags"]

joint_points = debug["joint_points"]
joint_tags = debug["joint_tags"]
joint_links = debug["joint_links"]

candidate_points = debug["candidate_points"]
candidate_tags = debug["candidate_tags"]
candidate_links = debug["candidate_links"]
# ---------- end viz_3 ----------
viz_4 = Python3Script(model=load_2)  # -> beam_centerlines, beam_tags, joint_points, joint_tags, joint_links, candidate_points, candidate_tags, candidate_links; same code as viz_3
stats = Python3Script(timber_model=load_2)  # -> stats
# ---------- stats: Python ----------
# venv: ca-fs26-focus-work

from compas_rhino.devtools import DevTools
DevTools.ensure_path()
ghenv.Component.Message = "Beam Length Stats"

# ------------------------------------------------------------------ #
# Inputs (wire these in GH):
#   timber_model  –  TimberModel object from the model creator component
# ------------------------------------------------------------------ #
# Outputs:
#   stats          –  human-readable summary string
#   category_names –  list of category strings
#   lengths_total  –  total centerline length per category [m]
#   lengths_avg    –  average beam length per category [m]
#   counts         –  number of beams per category
# ------------------------------------------------------------------ #

from collections import defaultdict

cat_lengths = defaultdict(list)

for beam in timber_model.beams:
    cat = beam.attributes.get("category", "unknown")
    cat_lengths[cat].append(beam.centerline.length)

category_names = []
lengths_total = []
lengths_avg = []
counts = []

lines = ["--- BEAM LENGTH STATS ---"]

for cat in sorted(cat_lengths.keys()):
    beam_lens = cat_lengths[cat]
    n = len(beam_lens)
    total = sum(beam_lens)
    avg = total / n

    category_names.append(cat)
    lengths_total.append(total)
    lengths_avg.append(avg)
    counts.append(n)

    lines.append(
        "{:10s}  {:3d} beams  total {:7.3f} m  avg {:6.3f} m".format(
            cat, n, total, avg
        )
    )

grand_total = sum(lengths_total)
lines.append("-------------------------")
lines.append("TOTAL       {:3d} beams  total {:7.3f} m".format(
    sum(counts), grand_total
))

stats = "\n".join(lines)
print(stats)
# ---------- end stats ----------
data = Data(viz_3.beam_tags)
data_2 = Data(viz_3.joint_links)
data_3 = Data(viz_3.candidate_points)
data_4 = Data(viz_3.candidate_tags)
data_5 = Data(viz_4.beam_tags)
data_6 = Data(viz_4.joint_links)
data_7 = Data(viz_4.candidate_points)
data_8 = Data(viz_4.candidate_tags)
# A03 Load timber model
# Gramazio Kohler Research
# Gonzalo Casas, Lorin Wiedemeier, Eric Gozzi
data_9 = Data(viz_3.joint_points)
data_10 = Data(viz_3.joint_tags)
data_11 = Data(viz_4.joint_points)
data_12 = Data(viz_4.joint_tags)
data_13 = Data(viz_4.beam_centerlines)
panel = Panel(stats)
reloader = CompasDevReloader()
# ---------- reloader: Python ----------
"""
------------------------------
Using VS Code as Python editor
------------------------------

The simplest way to start using VS Code as our editor, is
to place our Python code in files located IN THE SAME FOLDER as our Grasshopper file.

After we have done that, we need 2 steps: 

1. Enable the COMPAS reloader on one component. This tells Grasshopper to watch for changes in the Pythoh files and reload if changed.
2. Every other component that uses Python code from external files needs to start with a method to ensure Grasshopper knows where to load the files from.

"""
# venv: ca-fs26-final-project

from compas_rhino.devtools import DevTools
DevTools.enable_reloader()
# ---------- end reloader ----------
