# Grasshopper definition a03_extra_structural_analysis.ghx (Grasshopper 1.0.8)
# Copyright: Lorin Wiedemeier
# plug-ins: Karamba3D

# ----
# Karamba License
# Structural Model
license = LicenseKaramba3D()
panel = Panel(license)

# ----
# Unit Settings
# ensure is set to 'm'
settings = SettingsKaramba3D(menu=[dropdown(0)])  # -> AllSettings, GenericOutput

# ---- group: Load Timber Model
path = FilePath("/Users/timofeddern/Developer/ETH/coding_architecture_fs26/assignments/A03-design-project/timbermodel_final_hexmesh.json")
load = Python3Script(path=path)  # -> model
# ---------- load: Python ----------
# r: compas==2.15.1,timber_design==0.2.0
# venv: ca-fs26-final-project

from compas import json_load


model = json_load(path)

print(model)
# ---------- end load ----------

# ---- group: Save Timber Model
run = Button()
model = Data(load)
path_2 = FilePath("/Users/lorinwiedemeier/Desktop/test")
save_model = Python3Script(model=model, path=path_2, run=run)
# ---------- save_model: Python ----------
from compas.data import json_dump

if run and path:
    if not path.lower().endswith('.json'):
        path += '.json'
        
    json_dump(model, path)
    
    print("Model successfully saved to: {}".format(path))
else:
    print("Check 'run' state and ensure 'path' is a complete file path.")
# ---------- end save_model ----------

# ----
structural_model = Python3Script(model=load)  # -> nodes, elements, element_ids, element_sections, element_planes, virtual_elements, virtual_element_ids, support_nodes
# ---------- structural_model: Python ----------
# r: compas==2.15.1,timber_design==0.2.0
# venv: ca-fs26-final-project

import Rhino.Geometry as rg
from Grasshopper import DataTree
from Grasshopper.Kernel.Data import GH_Path

from compas_rhino.devtools import DevTools
DevTools.ensure_path()
ghenv.Component.Message = "Structural Model"

import a03_extra_structural_analysis as structural_analysis 
from compas_rhino.conversions import point_to_rhino, line_to_rhino, frame_to_rhino_plane

# --------------------------------------------------
# HELPERS 
# --------------------------------------------------

def list_to_tree(data):
    """Converts a list of lists into a Grasshopper DataTree."""
    tree = DataTree[object]()
    for i, branch in enumerate(data):
        path = GH_Path(i)
        if isinstance(branch, (list, tuple)):
            for item in branch:
                tree.Add(item, path)
        else:
            tree.Add(branch, path)
    return tree

# --------------------------------------------------
# EXECUTION 
# --------------------------------------------------

# 1. Analyse im Modul durchführen
result = structural_analysis.process_structural_model(model)

# 2. NODES & SUPPORTS konvertieren
nodes = []
support_nodes = []
support_node_indices = []

for node in result["nodes"]:
    rhino_pt = point_to_rhino(node["point"])
    nodes.append(rhino_pt)
    if node["is_support"]:
        support_nodes.append(rhino_pt)
        support_node_indices.append(node["index"])

# 3. BEAM ELEMENTS konvertieren (DataTrees)
e_lines, e_sections, e_planes, e_indices, e_ids = [], [], [], [], []

for beam_segments in result["beams"]:
    b_lines, b_sections, b_planes, b_indices, b_ids = [], [], [], [], []
    for seg in beam_segments:
        b_lines.append(line_to_rhino(seg["line"]))
        b_planes.append(frame_to_rhino_plane(seg["frame"]))
        b_sections.append("{},{}".format(seg["width"], seg["height"]))
        b_indices.append("{},{}".format(seg["node_indices"][0], seg["node_indices"][1]))
        b_ids.append(seg["id"])
    
    e_lines.append(b_lines)
    e_sections.append(b_sections)
    e_planes.append(b_planes)
    e_indices.append(b_indices)
    e_ids.append(b_ids)

elements = list_to_tree(e_lines)
element_sections = list_to_tree(e_sections)
element_planes = list_to_tree(e_planes)
element_node_indices = list_to_tree(e_indices)
element_ids = list_to_tree(e_ids)

# 4. VIRTUAL ELEMENTS konvertieren
virtual_elements = []
virtual_node_indices = []
virtual_element_ids = []

for vseg in result["virtual"]:
    virtual_elements.append(line_to_rhino(vseg["line"]))
    virtual_node_indices.append("{},{}".format(vseg["node_indices"][0], vseg["node_indices"][1]))
    virtual_element_ids.append(vseg["id"])
# ---------- end structural_model ----------

panel_2 = Panel(path)
data = Data(structural_model.element_ids)

# ----
# Crossections / Material
matselect = MaterialSelectionKaramba3D(menu=[dropdown(4), dropdown(11)])
split = TextSplit(Text=structural_model.element_sections, Separators=",")
dispatch = Dispatch(List=split, DispatchPattern=[True, False])  # -> ListA, ListB
cross_section = CrossSectionKaramba3D(
    FamilyNameOfCrossSection="DefaultCroSec",
    Material=matselect,
    Height_cm=expr("x*100", dispatch.ListB),
    UpperFlangeWidth_cm=expr("x*100", dispatch.ListA),
    LowerFlangeWidth_cm=expr("x*100", dispatch.ListA),
    mode="Trapezoid")  # -> flatten(CrossSection)

# ----
# A03 Extra Task: Structural Analysis
# Gramazio Kohler Research
# Gonzalo Casas, Lorin Wiedemeier, Eric Gozzi
# Patrick Studer
# Beams
crv = Curve(structural_model.elements)
pln = Plane(structural_model.element_planes)
deplane = DeconstructPlane(Plane=pln)  # -> Origin, XAxis, YAxis, ZAxis
linetobeam = LineToBeamKaramba3D(
    Line=crv,
    Identifier=data,
    CrossSection=cross_section,
    New=True,
    Remove=True,
    LimitDistance_m=0.005,
    ZOrientation=deplane.ZAxis,
    Bending=True,
    SetBucklingLength=True,
    ToPolylineMaxAngle=0.03,
    ToPolylineTolerance=0.01,
    ToPolylineMaxEdgeLength=0.25)  # -> Element, Points, Info

# ----
# Supports
# Loads
supp = SupportKaramba3D(PosInd=structural_model.support_nodes, menu=[buttons(on, on, on, off, off, off)])
support = SupportKaramba3D(supp)

# ----
# Virtual Elements
crv_2 = Curve(structural_model.virtual_elements)
data_2 = Data(structural_model.virtual_element_ids)
linetobeam_2 = LineToBeamKaramba3D(
    Line=flatten(crv_2),
    Identifier=data_2,
    CrossSection=cross_section,
    New=True,
    Remove=True,
    LimitDistance_m=0.005,
    Bending=True,
    SetBucklingLength=True,
    ToPolylineMaxAngle=0.03,
    ToPolylineTolerance=0.01,
    ToPolylineMaxEdgeLength=0.25)  # -> Element, Points, Info

vec = VectorXYZ(XComponent=0, YComponent=0, ZComponent="-1")  # -> Vector, Length
multiplication = Multiplication(A=vec.Vector, B="1.35")

timber_model = Data(load)
wind_sia = Python3Script(model=timber_model, wind_angle=Slider(0, range=0..360))  # -> out, element_ids, load_vectors
# ---------- wind_sia: Python ----------
# venv: ca-fs26-final-project


from compas_rhino.devtools import DevTools
DevTools.ensure_path()
ghenv.Component.Message = "Wind Loads"

import Rhino.Geometry as rg
import a03_extra_structural_analysis as structural_analysis
from compas.geometry import Vector

# 1. List of Beams
beams = list(model.beams)

# 2. calculate load vectors and element IDs
# wind_results = structural_analysis.calculate_wind_loads(model, wind_angle, q_pressure, c_coeff, safety_fac)
wind_results = structural_analysis.calculate_wind_loads_sia(model, wind_angle, qp0=0.9, terrain_category="III", z_max=3.0, c_force=2.0, gamma_q=1.35)

# 3. split data for karamba
element_ids = [res["id"] for res in wind_results]
load_vectors = [rg.Vector3d(res["vector"][0], res["vector"][1], res["vector"][2]) for res in wind_results]
# ---------- end wind_sia ----------

# ---- group: Point Load
item = ListItem(List=structural_model.nodes, Index=Slider(135, range=0..400), Wrap=invert(True))

# ----
cr_start = Slider(10, range=0..1000)
vec_2 = VectorXYZ(XComponent=cr_start, YComponent=cr_start, ZComponent=cr_start)  # -> Vector, Length

# ----
# Joints (Virtual Elements)
data_3 = Data(structural_model.virtual_element_ids)
panel_3 = Panel(data_3)
beam_joints = BeamJointsKaramba3D(
    AtElementIdentifiers=panel_3,
    CtKNMAtStartingNode=Vector(0, 0, 0),
    CrKNmRadAtStartingNode=vec_2.Vector,
    CtKNMAtEndNode=Vector(0, 0, 0),
    CrKNmRadAtEndNode=vec_2.Vector,
    menu=[buttons(off, off, off, on, on, on), buttons(off, off, off, on, on, on)])
joint = JointKaramba3D(beam_joints)

# ---- group: Point Load
multiplication_2 = Multiplication(A="9.81", B=Slider(120, range=0..200))
division = Division(A=multiplication_2, B="1000")
vec_3 = VectorXYZ(XComponent=0, YComponent=0, ZComponent=expr("-x", division))  # -> Vector, Length

panel_4 = Panel("03_PointLoad")
loads = LoadsKaramba3D(ForceVector=vec_3.Vector, Local=False, PosInd=item, LCase=panel_4, mode="Point")  # -> flatten(Load)

# ----
# Selfweight
# Wind-Load
# Point Load
panel_5 = Panel("02_Wind")
beam_loads = BeamLoadsKaramba3D(
    BeamIdentifier=wind_sia.element_ids,
    LoadCase=panel_5,
    ForceVector=wind_sia.load_vectors,
    TStart=0,
    TEnd=1,
    mode="Block",
    menu=[buttons(off, on, off)])  # -> flatten(Load)

loads_2 = LoadsKaramba3D(Vector=multiplication, LCase="01_Selfweight", mode="Gravity")

# ----
# Elements
merge = Merge(Data1=linetobeam.Element, Data2=linetobeam_2.Element)  # -> flatten(Result)
element = ElementKaramba3D(merge)

# ----
# Load Combinations
list = ValueList({"All": 0, "Selfweight": 1, "Wind": 2, "Point": 3, "SW + Wind": 4, "SW + Point": 5, "Wind + Point": 6}, selected="All")

entwine = Entwine(Branch0X=loads_2, Branch1X=beam_loads, Branch2X=loads, FlattenInputs=False)  # -> simplify(Result)
entwine_2 = Entwine(Branch0X="01_Selfweight", Branch1X=panel_5, Branch2X=panel_4, FlattenInputs=False)  # -> simplify(Result)
lc = Python3Script(cases=list)  # -> pathMask
# ---------- lc: Python ----------
"""
Logic Switch for Karamba Load Selection via Split Tree.
Inputs:
    cases: int (index 0-6)
Outputs:
    pathMask: list of strings (masks for Split Tree)
"""

# Mapping:
# 0: Alle (SW + Wind + Point)
# 1: Selfweight
# 2: Windload
# 3: Pointload
# 4: Selfweight + Windload
# 5: Selfweight + Pointload
# 6: Windload + Pointload

# Wir nutzen {N;*} - damit wird jeder Pfad erfasst, der mit der Zahl N beginnt.
# Das ist viel robuster gegen unterschiedliche Baum-Strukturen (DataTrees).

mask_data = {
    0: ["{0;*}", "{1;*}", "{2;*}"],
    1: ["{0;*}"],
    2: ["{1;*}"],
    3: ["{2;*}"],
    4: ["{0;*}", "{1;*}"],
    5: ["{0;*}", "{2;*}"],
    6: ["{1;*}", "{2;*}"]
}

# Rückgabe der Liste für den Split Tree 'M' Eingang
pathMask = mask_data.get(cases, ["{0;*}"])
# ---------- end lc ----------
split_2 = SplitTree(Data=entwine, Masks=lc)  # -> flatten(Positive), Negative
split_3 = SplitTree(Data=entwine_2, Masks=lc)  # -> flatten(Positive), Negative
load_2 = LoadKaramba3D(flatten(split_2.Positive))
panel_6 = Panel(split_3.Positive)

# ----
# Assemble / Analyze
assemble = AssembleModelKaramba3D(Elem=element, Support=support, Load=flatten(load_2), Joint=joint, LimitDistance_m=0.005)  # -> Model, Info, Mass_kg, CenterOfGravity, LoadCaseNames
analyze = AnalyzeKaramba3D(Model=assemble.Model)  # -> CalculatedModel, MaximumDisplacement_cm, ResultingForceOfGravity_kN, ElasticEnergyChange_kNm

swatch = ColourSwatch(SwatchColor=RGB(0, 254, 0))
swatch_2 = ColourSwatch(SwatchColor=RGB(255, 0, 0))
reloader = CompasDevReloader()
# ---------- reloader: Python ----------
"""
------------------------------
Using VS Code as Python editor
------------------------------

The simplest way to start using VS Code as our editor, is
to place our Python code in files located IN THE SAME FOLDER as our Grasshopper file.

After we have done that, we need 2 steps: 

1. Enable the COMPAS reloader on one component. This tells Grasshopper to watch for changes in the Pythoh files and reload if changed.
2. Every other component that uses Python code from external files needs to start with a method to ensure Grasshopper knows where to load the files from.

"""
# venv: ca-fs26-final-project

from compas_rhino.devtools import DevTools
DevTools.enable_reloader()
# ---------- end reloader ----------

# ----
# Display
modelview = ModelViewKaramba3D(Model=analyze.CalculatedModel, ResultFactors=1, ResultCase=-1)  # -> Model, DeformedMesh, DeformedAxes, DeformedModel
beamview = BeamViewKaramba3D(Model=modelview.Model)  # -> Model, MeshesOfRenderedBeams, DeformedBeamAxes, LegendColours, LegendTags
react = ReactionForcesKaramba3D(AnalyzedModel=modelview.Model, LoadCase=panel_6)  # -> AnalyzedModel, ReactionForces_kN, ReactionMoments_kNm, SupportPosition, SumOfReactionForces_kN, SumOfReactionMoments_kNm
legend = Legend(Colour=beamview.LegendColours, Tags=beamview.LegendTags, LegendType=1)
reactions = Python3Script(
    forces=simplify(react.ReactionForces_kN),
    positions=simplify(react.SupportPosition),
    scale_forces=Slider(0.2, range=0..10))  # -> out, geo_forces, tot_line; inputs forces: tree of Vector3d, positions: tree of Point3d
# ---------- reactions: Python ----------
import System
import Rhino
import Rhino.Geometry as rg
import Grasshopper

class ReactionForceDisplay(Grasshopper.Kernel.GH_ScriptInstance):

    def RunScript(self,
            forces: Grasshopper.DataTree[Rhino.Geometry.Vector3d],
            positions: Grasshopper.DataTree[Rhino.Geometry.Point3d],
            scale_forces):
        
        self._arrows = [] 
        self._dots = []  
        
        if not forces or forces.BranchCount == 0: return
            
        sc = scale_forces if scale_forces else 1.0
        geo_forces = []
        
        # 1. Gruppierung der Kräfte pro Auflager-Position
        node_summary = {} # Key: String, Value: [Point3d, Vector3d]
        
        # Akkumulatoren für die Komponenten der Gesamtsumme
        sum_x = 0.0
        sum_y = 0.0
        sum_z = 0.0
        
        for i in range(forces.BranchCount):
            branch_forces = forces.Branch(i)
            pos_idx = i if i < positions.BranchCount else 0
            branch_positions = positions.Branch(pos_idx)
            
            if len(branch_forces) != len(branch_positions):
                continue

            for j in range(len(branch_forces)):
                f_vec = branch_forces[j]
                pos = branch_positions[j]
                
                # Eindeutiger Schlüssel für die Position
                key = "{:.3f},{:.3f},{:.3f}".format(pos.X, pos.Y, pos.Z)
                
                if key not in node_summary:
                    node_summary[key] = [pos, rg.Vector3d(0,0,0)]
                
                # Addiere den Vektor zum jeweiligen Auflager
                node_summary[key][1] += f_vec
                
                # Addiere zu den Komponenten der Gesamtsumme
                sum_x += f_vec.X
                sum_y += f_vec.Y
                sum_z += f_vec.Z

        # 2. Visualisierung der GRUPPIERTEN Auflager-Kräfte (Blaue Pfeile)
        color_ind = System.Drawing.Color.DodgerBlue
        avg_pos_accumulator = rg.Point3d(0,0,0)
        
        for key in node_summary:
            pos, summed_vec = node_summary[key]
            avg_pos_accumulator += pos
            
            scaled_vec = summed_vec * sc
            start_pt = pos - scaled_vec
            force_line = rg.Line(start_pt, pos)
            geo_forces.append(force_line)
            
            if force_line.Length > 0.001:
                head_scale = 0.25
                shaft_line = rg.Line(start_pt, force_line.PointAt(1.0 - head_scale))
                self._arrows.append((force_line, shaft_line, color_ind, 3.2, head_scale))

        # 3. Resultierende Gesamtkraft & Text-Split (Roter Pfeil)
        total_sum_vector = rg.Vector3d(sum_x, sum_y, sum_z)
        color_tot = System.Drawing.Color.Crimson
        
        if len(node_summary) > 0:
            avg_pos = avg_pos_accumulator / len(node_summary)
            scaled_total = total_sum_vector * sc
            start_total = avg_pos - scaled_total
            geo_total_line = rg.Line(start_total, avg_pos)
            
            if total_sum_vector.Length > 0.001:
                head_scale_tot = 0.2
                shaft_tot_line = rg.Line(start_total, geo_total_line.PointAt(1.0 - head_scale_tot))
            
                self._arrows.append((geo_total_line, shaft_tot_line, color_tot, 5.5, head_scale_tot))
                
                # Formatierter Text-Tag mit X, Y, Z Splitting
                info_text = (
                    "TOTAL RESULTANT: {:.2f} kN\n"
                    "Sum X: {:.2f} kN\n"
                    "Sum Y: {:.2f} kN\n"
                    "Sum Z: {:.2f} kN (Vertical)"
                ).format(total_sum_vector.Length, sum_x, sum_y, sum_z)
                
                self._dots.append((info_text, start_total, color_tot, 15))

        # Rückgabe für Rhino-Vorschau (optional)
        return geo_forces, total_sum_vector

    def DrawViewportWires(self, args):
        if not hasattr(self, '_arrows'): return
        for full_line, shaft_line, color, thick, head_size in self._arrows:
            args.Display.DrawLine(shaft_line, color, thick)
            args.Display.DrawArrow(full_line, color, 0, head_size)

    def DrawViewportMeshes(self, args):
        if not hasattr(self, '_dots'): return
        for text, pt, color, size in self._dots:
            args.Display.Draw2dText(text, color, pt, True, int(size))
# ---------- end reactions ----------
utilization = UtilizationOfElementsKaramba3D(
    AnalysedModel=modelview.Model,
    LoadCaseCombination=panel_6,
    NumberOfSamplePoints=3,
    ElasticDesign=False,
    GammaM0=1,
    GammaM1=1.1,
    SwayFrame=True,
    WithDetails=invert(False),
    mode="Beams")  # -> Model, simplify(Utilization), SigMax_kN_cm2, SigMin_kN_cm2, TauMax_kN_cm2, UtilN, UtilVy, UtilVz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

geo = Geometry(beamview.MeshesOfRenderedBeams)

pt = Point(Point(-2.334000384, 8.379257966, 0))
# Report
analysis_report = Python3Script(
    model=load,
    total_weight=assemble.Mass_kg,
    max_displacements=analyze.MaximumDisplacement_cm,
    utilisations_tree=utilization.Utilization,
    loadcase_names=panel_6,
    report_pt=pt,
    report_scale=Slider(0.1, range=0..1))  # -> out, analysis_report, report_geo; inputs max_displacements: list, utilisations_tree: tree, loadcase_names: list, report_pt: Point3d, report_scale: Double
# ---------- analysis_report: Python ----------
# venv: ca-fs26-final-project

import Rhino
import Rhino.Geometry as rg

from compas_rhino.devtools import DevTools
DevTools.ensure_path()
ghenv.Component.Message = "Analysis Report"

import a03_extra_structural_analysis as structural_analysis 

# --------------------------------------------------
# EXECUTION 
# --------------------------------------------------

analysis_report = structural_analysis.create_analysis_report(model, total_weight, loadcase_names, max_displacements, utilisations_tree)


report_plane = rg.Plane(report_pt, rg.Vector3d.XAxis)

report_geo = structural_analysis.create_preview(analysis_report, report_pt, report_scale, report_plane)
# ---------- end analysis_report ----------
panel_7 = Panel(analysis_report.analysis_report)
