# Grasshopper definition a03_stencil.ghx (Grasshopper 1.0.8)
# Copyright: Lorin Wiedemeier

pipeline = GeometryPipeline(
    GroupByLayer=False,
    GroupByType=False,
    IncludeHidden=True,
    IncludeLocked=True,
    LayerFilter="Frame Beam Lines**",
    NameFilter="*",
    SublayerFiltering=True,
    TypeFilter=4)
pipeline_2 = GeometryPipeline(
    GroupByLayer=False,
    GroupByType=False,
    IncludeHidden=True,
    IncludeLocked=True,
    LayerFilter="Plate Beam Lines**",
    NameFilter="*",
    SublayerFiltering=True,
    TypeFilter=4)
pipeline_3 = GeometryPipeline(
    GroupByLayer=False,
    GroupByType=False,
    IncludeHidden=True,
    IncludeLocked=True,
    LayerFilter="Foundation Points**",
    NameFilter="*",
    SublayerFiltering=True,
    TypeFilter=1)
pipeline_4 = GeometryPipeline(
    GroupByLayer=False,
    GroupByType=False,
    IncludeHidden=True,
    IncludeLocked=True,
    LayerFilter="Plate Lines**",
    NameFilter="*",
    SublayerFiltering=True,
    TypeFilter=4)

pipeline_5 = GeometryPipeline(
    GroupByLayer=False,
    GroupByType=False,
    IncludeHidden=True,
    IncludeLocked=True,
    LayerFilter="Cut Lines**",
    NameFilter="*",
    SublayerFiltering=True,
    TypeFilter=4)

install = CompasPyTemplate(a=pipeline_4)  # -> a; inputs a: Brep
# ---------- install: Python ----------
# r: compas==2.15.1,timber_design==0.2.0,compas_fab==1.1.4
# venv: ca-fs26-focus-work

ghenv.Component.Message = "Install"
# ---------- end install ----------
crv = Curve(pipeline_2)
crv_2 = Curve(pipeline)
plate_bea = Explode(Curve=crv, Recursive=True)  # -> flatten(Segments), Vertices
explode = Explode(Curve=crv_2, Recursive=True)  # -> flatten(Segments), Vertices
pt = Point(pipeline_3)
crv_3 = Curve(install)

crv_4 = Curve(pipeline_5)

plate_beam_width = Slider(0.09, range=0..0.1)
plate_beam_height = Slider(0.09, range=0..0.1)
frame_beam_width = Slider(0.08, range=0..0.1)
frame_beam_height = Slider(0.06, range=0..0.1)
# Check Hole Segments before committing BTLx
toggle = BooleanToggle(True)
# Focus Work - Stencil
py3 = Python3Script(
    points=pt,
    rectangles=crv_3,
    cut_lines=crv_4,
    plate_beam_lines=plate_bea.Segments,
    frame_beam_lines=explode.Segments,
    plate_thickness=Slider(0.03, range=0..0.1),
    hole_radius=Slider(0.0385, range=0..0.1),
    hole_segments=Slider(22, range=0..100),
    plate_beam_width=plate_beam_width,
    plate_beam_height=plate_beam_height,
    frame_beam_width=frame_beam_width,
    frame_beam_height=frame_beam_height,
    process_joinery=Toggle(True),
    compute_plate_geometry=toggle,
    hole_processing="drilling")  # -> out, timber_model, plates_out, plate_holes_out, plate_beams_out, frame_beams_out; inputs points: list of Point3d, rectangles: list of Rectangle3d, cut_lines: list of Curve, plate_beam_lines: list of Line, frame_beam_lines: list of Line, hole_segments: Int32, process_joinery: Boolean, compute_plate_geometry: Boolean, hole_processing: String
# ---------- py3: Python ----------
# r: compas==2.15.1,timber_design==0.2.0,compas_fab==1.1.4
# venv: ca-fs26-focus-work

from compas_rhino.devtools import DevTools

import compas
print(compas.__file__)

DevTools.ensure_path()
ghenv.Component.Message = "Stencil BTLx"

from a03_stencil import create_stencil


# Inputs
rectangles = vars().get("rectangles") or []
points = vars().get("points") or []

# --- FIX FÜR POLYLINE / LIST ACCESS ---
raw_cut_lines = vars().get("cut_lines")
cut_lines = []

if raw_cut_lines:
    # Falls es eine einzelne Polyline oder ein zusammengesetztes Kurvenobjekt ist
    if hasattr(raw_cut_lines, "DuplicateSegments"):
        segments = raw_cut_lines.DuplicateSegments()
        if segments:
            cut_lines.extend(segments)
        else:
            cut_lines.append(raw_cut_lines)
    # Falls es bereits eine Liste/Iterable ist
    elif hasattr(raw_cut_lines, "__iter__") and not isinstance(raw_cut_lines, str):
        for item in raw_cut_lines:
            if hasattr(item, "DuplicateSegments"):
                cut_lines.extend(item.DuplicateSegments())
            else:
                cut_lines.append(item)
    else:
        cut_lines.append(raw_cut_lines)
# --------------------------------------

frame_beam_lines = vars().get("frame_beam_lines") or []
plate_beam_lines = vars().get("plate_beam_lines") or []

plate_thickness = vars().get("plate_thickness") or 0.010
hole_radius = vars().get("hole_radius") or 0.015
hole_segments = vars().get("hole_segments") or 24
hole_processing = vars().get("hole_processing") or "free_contour"

frame_beam_width = vars().get("frame_beam_width") or 0.060
frame_beam_height = vars().get("frame_beam_height") or 0.080
plate_beam_width = vars().get("plate_beam_width") or 0.040
plate_beam_height = vars().get("plate_beam_height") or 0.060

joint_max_distance = vars().get("joint_max_distance") or 0.020
tbutt_mill_depth = vars().get("tbutt_mill_depth") or 0.001
lap_cut_plane_bias = vars().get("lap_cut_plane_bias") or 0.5
flip_lap_side = vars().get("flip_lap_side") or False

include_x_lap = vars().get("include_x_lap")
include_x_lap = True if include_x_lap is None else include_x_lap

process_joinery = vars().get("process_joinery") or False
compute_plate_geometry = vars().get("compute_plate_geometry") or False


# Create stencil
result = create_stencil(
    rectangles=rectangles,
    points=points,
    cut_lines=cut_lines,
    frame_beam_lines=frame_beam_lines,
    plate_beam_lines=plate_beam_lines,
    plate_thickness=plate_thickness,
    hole_radius=hole_radius,
    hole_segments=hole_segments,
    hole_processing=hole_processing,
    frame_beam_width=frame_beam_width,
    frame_beam_height=frame_beam_height,
    plate_beam_width=plate_beam_width,
    plate_beam_height=plate_beam_height,
    joint_max_distance=joint_max_distance,
    tbutt_mill_depth=tbutt_mill_depth,
    lap_cut_plane_bias=lap_cut_plane_bias,
    flip_lap_side=flip_lap_side,
    include_x_lap=include_x_lap,
    process_joinery=process_joinery,
    compute_plate_geometry=compute_plate_geometry,
)


# Outputs
plates = result["plates"]
frame_beams = result["frame_beams"]
plate_beams = result["plate_beams"]

plates_out = result["plates_out"]
frame_beams_out = result["frame_beams_out"]
plate_beams_out = result["plate_beams_out"]

plates_brep_out = result.get("plates_brep_out")
plates_brep_by_plate = result.get("plates_brep_by_plate")

plate_holes_out = result["plate_holes_out"]
plate_holes_rhino = result["plate_holes_rhino"]
plate_holes_by_plate = result.get("plate_holes_by_plate")

plate_openings = result.get("plate_openings")
plate_openings_by_plate = result.get("plate_openings_by_plate")
plate_preview_holes_by_plate = result.get("plate_preview_holes_by_plate")

hole_volumes_out = result.get("hole_volumes_out")
hole_volumes_by_plate = result.get("hole_volumes_by_plate")

plate_drilling_lines_by_plate = result.get("plate_drilling_lines_by_plate")
plate_drillings_by_plate = result.get("plate_drillings_by_plate")

points_by_plate = result.get("points_by_plate")
hole_processing_out = result.get("hole_processing")

plates_rhino = result["plates_rhino"]
frame_beams_rhino = result["frame_beams_rhino"]
plate_beams_rhino = result["plate_beams_rhino"]

geometry_errors = result["geometry_errors"]
joints = result["joints"]
joint_count = result["joint_count"]
joint_types = result["joint_types"]
joint_errors = result["joint_errors"]
joining_errors = result["joining_errors"]
unjoined_clusters = result["unjoined_clusters"]
timber_model = result["timber_model"]
# ---------- end py3 ----------
draw = COMPASDraw(cg=py3.plates_out)  # -> rg
#   port cg: The COMPAS geometry or datastructure to be drawn.
#   port rg: The Rhino geometry object.
# ---------- draw: Python ----------
# r: compas>=2.14.1
"""
Draws COMPAS geometry in Grasshopper.
"""

from typing import Any

import Grasshopper

from compas.scene import SceneObject


class CompasToRhinoGeometry(Grasshopper.Kernel.GH_ScriptInstance):
    def RunScript(self, cg):
        if not cg:
            return None

        return SceneObject(item=cg).draw()
# ---------- end draw ----------
draw_2 = COMPASDraw(cg=py3.plate_holes_out)  # -> rg; same code as draw

draw_3 = COMPASDraw(cg=py3.plate_beams_out)  # -> rg; same code as draw
draw_4 = COMPASDraw(cg=py3.frame_beams_out)  # -> rg; same code as draw

path = FilePath("C:\Users\lucij\Documents\ETH\Master\2. Semester\6_Vertiefungsarbeit\coding_architecture_fs26_focus_work\working_directory\group_c\stencil\")
btlx_out = Python3Script(model=py3.timber_model, path=path, write=Button())  # -> out, BTLx; inputs path: String, write: Boolean
# ---------- btlx_out: Python ----------
from compas_timber.fabrication import BTLxWriter

if write:
    btlx = BTLxWriter()
    XML = btlx.write(model, path)
else:
    XML = None
# ---------- end btlx_out ----------

python_3_script = Python3Script(model=py3.timber_model)  # -> out, beam_blanks
# ---------- python_3_script: Python ----------
beam_blanks = []


for beam in model.beams:
    beam_blanks.append(beam.blank)
# ---------- end python_3_script ----------
compas_draw = COMPASDraw(cg=python_3_script.beam_blanks)  # -> rg; same code as draw
panel = Panel(btlx_out.out)

pt_2 = Point(Point(2.31887332, 8.754053132, 0))
stencil_stats_and_arrange = Python3Script(
    timber_model=py3.timber_model,
    origin=pt_2,
    stock_length_frame=Slider(5, range=0..10),
    stock_length_plate=Slider(2.3, range=0..10),
    saw_gap=Slider(0.01, range=0..0.05),
    beam_spacing=Slider(0.6, range=0..1),
    beam_offset=Slider(0.2, range=0..1))  # -> model_stats, packing_stats, visual_stocks, visual_beams, beam_labels, beam_label_points, grouped_stocks, beam_blankets_out, beam_name_texts, stencil_beam_name_onplace; inputs origin: Point3d
# ---------- stencil_stats_and_arrange: Python ----------
# venv: ca-fs26-focus-work

from compas_rhino.devtools import DevTools
DevTools.ensure_path()

ghenv.Component.Message = "Stencil Stats/Arrange"

import importlib
import a03_stencil_packing_blank_gap
importlib.reload(a03_stencil_packing_blank_gap)

from a03_stencil_packing_blank_gap import solve_and_visualize_stencil_packing


if origin is None:
    raise ValueError("origin fehlt")

# DEFAULTS se gli slider non sono collegati
stock_length_frame = stock_length_frame or 5.0    # beams 6x8 cm
stock_length_plate = stock_length_plate or 2.3    # beams 9x9 cm

saw_gap = saw_gap or 0.0
beam_spacing = beam_spacing or 0.25
beam_offset = beam_offset or 0.0
group_gap = group_gap or 0.50
label_offset = label_offset or 0.05


(
    model_stats,
    packing_stats,
    visual_stocks,
    visual_beams,
    beam_labels,
    beam_label_points,
    grouped_stocks,
    beam_blankets_out,
    beam_name_texts,
    stencil_beam_name_onplace,
) = solve_and_visualize_stencil_packing(
    timber_model=timber_model,
    origin=origin,
    stock_length_frame=stock_length_frame,
    stock_length_plate=stock_length_plate,
    saw_gap=saw_gap,
    beam_spacing=beam_spacing,
    beam_offset=beam_offset,
    group_gap=group_gap,
    label_offset=label_offset,
)
# ---------- end stencil_stats_and_arrange ----------
draw_5 = COMPASDraw(cg=stencil_stats_and_arrange.visual_stocks)  # -> rg; same code as draw
draw_6 = COMPASDraw(cg=stencil_stats_and_arrange.beam_label_points)  # -> rg; same code as draw
draw_7 = COMPASDraw(cg=stencil_stats_and_arrange.visual_beams)  # -> rg; same code as draw
draw_8 = COMPASDraw(cg=stencil_stats_and_arrange.beam_blankets_out)  # -> rg; same code as draw
panel_2 = Panel(stencil_stats_and_arrange.packing_stats)
custom_preview = CustomPreview(
    Geometry=stencil_stats_and_arrange.stencil_beam_name_onplace,
    Material={diffuse=RGB(221, 160, 221), emission=RGB(66, 48, 66), shine=0.5, specular=RGB(255, 255, 255), transparency=0})
custom_preview_2 = CustomPreview(
    Geometry=stencil_stats_and_arrange.beam_name_texts,
    Material={diffuse=RGB(221, 160, 221), emission=RGB(66, 48, 66), shine=0.5, specular=RGB(255, 255, 255), transparency=0})
panel_3 = Panel(stencil_stats_and_arrange.beam_labels)
list_item = ListItem(List=stencil_stats_and_arrange.visual_beams, Index=Slider(29, range=0..35), Wrap=True)
draw_9 = COMPASDraw(cg=list_item)  # -> rg; same code as draw

stats = Python3Script(timber_model=py3.timber_model)  # -> stats
# ---------- stats: Python ----------
# venv: ca-fs26-focus-work

from compas_rhino.devtools import DevTools
DevTools.ensure_path()
ghenv.Component.Message = "Beam Length Stats"

# ------------------------------------------------------------------ #
# Inputs (wire these in GH):
#   timber_model  –  TimberModel object from the model creator component
# ------------------------------------------------------------------ #
# Outputs:
#   stats          –  human-readable summary string
#   category_names –  list of category strings
#   lengths_total  –  total centerline length per category [m]
#   lengths_avg    –  average beam length per category [m]
#   counts         –  number of beams per category
# ------------------------------------------------------------------ #

from collections import defaultdict

cat_lengths = defaultdict(list)

for beam in timber_model.beams:
    cat = beam.attributes.get("category", "unknown")
    cat_lengths[cat].append(beam.centerline.length)

category_names = []
lengths_total = []
lengths_avg = []
counts = []

lines = ["--- BEAM LENGTH STATS ---"]

for cat in sorted(cat_lengths.keys()):
    beam_lens = cat_lengths[cat]
    n = len(beam_lens)
    total = sum(beam_lens)
    avg = total / n

    category_names.append(cat)
    lengths_total.append(total)
    lengths_avg.append(avg)
    counts.append(n)

    lines.append(
        "{:10s}  {:3d} beams  total {:7.3f} m  avg {:6.3f} m".format(
            cat, n, total, avg
        )
    )

grand_total = sum(lengths_total)
lines.append("-------------------------")
lines.append("TOTAL       {:3d} beams  total {:7.3f} m".format(
    sum(counts), grand_total
))

stats = "\n".join(lines)
print(stats)
# ---------- end stats ----------
panel_4 = Panel(stats)

reloader = CompasDevReloader()
# ---------- reloader: Python ----------
"""
------------------------------
Using VS Code as Python editor
------------------------------

The simplest way to start using VS Code as our editor, is
to place our Python code in files located IN THE SAME FOLDER as our Grasshopper file.

After we have done that, we need 2 steps: 

1. Enable the COMPAS reloader on one component. This tells Grasshopper to watch for changes in the Pythoh files and reload if changed.
2. Every other component that uses Python code from external files needs to start with a method to ensure Grasshopper knows where to load the files from.

"""
# venv: ca-fs26-focus-work

from compas_rhino.devtools import DevTools
DevTools.enable_reloader()
# ---------- end reloader ----------
