# Grasshopper definition a03_stencil PAKI.ghx (Grasshopper 1.0.8)
# Copyright: Lorin Wiedemeier

pipeline = GeometryPipeline(
    GroupByLayer=False,
    GroupByType=False,
    IncludeHidden=True,
    IncludeLocked=True,
    LayerFilter="Frame Beam Lines**",
    NameFilter="*",
    SublayerFiltering=True,
    TypeFilter=4)
pipeline_2 = GeometryPipeline(
    GroupByLayer=False,
    GroupByType=False,
    IncludeHidden=True,
    IncludeLocked=True,
    LayerFilter="Plate Beam Lines**",
    NameFilter="*",
    SublayerFiltering=True,
    TypeFilter=4)
pipeline_3 = GeometryPipeline(
    GroupByLayer=False,
    GroupByType=False,
    IncludeHidden=True,
    IncludeLocked=True,
    LayerFilter="Foundation Points**",
    NameFilter="*",
    SublayerFiltering=True,
    TypeFilter=1)
pipeline_4 = GeometryPipeline(
    GroupByLayer=False,
    GroupByType=False,
    IncludeHidden=True,
    IncludeLocked=True,
    LayerFilter="Plate Lines**",
    NameFilter="*",
    SublayerFiltering=True,
    TypeFilter=4)

install = CompasPyTemplate(a=pipeline_4)  # -> a; inputs a: Brep
# ---------- install: Python ----------
# r: compas==2.15.1,timber_design==0.2.0,compas_fab==1.1.4
# venv: ca-fs26-focus-work

ghenv.Component.Message = "Install"
# ---------- end install ----------
crv = Curve(pipeline_2)
crv_2 = Curve(pipeline)
plate_bea = Explode(Curve=crv, Recursive=True)  # -> flatten(Segments), Vertices
explode = Explode(Curve=crv_2, Recursive=True)  # -> flatten(Segments), Vertices
pt = Point(pipeline_3)
crv_3 = Curve(install)

plate_beam_width = Slider(0.09, range=0..0.1)
plate_beam_height = Slider(0.09, range=0..0.1)
frame_beam_width = Slider(0.08, range=0..0.1)
frame_beam_height = Slider(0.06, range=0..0.1)
number_slider = Slider(0.03, range=0..0.1)
# Check Hole Segments before committing BTLx
toggle = BooleanToggle(True)
# Focus Work - Stencil
stencil = Python3Script(
    points=pt,
    rectangles=crv_3,
    plate_beam_lines=plate_bea.Segments,
    frame_beam_lines=explode.Segments,
    plate_thickness=number_slider,
    hole_radius=Slider(0.0385, range=0..0.1),
    hole_segments=Slider(22, range=0..100),
    plate_beam_width=plate_beam_width,
    plate_beam_height=plate_beam_height,
    frame_beam_width=frame_beam_width,
    frame_beam_height=frame_beam_height,
    process_joinery=Toggle(True),
    compute_plate_geometry=toggle)  # -> out, timber_model, plates_out, plates_brep_out, plate_holes_out, hole_volumes_out, plate_openings, plate_beams_out, frame_beams_out; inputs points: list of Point3d, rectangles: list of Rectangle3d, plate_beam_lines: list of Line, frame_beam_lines: list of Line, hole_segments: Int32, process_joinery: Boolean, compute_plate_geometry: Boolean
# ---------- stencil: Python ----------
# r: compas==2.15.1,timber_design==0.2.0,compas_fab==1.1.4
# venv: ca-fs26-focus-work

from compas_rhino.devtools import DevTools

DevTools.ensure_path()
ghenv.Component.Message = "Stencil"

from a03_stencil import create_stencil

# Inputs holen (mit deinen neuen Variablennamen für Linien und Dimensionen)
frame_beam_lines = vars().get("frame_beam_lines") or []
plate_beam_lines = vars().get("plate_beam_lines") or []

plate_thickness = vars().get("plate_thickness") or 0.010
hole_radius = vars().get("hole_radius") or 0.015
hole_segments = vars().get("hole_segments") or 24

# Dimensionen aufgeteilt
frame_beam_width = vars().get("frame_beam_width") or 0.060
frame_beam_height = vars().get("frame_beam_height") or 0.080
plate_beam_width = vars().get("plate_beam_width") or 0.040
plate_beam_height = vars().get("plate_beam_height") or 0.060

joint_max_distance = vars().get("joint_max_distance") or 0.020
tbutt_mill_depth = vars().get("tbutt_mill_depth") or 0.001
lap_cut_plane_bias = vars().get("lap_cut_plane_bias") or 0.5
flip_lap_side = vars().get("flip_lap_side") or False
include_x_lap = vars().get("include_x_lap")
include_x_lap = True if include_x_lap is None else include_x_lap
process_joinery = vars().get("process_joinery") or False
compute_plate_geometry = vars().get("compute_plate_geometry")
compute_plate_geometry = False if compute_plate_geometry is None else compute_plate_geometry

# Funktion aufrufen
result = create_stencil(
    rectangles=rectangles,
    points=points,
    frame_beam_lines=frame_beam_lines,
    plate_beam_lines=plate_beam_lines,
    plate_thickness=plate_thickness,
    hole_radius=hole_radius,
    hole_segments=hole_segments,
    frame_beam_width=frame_beam_width,
    frame_beam_height=frame_beam_height,
    plate_beam_width=plate_beam_width,
    plate_beam_height=plate_beam_height,
    joint_max_distance=joint_max_distance,
    tbutt_mill_depth=tbutt_mill_depth,
    lap_cut_plane_bias=lap_cut_plane_bias,
    flip_lap_side=flip_lap_side,
    include_x_lap=include_x_lap,
    process_joinery=process_joinery,
    compute_plate_geometry=compute_plate_geometry,
)

# Outputs an Grasshopper übergeben (müssen exakt den Namen der rechten Ausgänge entsprechen)
plates = result["plates"]
frame_beams = result["frame_beams"]
plate_beams = result["plate_beams"]

plates_out = result["plates_out"]
plates_brep_out = result["plates_brep_out"]
hole_volumes_out = result["hole_volumes_out"]

frame_beams_out = result["frame_beams_out"]
plate_beams_out = result["plate_beams_out"]

plate_holes_out = result["plate_holes_out"]
plate_holes_rhino = result["plate_holes_rhino"]
plates_rhino = result["plates_rhino"]

# plates_out = result["plates_out"]
# frame_beams_out = result["frame_beams_out"]    # angepasst
# plate_beams_out = result["plate_beams_out"]    # angepasst

# plate_holes_out = result["plate_holes_out"]
# plate_holes_rhino = result["plate_holes_rhino"]
# plates_rhino = result["plates_rhino"]

# frame_beams_rhino = result["frame_beams_rhino"]
# plate_beams_rhino = result["plate_beams_rhino"]
# frame_beams_rhino = result["frame_beams_rhino"] # angepasst
# plate_beams_rhino = result["plate_beams_rhino"] # angepasst

geometry_errors = result["geometry_errors"]
joints = result["joints"]
joint_count = result["joint_count"]
joint_types = result["joint_types"]
joint_errors = result["joint_errors"]
joining_errors = result["joining_errors"]
unjoined_clusters = result["unjoined_clusters"]
timber_model = result["timber_model"]

# =============================================================================
# DEBUG TIMBER MODEL
# =============================================================================

try:
    out = "TYPE timber_model: {}\nMODULE: {}\nHAS beams: {}\nHAS plates: {}\nN beams: {}\nN plates: {}".format(
        type(timber_model).__name__,
        type(timber_model).__module__,
        hasattr(timber_model, "beams"),
        hasattr(timber_model, "plates"),
        len(list(timber_model.beams)) if hasattr(timber_model, "beams") else "NO beams",
        len(list(timber_model.plates)) if hasattr(timber_model, "plates") else "NO plates"
    )
except Exception as e:
    out = "Errore controllo timber_model: {}".format(e)
# ---------- end stencil ----------
draw = COMPASDraw(cg=stencil.plate_holes_out)  # -> rg
#   port cg: The COMPAS geometry or datastructure to be drawn.
#   port rg: The Rhino geometry object.
# ---------- draw: Python ----------
# r: compas>=2.14.1
"""
Draws COMPAS geometry in Grasshopper.
"""

from typing import Any

import Grasshopper

from compas.scene import SceneObject


class CompasToRhinoGeometry(Grasshopper.Kernel.GH_ScriptInstance):
    def RunScript(self, cg):
        if not cg:
            return None

        return SceneObject(item=cg).draw()
# ---------- end draw ----------
draw_2 = COMPASDraw(cg=stencil.plates_out)  # -> rg; same code as draw

draw_3 = COMPASDraw(cg=stencil.plate_openings)  # -> rg; same code as draw
draw_4 = COMPASDraw(cg=stencil.frame_beams_out)  # -> rg; same code as draw
draw_5 = COMPASDraw(cg=stencil.plate_beams_out)  # -> rg; same code as draw
panel = Panel(stencil.out)
custom_preview = CustomPreview(
    Geometry=stencil.plates_brep_out,
    Material={diffuse=RGB(221, 160, 221), emission=RGB(66, 48, 66), shine=0.5, specular=RGB(255, 255, 255), transparency=0})
custom_preview_2 = CustomPreview(
    Geometry=stencil.hole_volumes_out,
    Material={diffuse=RGB(221, 160, 221), emission=RGB(66, 48, 66), shine=0.5, specular=RGB(255, 255, 255), transparency=0})
negative = Negative(Value=number_slider)
file_path = FilePath("C:\Users\paola\OneDrive\Desktop\Kernfächer\Focus Work\coding_architecture_fs26_focus_work\working_directory\group_c\stencil\plate holes\btlx-stencil-test.btlx")

stats = Python3Script(timber_model=stencil.timber_model)  # -> stats
# ---------- stats: Python ----------
# venv: ca-fs26-focus-work

from compas_rhino.devtools import DevTools
DevTools.ensure_path()
ghenv.Component.Message = "Beam Length Stats"

# ------------------------------------------------------------------ #
# Inputs (wire these in GH):
#   timber_model  –  TimberModel object from the model creator component
# ------------------------------------------------------------------ #
# Outputs:
#   stats          –  human-readable summary string
#   category_names –  list of category strings
#   lengths_total  –  total centerline length per category [m]
#   lengths_avg    –  average beam length per category [m]
#   counts         –  number of beams per category
# ------------------------------------------------------------------ #

from collections import defaultdict

cat_lengths = defaultdict(list)

for beam in timber_model.beams:
    cat = beam.attributes.get("category", "unknown")
    cat_lengths[cat].append(beam.centerline.length)

category_names = []
lengths_total = []
lengths_avg = []
counts = []

lines = ["--- BEAM LENGTH STATS ---"]

for cat in sorted(cat_lengths.keys()):
    beam_lens = cat_lengths[cat]
    n = len(beam_lens)
    total = sum(beam_lens)
    avg = total / n

    category_names.append(cat)
    lengths_total.append(total)
    lengths_avg.append(avg)
    counts.append(n)

    lines.append(
        "{:10s}  {:3d} beams  total {:7.3f} m  avg {:6.3f} m".format(
            cat, n, total, avg
        )
    )

grand_total = sum(lengths_total)
lines.append("-------------------------")
lines.append("TOTAL       {:3d} beams  total {:7.3f} m".format(
    sum(counts), grand_total
))

stats = "\n".join(lines)
print(stats)
# ---------- end stats ----------
panel_2 = Panel(stats)

unit_z = UnitZ(Factor=negative)
python_3_script = Python3Script(model=stencil.timber_model, path=file_path, write=Button())  # -> out, a; inputs path: String, write: Boolean
# ---------- python_3_script: Python ----------
"""Writes a BTLx file for machining of model parts."""

from compas_timber.fabrication import BTLxWriter




btlx = BTLxWriter(path)

if write:
    
    XML = btlx.write(model, path)
else:
    XML = btlx.model_to_xml(model)
# ---------- end python_3_script ----------
extrude = Extrude(Base=draw, Direction=unit_z)
cap_holes = CapHoles(Brep=extrude)

reloader = CompasDevReloader()
# ---------- reloader: Python ----------
"""
------------------------------
Using VS Code as Python editor
------------------------------

The simplest way to start using VS Code as our editor, is
to place our Python code in files located IN THE SAME FOLDER as our Grasshopper file.

After we have done that, we need 2 steps: 

1. Enable the COMPAS reloader on one component. This tells Grasshopper to watch for changes in the Pythoh files and reload if changed.
2. Every other component that uses Python code from external files needs to start with a method to ensure Grasshopper knows where to load the files from.

"""
# venv: ca-fs26-focus-work

from compas_rhino.devtools import DevTools
DevTools.enable_reloader()
# ---------- end reloader ----------
